# Grasshopper definition 20251030.gh (Grasshopper 1.0.8)
# plug-ins: Shaper3D For Rhino 7, RhinoCodePluginGH, Pufferfish, Firefly.X, BodyAnalytics, gHowl

trigger = Trigger(Interval=500, TimerInterval=500, Target=button)  # disabled
button = Button()
osc_listener = OSCListener(Port="9000", Reset=button)
panel = Panel(osc_listener)
item = ListItem(List=osc_listener, Index="1", Wrap=True)
panel_2 = Panel(item)
split = TextSplit(Text=item, Separators=",")
panel_3 = Panel(split)
item_2 = ListItem(List=panel_3, Index=0, Wrap=True)  # -> simplify(flatten(Item)), Item1, Item2, Item3
joy = Panel(item_2.Item)
crv = Curve(<curve referenced from the Rhino model>)
point = Point()

# ---- group: 坐标系转化
srf = Surface(<surface referenced from the Rhino model>)
pln = Plane(srf)
flip_plane = FlipPlane(Plane=pln, ReverseX=False, ReverseY=False, SwapAxes=True)
deplane = DeconstructPlane(Plane=flip_plane)  # -> Origin, XAxis, YAxis, ZAxis
deplane_2 = DeconstructPlane(Plane=flip_plane)  # -> Origin, XAxis, YAxis, ZAxis
vec = Vector(deplane_2.XAxis)
vec_2 = Vector(deplane.ZAxis)
line_sdl = LineSDL(Start=deplane.Origin, Direction=vec_2, Length=Slider(1, range=0..1))
pt = Point(flip_plane)
vdis = VectorDisplay(Anchor=pt, Vector=vec_2)
rotate_axis = RotateAxis(Geometry=flip_plane, Angle=degrees(Slider(90, range=0..100)), Axis=line_sdl)  # -> Geometry, Transform
xy = XYPlane(Origin=Point(0, 0, 0))
zed深度相机缩放比例 = Slider(1.129, range=0..10)
deplane_3 = DeconstructPlane(Plane=xy)  # -> Origin, XAxis, YAxis, ZAxis
scale = Scale(Geometry=point, Center=deplane_3.Origin, Factor=zed深度相机缩放比例)  # -> Geometry, Transform
orient = Orient(Geometry=scale.Geometry, Source=xy, Target=rotate_axis.Geometry)  # -> Geometry, Transform

# ----
deplane_4 = DeconstructPlane(Plane=rotate_axis.Geometry)  # -> Origin, XAxis, YAxis, ZAxis
vector = Vector(rotate_axis.Geometry)
vector_display = VectorDisplay(Anchor=deplane_4.Origin, Vector=vector)

# ----
# 这颗电池负责连接服务器
boolean_toggle = BooleanToggle(True)

# ----
# 一个实验对象
# 1、自动控制体验
# --换线，换成手动控制（slider）
# 2、手动控制（语音控制）体验
# --换线，自动控制
# 3、填写问卷
# 
# （测试下一个实验对象）
serverconnector = ServerConnector(Host="127.0.0.1", Port="8899", Run=boolean_toggle)
crv_2 = Curve(<curve referenced from the Rhino model>)

# ---- group: 相机位置信息
crv_3 = Curve(<curve referenced from the Rhino model>)
xy_plane = XYPlane(Origin=Point(0, 0, 0))
unit_z = UnitZ(Factor=1)
vector_2 = Vector(deplane_4.XAxis)
vector_3 = Vector(crv_3)
vector_4 = Vector(deplane_4.YAxis)
deconstruct = Deconstruct(Point=deplane_4.Origin)  # -> XComponent, YComponent, ZComponent
plane_closest_point = PlaneClosestPoint(Point=deplane_4.Origin, Plane=xy_plane)  # -> Point, UVPoint, Distance
angle = Angle(VectorA=vector_2, VectorB=vector_3)  # -> Angle, Reflex
angle_2 = Angle(VectorA=vector_4, VectorB=unit_z)  # -> Angle, Reflex
degrees = Degrees(Radians=angle_2.Angle)
degrees_2 = Degrees(Radians=angle.Angle)
相机高度 = Panel(deconstruct.ZComponent)
pull_point = PullPoint(Point=plane_closest_point.Point, Geometry=crv_2, ClosestOnly=True)  # -> ClosestPoint, Distance
相机水平角度 = Panel(degrees_2)
相机垂直角度 = Panel(degrees)
distance = Distance()

# ----
panel_4 = Panel(pull_point.Distance)

# ---- group: Rhino里人的位置微调
# 实验前准备：
# 调整位置：
# 人站在距离深度相机前2米，正对深度相机
# 调整坐标轴至正确位置
# 若quest中mesh的位置有偏差 略微调整zy坐标
# 若在rhino中看到人的位置相对红色mesh有偏差，调整zy坐标
z = Slider(0.001, range=-1..1)
# 实验流程：
y = Slider(0.478, range=-1..1)

# ----
Z = UnitZ(Factor=z)
Y = UnitY(Factor=y)

# ---- group: VR里mesh的位置调整
# 谁来操作？
# 用什么电脑？
# 表情控制要不要加？
# 操作方式
# 说明：
# 一共有五种状态、对应五种变化方式
# 其中协作状态-分隔与注意力-对侧高度与人的位置有关（映射到地面的位置）
# 其他变化与人的位置无关
# 调试模式下切换自动和手动（slider）控制：将不同的源连接到红色框的“relay”
z_2 = Slider(1.128, range=0..2, expression="-X")
y_2 = Slider(1.841, range=0..10)

# ----
# 模式切换
# 调试模式：
# 可以单个测试
# 
# 自动控制模式：
# 全部通过姿态和位置计算
# 
# 手动控制模式：
# 位置自动检测
# 其他手动控制
# 0-调试模式
# 1-自动控制模式
# 2-手动控制模式
模式切换 = Slider(2, range=0..2)

number_slider = Slider(4, range=0..10)
number_slider_2 = Slider(4, range=0..10)
flatten = FlattenTree(Tree=joy, Path="{0}")
suirify = Suirify(flatten)

# ---- group: 面部尺度（是否需要）
# 切换时点击recorder  “×”
panel_5 = Panel(suirify)
情绪状态_joy_手动控制_控制颜色_红色 = Slider(0, range=0..1)

# ----
join = TextJoin(Text=["Emotional State:", 情绪状态_joy_手动控制_控制颜色_红色])
# 手动模式下打开trigger，其他时候可以关闭
trigger_2 = Trigger(Interval=100, TimerInterval=100, Target=udp)

# ---- group: 手动控制菜单窗口
控制中间分隔_0_1 = Slider(1, range=0..1)
控制开放度_0_3 = Slider(0, range=0..3)
控制规整度_0_4 = Slider(1, range=0..4)
控制对侧高度_0_3 = Slider(3, range=0..3)
控制颜色深度_红色_0_4 = Slider(0, range=0..4)

# ----
udp = UDPReceiver(Address="127.0.0.1", Port="11000", Pattern=0)  # -> Info, Data
panel_6 = Panel(udp.Data)

控制近端高度 = Slider(1, range=0..1)
控制近端宽度 = Slider(1, range=0..1)
控制远端宽度 = Slider(1, range=0..1)

split_2 = TextSplit(Text=panel_6, Separators=",")  # -> flatten(Result)
item_3 = ListItem(List=split_2, Index=0, Wrap=True)  # -> Item, Item1, Item2, Item3, Item4
remap = RemapNumbers(Value=[控制开放度_0_3, 控制对侧高度_0_3], Source="0 to 3", Target="0 to 1")  # -> Mapped, Clipped
remap_2 = RemapNumbers(Value=[控制规整度_0_4, 控制颜色深度_红色_0_4], Source="0 to 4 ", Target="0 to 1")  # -> Mapped, Clipped
item_4 = ListItem(List=remap.Clipped, Index=0, Wrap=True)  # -> Item, Item1
item_5 = ListItem(List=remap_2.Clipped, Index=0, Wrap=True)  # -> Item, Item1
# “对侧”的位置与人的位置相关,人在的位置永远为高点
# joy值（表情）0-1
# 0→白色
# 1→最红
a = Python3Script(test=情绪状态_joy_手动控制_控制颜色_红色, adaptive=情绪状态_joy_手动控制_控制颜色_红色, manual=item_5.Item1, x=模式切换)  # -> out, a
# ---------- a: Python ----------
if x == 1:
    a = adaptive
if x == 2:
    a = manual
if x == 0:
    a = test
# ---------- end a ----------
panel_7 = Panel(split_2)
subtraction = Subtraction(A="1", B=控制近端高度)
subtraction_2 = Subtraction(A="1", B=控制近端宽度)
subtraction_3 = Subtraction(A="1", B=控制远端宽度)
remap_3 = RemapNumbers(Value=item_4.Item, Source=Domain(0, 1), Target="0.3 to 0.9")  # -> Mapped, Clipped
panel_8 = Panel(控制中间分隔_0_1)
remap_4 = RemapNumbers(Value=item_5.Item, Source=Domain(0, 1), Target="0.3 to 0.8")  # -> Mapped, Clipped
subtraction_4 = Subtraction(A="1", B=remap_4.Clipped)
subtraction_5 = Subtraction(A="1", B=控制中间分隔_0_1)
subtraction_6 = Subtraction(A="1", B=item_4.Item1)
速度_值越大越慢 = Slider(5, range=0..100)
速度_值越大越慢_2 = Slider(5, range=0..100)
速度_值越大越慢_3 = Slider(5, range=0..100)
panel_9 = Panel(subtraction_5)
panel_10 = Panel(remap_3.Mapped)
panel_11 = Panel(subtraction_4)
panel_12 = Panel(subtraction_6)
panel_13 = Panel(item_5.Item1)

# ---- group: 1 / 第1个人的位置（手动控制） / 第1个人的位置（手动控制xy坐标）
number_slider_3 = Slider(-1.248, range=-3..3)
number_slider_4 = Slider(-0.348, range=-2..2)

# ---- group: 0 / 第0个人的位置（手动控制） / 第0个人的位置（手动控制xy坐标）
x = Slider(-0.176, range=-2..2)
y_3 = Slider(0.577, range=-5..5)

# ----
trigger_3 = Trigger(Interval=200, TimerInterval=200, Target=rec_6)
trigger_4 = Trigger(Interval=200, TimerInterval=200, Target=rec_12)
trigger_5 = Trigger(Interval=200, TimerInterval=200, Target=rec_5)

# ---- group: 情绪 颜色 / 色相 / anger
number_slider_5 = Slider(0.686, range=0..1)
swatch = ColourSwatch(SwatchColor=RGB(105, 143, 209))

# ---- group: 情绪 颜色 / 色相 / joy
number_slider_6 = Slider(0, range=0..1)
swatch_2 = ColourSwatch(SwatchColor=RGB(224, 126, 126))

# ---- group: 情绪 颜色 / 色相 / sorrow
number_slider_7 = Slider(0.01, range=0..1)
swatch_3 = ColourSwatch(SwatchColor=RGB(148, 148, 148))

# ---- group: 情绪 颜色 / 色相 / surprise
number_slider_8 = Slider(0.102, range=0..1)
swatch_4 = ColourSwatch(SwatchColor=RGB(114, 194, 107))

# ---- group: 情绪 颜色
明度 = Slider(-0.03, range=-0.1..0.1)
饱和度 = Slider(-0.033, range=-0.1..0.1)

# ----
relay = Relay()
relay_2 = Relay()
relay_3 = Relay()
relay_4 = Relay()
X = UnitX(Factor=number_slider_4)
xy_2 = XYPlane(Origin=Point(0, 0, 0))
Y_2 = UnitY(Factor=number_slider_3)
pt_2 = Point(<point referenced from the Rhino model>)
move = Move(Geometry=pt_2, Motion=X)  # -> Geometry, Transform

# ---- group: 1
move_2 = Move(Geometry=move.Geometry, Motion=Y_2)  # -> Geometry, Transform

# ----
Y_3 = UnitY(Factor=y_3)
X_2 = UnitX(Factor=x)
move_3 = Move(Geometry=pt_2, Motion=X_2)  # -> Geometry, Transform

# ---- group: 坐标点替换 0
move_4 = Move(Geometry=move_3.Geometry, Motion=Y_3)  # -> Geometry, Transform

# ----
ghpython_script = GhPythonScript(x=subtraction)  # -> out, a
# ---------- ghpython_script: Python ----------
__author__ = "lmh"
__version__ = "2024.06.21"

import rhinoscriptsyntax as rs
if x or x == 0:
    a = x
else:
    a = 0
# ---------- end ghpython_script ----------
ghpython_script_2 = GhPythonScript(x=subtraction_2)  # -> out, a; same code as ghpython_script
ghpython_script_3 = GhPythonScript(x=subtraction_3)  # -> out, a; same code as ghpython_script

# ---- group: test null
# 修改
# 网格数量
# 高宽阈值
# 进入空间引起高宽变化的范围
# 分隔范围
# 缝隙大小
# 开放度阈值
# 档位调试
null_empty = Panel("")
python = GhPythonScript(x=null_empty)  # -> out, a
# ---------- python: Python ----------
__author__ = "lmh"
__version__ = "2024.06.21"

import rhinoscriptsyntax as rs
if x or x == 0:
    a = x
else:
    a = null
# ---------- end python ----------

# ----
pt_3 = Point(<point referenced from the Rhino model>)
pt_4 = Point(<point referenced from the Rhino model>)
crv_4 = Curve(<curve referenced from the Rhino model>)
crv_5 = Curve(<curve referenced from the Rhino model>)
crv_6 = Curve(<curve referenced from the Rhino model>)
crv_7 = Curve(<curve referenced from the Rhino model>)
crv_8 = Curve(<curve referenced from the Rhino model>)
crv_9 = Curve(<curve referenced from the Rhino model>)
crv_10 = Curve(<curve referenced from the Rhino model>)
crv_11 = Curve(<curve referenced from the Rhino model>)
crv_12 = Curve(<curve referenced from the Rhino model>)
crv_13 = Curve(<curve referenced from the Rhino model>)
crv_14 = Curve(<curve referenced from the Rhino model>)
flip = FlipCurve(Curve=crv_10)  # -> Curve, Flag
flip_2 = FlipCurve(Curve=crv_5)  # -> Curve, Flag
flip_3 = FlipCurve(Curve=crv_11)  # -> Curve, Flag
flip_4 = FlipCurve(Curve=crv_6)  # -> Curve, Flag
flip_5 = FlipCurve(Curve=crv_14)  # -> Curve, Flag
flip_6 = FlipCurve(Curve=crv_12)  # -> Curve, Flag
flip_7 = FlipCurve(Curve=crv_7)  # -> Curve, Flag

# ---- group: 红色控制
swatch_5 = ColourSwatch(SwatchColor=RGB(255, 255, 255))
swatch_6 = ColourSwatch(SwatchColor=RGB(240, 194, 194))
swatch_7 = ColourSwatch(SwatchColor=RGB(224, 144, 144))
swatch_8 = ColourSwatch(SwatchColor=RGB(227, 107, 107))
swatch_9 = ColourSwatch(SwatchColor=RGB(235, 91, 91))

# ----
vec_3 = Vector(crv_13)
vec_4 = Vector(flip_5.Curve)

# ---- group: 高度宽度 / 高宽阈值
高度缩小阈值 = Slider(1, range=0..1)
宽度缩小阈值 = Slider(0.76, range=0..1)

# ----
crv_15 = Curve(<curve referenced from the Rhino model>)
crv_16 = Curve(<curve referenced from the Rhino model>)
crv_17 = Curve(<curve referenced from the Rhino model>)
crv_18 = Curve(<curve referenced from the Rhino model>)
crv_19 = Curve(<curve referenced from the Rhino model>)
crv_20 = Curve(<curve referenced from the Rhino model>)
crv_21 = Curve(<curve referenced from the Rhino model>)
crv_22 = Curve(<curve referenced from the Rhino model>)
crv_23 = Curve(<curve referenced from the Rhino model>)
pt_5 = Point(<point referenced from the Rhino model>)
pt_6 = Point(<point referenced from the Rhino model>)
flip_8 = FlipCurve(Curve=crv_17)  # -> Curve, Flag
flip_9 = FlipCurve(Curve=crv_22)  # -> Curve, Flag
flip_10 = FlipCurve(Curve=crv_20)  # -> Curve, Flag
flip_11 = FlipCurve(Curve=crv_23)  # -> Curve, Flag
速度_越大越慢 = Slider(5, range=0..100)

# ---- group: 分隔 / 范围线
crv_24 = Curve(<curve referenced from the Rhino model>)
crv_25 = Curve(<curve referenced from the Rhino model>)

# ----
number_slider_9 = Slider(0, range=0..1)
number_slider_10 = Slider(0.01, range=0..0.01)
number_slider_11 = Slider(0.753, range=0..1)
number_slider_12 = Slider(0.249, range=0..1)
number_slider_13 = Slider(0.757, range=0..1)
subtraction_7 = Subtraction(A=number_slider_13, B=number_slider_10)
expression = Expression(x=number_slider_9, Expression="1-X")
number_slider_14 = Slider(0.01, range=0..0.01)
number_slider_15 = Slider(0.757, range=0..1)
eval = EvaluateCurve(Curve=reparameterize(flip_6.Curve), Parameter=Slider(0.25, range=0..1))  # -> Point, Tangent, Angle
eval_2 = EvaluateCurve(Curve=reparameterize(crv_9), Parameter=number_slider_12)  # -> Point, Tangent, Angle
eval_3 = EvaluateCurve(Curve=reparameterize(crv_9), Parameter=number_slider_12)  # -> Point, Tangent, Angle
eval_4 = EvaluateCurve(Curve=reparameterize(crv_9), Parameter=number_slider_13)  # -> Point, Tangent, Angle
eval_5 = EvaluateCurve(Curve=reparameterize(crv_9), Parameter=number_slider_13)  # -> Point, Tangent, Angle
eval_6 = EvaluateCurve(Curve=reparameterize(crv_9), Parameter=subtraction_7)  # -> Point, Tangent, Angle
eval_7 = EvaluateCurve(Curve=reparameterize(crv_9), Parameter=number_slider_13)  # -> Point, Tangent, Angle
eval_8 = EvaluateCurve(Curve=reparameterize(crv_9), Parameter=subtraction_7)  # -> Point, Tangent, Angle
eval_9 = EvaluateCurve(Curve=reparameterize(flip.Curve), Parameter=number_slider_9)  # -> Point, Tangent, Angle
eval_10 = EvaluateCurve(Curve=reparameterize(crv_8), Parameter=expression)  # -> Point, Tangent, Angle
eval_11 = EvaluateCurve(Curve=reparameterize(flip_4.Curve), Parameter=number_slider_9)  # -> Point, Tangent, Angle
eval_12 = EvaluateCurve(Curve=reparameterize(flip_6.Curve), Parameter=number_slider_11)  # -> Point, Tangent, Angle
eval_13 = EvaluateCurve(Curve=reparameterize(flip_6.Curve), Parameter=number_slider_11)  # -> Point, Tangent, Angle
eval_14 = EvaluateCurve(Curve=reparameterize(flip_7.Curve), Parameter=number_slider_9)  # -> Point, Tangent, Angle
eval_15 = EvaluateCurve(Curve=crv_4, Parameter=number_slider_9)  # -> Point, Tangent, Angle
subtraction_8 = Subtraction(A=number_slider_15, B=number_slider_14)
速度_越大越慢_2 = Slider(5, range=0..100)
自定义人数 = Slider(2, range=0..10)
eval_16 = EvaluateCurve(Curve=reparameterize(crv_16), Parameter=Slider(0.249, range=0..1))  # -> Point, Tangent, Angle
eval_17 = EvaluateCurve(Curve=reparameterize(crv_16), Parameter=number_slider_15)  # -> Point, Tangent, Angle
eval_18 = EvaluateCurve(Curve=reparameterize(crv_16), Parameter=subtraction_8)  # -> Point, Tangent, Angle
eval_19 = EvaluateCurve(Curve=reparameterize(crv_21), Parameter=Slider(0.25, range=0..1))  # -> Point, Tangent, Angle
eval_20 = EvaluateCurve(Curve=reparameterize(crv_21), Parameter=Slider(0.753, range=0..1))  # -> Point, Tangent, Angle
panel_14 = Panel("1")
trigger_6 = Trigger(Interval=200, TimerInterval=200, Target=rec_10)
vec2pt = Vector2Pt(PointA=eval_5.Point, PointB=eval_6.Point, Unitize=False)  # -> Vector, Length
vec2pt_2 = Vector2Pt(PointA=eval_5.Point, PointB=eval_6.Point, Unitize=False)  # -> Vector, Length
python_2 = GhPythonScript(x=a.a)  # -> out, simplify(a); same code as python
vec2pt_3 = Vector2Pt(PointA=eval_17.Point, PointB=eval_18.Point, Unitize=False)  # -> Vector, Length

# ---- group: 网格数设定
number_slider_16 = Slider(1, range=0..10)
number_slider_17 = Slider(5, range=0..10)
number_slider_18 = Slider(5, range=0..10)

# ----
number_slider_19 = Slider(0.984, range=0..1)
data_recorder = DataRecorder(flatten(python_2.a), DataLimit=-10, RecordData=True)
null = NullItem(Item=data_recorder)  # -> NullFlags, InvalidFlags, Description
panel_15 = Panel(python_2.a)
not = GateNot(A=null.NullFlags)
dispatch = Dispatch(List=data_recorder, DispatchPattern=not)  # -> ListA, ListB
panel_16 = Panel(data_recorder)
list_item = ListItem(List=dispatch.ListA, Index="-1", Wrap=True)
python_3 = GhPythonScript(x=list_item, w=swatch_5, z1=swatch_6, z2=swatch_7, z3=swatch_8, z4=swatch_9)  # -> out, a
# ---------- python_3: Python ----------
__author__ = "lmh"
__version__ = "2024.06.20"

import rhinoscriptsyntax as rs

if 0 <= x <= 0.2:
    a = w
if 0.2 < x <= 0.4:
    a = z1
if 0.4 < x <= 0.6:
    a = z2
if 0.6 < x <= 0.8:
    a = z3
if 0.8 < x <= 1:
    a = z4
# ---------- end python_3 ----------
panel_17 = Panel(dispatch.ListA)
argb = SplitARGB(Colour=python_3.a)  # -> Alpha, Red, Green, Blue
merge = Merge(Data1=argb.Red, Data2=argb.Green, Data3=argb.Blue)

number_slider_20 = Slider(11, range=0..100)
graft = GraftTree(Tree=merge, IncludeEmptyLists=True, IncludeNullItems=True)  # -> simplify(Tree)
trigger_7 = Trigger(Interval=200, TimerInterval=200, Target=rec)
toggle = BooleanToggle(True)
rec = DataRecorder(graft, DataLimit=30, RecordData=True)
trigger_8 = Trigger(Interval=20, TimerInterval=20, Target=[counter_3, counter_2, counter])
item_6 = ListItem(List=rec, Index="-2", Wrap=True)  # -> flatten(Item)
item_7 = ListItem(List=rec, Index="-1", Wrap=True)  # -> flatten(Item)
dcon = DeleteConsecutive(Set=rec, Wrap=False)  # -> Set, Count
subtraction_9 = Subtraction(A=item_7, B=item_6)
abs = Absolute(Value=subtraction_9)
item_8 = ListItem(List=abs, Index=0, Wrap=True)  # -> Item, Item1, Item2
counter = Counter(CountDirection=True, Step=1, StartStop=toggle, Reset=item_8.Item2, OptionalCounterDomain=number_slider_20)
counter_2 = Counter(CountDirection=True, Step=1, StartStop=toggle, Reset=item_8.Item1, OptionalCounterDomain=number_slider_20)
counter_3 = Counter(CountDirection=True, Step=1, StartStop=toggle, Reset=item_8.Item, OptionalCounterDomain=number_slider_20)
item_9 = ListItem(List=dcon.Set, Index="-2", Wrap=True)  # -> flatten(Item)
item_10 = ListItem(List=dcon.Set, Index="-1", Wrap=True)  # -> flatten(Item)
dom = ConstructDomain(DomainStart=item_9, DomainEnd=item_10)
merge_2 = Merge(Data1=counter_3, Data2=counter_2, Data3=counter)
remap_5 = RemapNumbers(Value=merge_2, Source=number_slider_20, Target=Domain(0, 1))  # -> Mapped, Clipped
python_4 = GhPythonScript(x=remap_5.Mapped)  # -> out, a
# ---------- python_4: Python ----------
__author__ = "lmh"
__version__ = "2024.06.11"

import rhinoscriptsyntax as rs
import math
if 0 <= x <= 1:
    a = (math.cos((x-1) * math.pi) + 1) / 2


if x > 1:
    a = 1
# ---------- end python_4 ----------
remap_6 = RemapNumbers(Value=python_4.a, Source=Domain(0, 1), Target=dom)  # -> Mapped, Clipped

item_11 = ListItem(List=remap_6.Mapped, Index=0, Wrap=True)  # -> Item, Item1, Item2
frgb = ColourRGBF(Alpha=1, Red=item_11.Item, Green=item_11.Item1, Blue=item_11.Item2)
ahsv = SplitAHSV(Colour=frgb)  # -> Alpha, Hue, Saturation, Value

# ----
# 这颗电池负责按一定刷新率激活
# 每次激活将最新数据传递给后面的gh电池。
number_slider_21 = Slider(250, range=100..5000)
# 输出一个自定义类型（body）
# 自带一个显示
receive = Receive(Interval=number_slider_21)  # -> Timestamp, Body, PyMessage, RCSLocation

addition = Addition(A=ahsv.Saturation, B=饱和度)
addition_2 = Addition(A=ahsv.Value, B=明度)
hsv = ColourHSV(Alpha="1", Hue=ahsv.Hue, Saturation=addition, Value=addition_2)
plane = Plane(receive.RCSLocation)
panel_18 = Panel(receive.Body)
panel_19 = Panel(receive.Timestamp)
body = Body(receive.Body)
list_item_2 = ListItem(List=body, Index="1", Wrap=True)
deconstruct_body = DeconstructBody(Body=list_item_2)  # -> Id, UniqueObjectId, ActionState, Position, Velocity, PositionCovariance, Confidence, HeadPosition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
panel_20 = Panel(receive.PyMessage)
list_item_3 = ListItem(List=body, Index=0, Wrap=True)
pt_7 = Point(deconstruct_body.Keypoints)
# 将Body对象解构
deconstruct_body_2 = DeconstructBody(Body=list_item_3)  # -> Id, UniqueObjectId, ActionState, Position, Velocity, PositionCovariance, Confidence, HeadPosition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
center_box = CenterBox(Base=plane, X="0.05", Y="0.05", Z="0.05")
panel_21 = Panel(pt_7)
panel_22 = Panel(deconstruct_body_2.Id)
# 网格线（待定）
point_2 = Point(deconstruct_body_2.BoundingBox)
pt_8 = Point(deconstruct_body_2.Keypoints)
entwine = Entwine(Branch00=pt_8, Branch01=pt_7, FlattenInputs=True)
list_item_4 = ListItem(List=point_2, Index=4, Wrap=True)
suirify_2 = Suirify(entwine)
panel_23 = Panel(deconstruct_body_2.Keypoints)
list_item_5 = ListItem(List=point_2, Index=6, Wrap=True)
box_2pt = Box2Pt(PointA=list_item_4, PointB=list_item_5, Plane=PlaneXY(0, 0, 0))
mesh_colours = MeshColours(Mesh=box_2pt, Colours=ColourSwatch(SwatchColor=RGB(252, 134, 134)))
mesh_colours_2 = MeshColours(Mesh=center_box, Colours=ColourSwatch(SwatchColor=RGB(72, 255, 0)))
# 负责输出数据给Server
panel_24 = Panel("我是GH")
mesh_join = MeshJoin(Meshes=flatten([mesh_colours_2, mesh_colours]))
number_slider_22 = Slider(5, range=0..100)

panel_25 = Panel("""0
1
2
3
26
27""")
panel_26 = Panel("""27
28
29""")
panel_27 = Panel("""27
30
31""")
panel_28 = Panel("""2
4
5
6
7
8
9""")
panel_29 = Panel("""7
10""")
panel_30 = Panel("""2
11
12
13
14
15
16""")
panel_31 = Panel("""14
17""")
panel_32 = Panel("""0
22
23
24
25""")
# 看看取的是谁的
panel_33 = Panel("""24
33""")
panel_34 = Panel("""0
18
19
20
21""")
panel_35 = Panel("""20
32""")

肘关节夹角 = Panel("""18
19
20""")
肩部夹角 = Panel("""13
12
22""")
肘关节夹角_2 = Panel("""22
23
24""")
肩部夹角_2 = Panel("""6
5
18""")
躯干_大腿夹角 = Panel("""4
18
19""")
肘关节夹角_3 = Panel("""5
6
7""")
躯干_大腿夹角_2 = Panel("""11
22
23""")
肘关节夹角_4 = Panel("""12
13
14""")

阈值角度 = Slider(30, range=0..100)

# ---- group: 全局身体姿态尺度
# 切换时点击recorder  “×”
# 切换时点击recorder  “×”
全身身体状态手动控制_控制开放度 = Slider(0, range=0..1)
上肢身体状态手动控制_控制规整度 = Slider(1, range=0..1)

# ---- group: 局部姿态尺度
# 切换时点击recorder  “×”
注意力状态手动控制_控制对侧高度 = Slider(0, range=0..1)

# ---- group: 社交尺度
# 切换时改z（若需要）
协作状态手动控制_控制中间分隔 = Slider(1, range=0..1)

# ----
join_2 = TextJoin(Text=["Collaboration State:", 协作状态手动控制_控制中间分隔])

# ---- group: 分隔输入 远端高度
trigger_9 = Trigger(Interval=10, TimerInterval=10, Target=counter_16)

# ---- group: 分隔输入 开放度
trigger_10 = Trigger(Interval=10, TimerInterval=10, Target=counter_5)

# ---- group: 分隔输入 规整度
trigger_11 = Trigger(Interval=10, TimerInterval=10, Target=counter_4)

# ---- group: 高度宽度
ln = Line(StartPoint=eval_15.Point, EndPoint=eval_13.Point)
amp = Amplitude(Vector=ln, Amplitude=Slider(0.17, range=0..1))
dom_2 = ConstructDomain(DomainStart="0", DomainEnd=高度缩小阈值)
dom_3 = ConstructDomain(DomainStart="0", DomainEnd=宽度缩小阈值)
remap_7 = RemapNumbers(Value=ghpython_script.a, Source=Domain(0, 1), Target=dom_2)  # -> Mapped, Clipped
crv_26 = Curve(<curve referenced from the Rhino model>)
merge_3 = Merge(
    Data1=eval_15.Point,
    Data2=eval_13.Point,
    Data3=eval_14.Point,
    Data4=eval.Point,
    Data5=eval_11.Point,
    Data6=eval_2.Point,
    Data7=eval_10.Point,
    Data8=eval_7.Point,
    Data9=eval_9.Point)
remap_8 = RemapNumbers(Value=ghpython_script_2.a, Source=Domain(0, 1), Target=dom_3)  # -> Mapped, Clipped
remap_9 = RemapNumbers(Value=ghpython_script_3.a, Source=Domain(0, 1), Target=dom_3)  # -> Mapped, Clipped
panel_36 = Panel("""0
1
2
3
4
5
6
7
8""")
toggle_2 = BooleanToggle(True)
trigger_12 = Trigger(
    Interval=20,
    TimerInterval=20,
    Target=[counter_6, counter_7, counter_8, counter_9, counter_10, counter_13, counter_11, counter_12, counter_14])
merge_4 = Merge(Data1="1", Data2="1", Data3="1", Data4="1", Data5="1", Data6="2", Data7="2", Data8="2", Data9="2")
panel_37 = Panel("""0
0
0
0
0
0
0
0
0""")
trigger_13 = Trigger(Interval=200, TimerInterval=200, Target=rec_9)

# ----
move_5 = Move(Geometry=merge_3, Motion=amp)  # -> Geometry, Transform

# ---- group: 分隔
分隔离地面的高度 = Slider(0.3, range=0..1)
merge_5 = Merge(Data1=crv_24, Data2=crv_25)
pt_9 = ConstructPoint(XCoordinate="0", YCoordinate="0", ZCoordinate=分隔离地面的高度)
xy_3 = XYPlane(Origin=pt_9)
trigger_14 = Trigger(Interval=20, TimerInterval=20, Target=counter_15)

# ----
number_slider_23 = Slider(5, range=0..10)
number_slider_24 = Slider(1, range=0..10)

# ---- group: 片片
开放度最小百分比 = Slider(0.5, range=0..1)
construct_domain = ConstructDomain(DomainStart="1", DomainEnd=开放度最小百分比)

# ----
Z_2 = UnitZ(Factor=z_2)
Y_4 = UnitY(Factor=y_2)

move_6 = Move(Geometry=suirify_2, Motion=expr("-x", Z_2))  # -> Geometry, Transform
move_7 = Move(Geometry=move_6.Geometry, Motion=expr("-x", Y_4))  # -> Geometry, Transform
move_8 = Move(Geometry=move_7.Geometry, Motion=Z)  # -> Geometry, Transform
move_9 = Move(Geometry=move_8.Geometry, Motion=Y)  # -> Geometry, Transform

list_item_6 = ListItem(List=move_9.Geometry, Index=panel_26, Wrap=True)  # -> simplify(Item)
list_item_7 = ListItem(List=move_9.Geometry, Index=panel_25, Wrap=True)
list_item_8 = ListItem(List=move_9.Geometry, Index=panel_27, Wrap=True)
list_item_9 = ListItem(List=move_9.Geometry, Index=panel_28, Wrap=True)
list_item_10 = ListItem(List=move_9.Geometry, Index=panel_29, Wrap=True)
list_item_11 = ListItem(List=move_9.Geometry, Index=panel_30, Wrap=True)
list_item_12 = ListItem(List=move_9.Geometry, Index=panel_31, Wrap=True)
list_item_13 = ListItem(List=move_9.Geometry, Index=panel_32, Wrap=True)
list_item_14 = ListItem(List=move_9.Geometry, Index=panel_33, Wrap=True)
list_item_15 = ListItem(List=move_9.Geometry, Index=panel_34, Wrap=True)
list_item_16 = ListItem(List=move_9.Geometry, Index=panel_35, Wrap=True)
polyline = PolyLine(Vertices=list_item_7, Closed=False)
polyline_2 = PolyLine(Vertices=list_item_6, Closed=False)
polyline_3 = PolyLine(Vertices=list_item_8, Closed=False)
polyline_4 = PolyLine(Vertices=list_item_9, Closed=False)
polyline_5 = PolyLine(Vertices=list_item_10, Closed=False)
polyline_6 = PolyLine(Vertices=list_item_11, Closed=False)
polyline_7 = PolyLine(Vertices=list_item_12, Closed=False)
polyline_8 = PolyLine(Vertices=list_item_13, Closed=False)
polyline_9 = PolyLine(Vertices=list_item_14, Closed=False)
polyline_10 = PolyLine(Vertices=list_item_15, Closed=False)
polyline_11 = PolyLine(Vertices=list_item_16, Closed=False)
merge_6 = Merge(
    Data1=polyline,
    Data2=polyline_2,
    Data3=polyline_3,
    Data4=polyline_4,
    Data5=polyline_5,
    Data6=polyline_6,
    Data7=polyline_7,
    Data8=polyline_8,
    Data9=polyline_9,
    Data10=polyline_10,
    Data11=polyline_11)

panel_38 = Panel(move_9.Geometry)

# ---- group: 头部向量及位置
cluster = Cluster(list_3=move_9.Geometry, list=move_9.Geometry, list_2=move_9.Geometry)  # -> vector_2, i

# ---- group: 所有人的头
point_3 = Point(cluster.i)

# ----
viewer = ParamViewer(panel_38)
point_in_curve = PointInCurve(Point=point_3, Curve=crv)  # -> Relationship, Point
panel_39 = Panel(point_in_curve.Point)
equality = Equality(FirstNumber=point_in_curve.Relationship, SecondNumber=2)  # -> Equality, Inequality
# 分好枝干后的身体坐标
panel_40 = Panel(equality.Equality)
dispatch_2 = Dispatch(List=move_9.Geometry, DispatchPattern=equality.Equality)  # -> ListA, ListB
viewer_2 = ParamViewer(panel_40)
lng = ListLength(List=dispatch_2.ListA)
larger = LargerThan(FirstNumber=lng, SecondNumber="0")  # -> LargerThan, OrEqualTo
tstat = TreeStatistics(Tree=dispatch_2.ListA)  # -> Paths, Length, Count
panel_41 = Panel(tstat.Paths)
panel_42 = Panel(dispatch_2.ListA)
flatten_2 = FlattenTree(Tree=larger.LargerThan, Path="{0}")
mindex = MemberIndex(Set=flatten_2, Member=Toggle(True))  # -> Index, Count
dispatch_3 = Dispatch(List=point_in_curve.Point, DispatchPattern=equality.Equality)  # -> ListA, ListB
item_12 = ListItem(List=mindex.Index, Index=0, Wrap=True)
item_13 = ListItem(List=tstat.Paths, Index=item_12, Wrap=True)
branch = TreeBranch(Tree=dispatch_2.ListA, Path=item_13, MaintainPaths=True)
panel_43 = Panel(branch)

# ---- group: 选中的人
point_4 = Point(branch)

# ----
cluster_2 = Cluster_2(L=point_4)  # -> M, swatch

# ---- group: 范围内人的头映射
point_5 = Point(dispatch_3.ListA)

# ----
mcol = MeshColours(Mesh=cluster_2.M, Colours=cluster_2.swatch)

list_item_17 = ListItem(List=point_4, Index=肘关节夹角, Wrap=True)
list_item_18 = ListItem(List=point_4, Index=肘关节夹角_2, Wrap=True)
list_item_19 = ListItem(List=point_4, Index=躯干_大腿夹角, Wrap=True)
list_item_20 = ListItem(List=point_4, Index=肘关节夹角_3, Wrap=True)
list_item_21 = ListItem(List=point_4, Index=躯干_大腿夹角_2, Wrap=True)
list_item_22 = ListItem(List=point_4, Index=肘关节夹角_4, Wrap=True)
list_item_23 = ListItem(List=point_4, Index=肩部夹角_2, Wrap=True)
list_item_24 = ListItem(List=point_4, Index=肩部夹角, Wrap=True)
polyline_12 = PolyLine(Vertices=list_item_17, Closed=False)
polyline_13 = PolyLine(Vertices=list_item_18, Closed=False)
polyline_14 = PolyLine(Vertices=list_item_21, Closed=False)
polyline_15 = PolyLine(Vertices=list_item_20, Closed=False)
polyline_16 = PolyLine(Vertices=list_item_22, Closed=False)
polyline_17 = PolyLine(Vertices=list_item_19, Closed=False)
polyline_18 = PolyLine(Vertices=list_item_23, Closed=False)
polyline_19 = PolyLine(Vertices=list_item_24, Closed=False)
list_item_25 = ListItem(List=list_item_18, Index=0, Wrap=True)  # -> Item, Item1, Item2
list_item_26 = ListItem(List=list_item_21, Index=0, Wrap=True)  # -> Item, Item1, Item2
list_item_27 = ListItem(List=list_item_22, Index=0, Wrap=True)  # -> Item, Item1, Item2
list_item_28 = ListItem(List=list_item_17, Index=0, Wrap=True)  # -> Item, Item1, Item2
list_item_29 = ListItem(List=list_item_24, Index=0, Wrap=True)  # -> Item, Item1, Item2
list_item_30 = ListItem(List=list_item_19, Index=0, Wrap=True)  # -> Item, Item1, Item2
list_item_31 = ListItem(List=list_item_20, Index=0, Wrap=True)  # -> Item, Item1, Item2
list_item_32 = ListItem(List=list_item_23, Index=0, Wrap=True)  # -> Item, Item1, Item2
vector_2pt = Vector2Pt(PointA=list_item_25.Item, PointB=list_item_25.Item1, Unitize=False)  # -> Vector, Length
vector_2pt_2 = Vector2Pt(PointA=list_item_25.Item2, PointB=list_item_25.Item1, Unitize=False)  # -> Vector, Length
vector_2pt_3 = Vector2Pt(PointA=list_item_26.Item, PointB=list_item_26.Item1, Unitize=False)  # -> Vector, Length
vector_2pt_4 = Vector2Pt(PointA=list_item_26.Item2, PointB=list_item_26.Item1, Unitize=False)  # -> Vector, Length
vector_2pt_5 = Vector2Pt(PointA=list_item_27.Item, PointB=list_item_27.Item1, Unitize=False)  # -> Vector, Length
vector_2pt_6 = Vector2Pt(PointA=list_item_27.Item2, PointB=list_item_27.Item1, Unitize=False)  # -> Vector, Length
vector_2pt_7 = Vector2Pt(PointA=list_item_28.Item, PointB=list_item_28.Item1, Unitize=False)  # -> Vector, Length
vector_2pt_8 = Vector2Pt(PointA=list_item_28.Item2, PointB=list_item_28.Item1, Unitize=False)  # -> Vector, Length
vector_2pt_9 = Vector2Pt(PointA=list_item_29.Item, PointB=list_item_29.Item1, Unitize=False)  # -> Vector, Length
vector_2pt_10 = Vector2Pt(PointA=list_item_29.Item2, PointB=list_item_29.Item1, Unitize=False)  # -> Vector, Length
vector_2pt_11 = Vector2Pt(PointA=list_item_30.Item, PointB=list_item_30.Item1, Unitize=False)  # -> Vector, Length
vector_2pt_12 = Vector2Pt(PointA=list_item_30.Item2, PointB=list_item_30.Item1, Unitize=False)  # -> Vector, Length
vector_2pt_13 = Vector2Pt(PointA=list_item_31.Item, PointB=list_item_31.Item1, Unitize=False)  # -> Vector, Length
vector_2pt_14 = Vector2Pt(PointA=list_item_31.Item2, PointB=list_item_31.Item1, Unitize=False)  # -> Vector, Length
vector_2pt_15 = Vector2Pt(PointA=list_item_32.Item, PointB=list_item_32.Item1, Unitize=False)  # -> Vector, Length
vector_2pt_16 = Vector2Pt(PointA=list_item_32.Item2, PointB=list_item_32.Item1, Unitize=False)  # -> Vector, Length
angle_3 = Angle(VectorA=vector_2pt.Vector, VectorB=vector_2pt_2.Vector)  # -> Angle, Reflex
angle_4 = Angle(VectorA=vector_2pt_3.Vector, VectorB=vector_2pt_4.Vector)  # -> Angle, Reflex
angle_5 = Angle(VectorA=vector_2pt_5.Vector, VectorB=vector_2pt_6.Vector)  # -> Angle, Reflex
angle_6 = Angle(VectorA=vector_2pt_7.Vector, VectorB=vector_2pt_8.Vector)  # -> Angle, Reflex
angle_7 = Angle(VectorA=vector_2pt_9.Vector, VectorB=vector_2pt_10.Vector)  # -> Angle, Reflex
angle_8 = Angle(VectorA=vector_2pt_11.Vector, VectorB=vector_2pt_12.Vector)  # -> Angle, Reflex
angle_9 = Angle(VectorA=vector_2pt_13.Vector, VectorB=vector_2pt_14.Vector)  # -> Angle, Reflex
angle_10 = Angle(VectorA=vector_2pt_15.Vector, VectorB=vector_2pt_16.Vector)  # -> Angle, Reflex
degrees_3 = Degrees(Radians=angle_3.Angle)
degrees_4 = Degrees(Radians=angle_4.Angle)
degrees_5 = Degrees(Radians=angle_5.Angle)
degrees_6 = Degrees(Radians=angle_6.Angle)
degrees_7 = Degrees(Radians=angle_7.Angle)
degrees_8 = Degrees(Radians=angle_8.Angle)
degrees_9 = Degrees(Radians=angle_9.Angle)
degrees_10 = Degrees(Radians=angle_10.Angle)
right_膝关节夹角 = Panel(degrees_6)
left_膝关节夹角 = Panel(degrees_3)
right_躯干_大腿夹角 = Panel(degrees_8)
left_躯干_大腿夹角 = Panel(degrees_4)
right_肘关节夹角 = Panel(degrees_9)
left_肘关节夹角 = Panel(degrees_5)
right_肩部关节夹角 = Panel(degrees_10)
left_肩部关节夹角 = Panel(degrees_7)
addition_3 = Addition(A=right_膝关节夹角, B=left_膝关节夹角)
division = Division(A=addition_3, B=2)
addition_4 = Addition(A=right_躯干_大腿夹角, B=left_躯干_大腿夹角)
division_2 = Division(A=addition_4, B=2)
addition_5 = Addition(A=right_肘关节夹角, B=left_肘关节夹角)
addition_6 = Addition(A=right_肩部关节夹角, B=left_肩部关节夹角)
ghpython_script_4 = GhPythonScript(x=division)  # -> out, a
# ---------- ghpython_script_4: Python ----------
__author__ = "Lenovo"
__version__ = "2024.06.30"

import rhinoscriptsyntax as rs
if x:
    a = abs(90-x)/90
# ---------- end ghpython_script_4 ----------
ghpython_script_5 = GhPythonScript(x=division_2)  # -> out, a; same code as ghpython_script_4
division_3 = Division(A=addition_5, B="360")
division_4 = Division(A=addition_6, B="360")
肩部关节夹角_归一化 = Panel(division_4)
肘关节夹角均值_归一化 = Panel(division_3)
膝关节夹角与90度差_归一化 = Panel(ghpython_script_4.a)
大腿_躯干与90度差_归一化 = Panel(ghpython_script_5.a)
addition_7 = Addition(A=ghpython_script_4.a, B=ghpython_script_5.a)
division_5 = Division(A=addition_7, B=2)
addition_8 = Addition(A=肩部关节夹角_归一化, B=肘关节夹角均值_归一化)
division_6 = Division(A=addition_8, B=2)

panel_44 = Panel(point_4)

list_item_33 = ListItem(List=flatten(point_5), Index=0, Wrap=True)  # -> Item, Item1
line = Line(StartPoint=list_item_33.Item, EndPoint=list_item_33.Item1)
line_2 = Line(StartPoint=list_item_33.Item1, EndPoint=list_item_33.Item)
list_item_34 = ListItem(List=flatten(cluster.vector_2), Index=0, Wrap=True)  # -> Item, Item1
vector_display_2 = VectorDisplay(Anchor=list_item_33.Item, Vector=line)
angle_11 = Angle(VectorA=line_2, VectorB=list_item_34.Item1)  # -> Angle, Reflex
angle_12 = Angle(VectorA=line, VectorB=list_item_34.Item)  # -> Angle, Reflex
angle_13 = Angle(VectorA=list_item_34.Item, VectorB=list_item_34.Item1)  # -> Angle, Reflex
degrees_11 = Degrees(Radians=angle_12.Angle)
degrees_12 = Degrees(Radians=angle_13.Angle)
degrees_13 = Degrees(Radians=angle_11.Angle)
夹角2 = Panel(degrees_13)
夹角1 = Panel(degrees_11)
夹角 = Panel(degrees_12)
smaller_than = SmallerThan(FirstNumber=夹角2, SecondNumber=阈值角度)  # -> SmallerThan, OrEqualTo
smaller_than_2 = SmallerThan(FirstNumber=夹角1, SecondNumber=阈值角度)  # -> SmallerThan, OrEqualTo
gate_and = GateAnd(A=smaller_than_2.OrEqualTo, B=smaller_than.OrEqualTo)

list_length = ListLength(List=flatten(point_5))
范围内person_count = Panel(list_length)

是否交互 = Panel(gate_and)

灵活度_归一化 = Panel(division_5)
思考强度_归一化 = Panel(division_6)

flatten_3 = FlattenTree(Tree=灵活度_归一化, Path="{0}")
flatten_4 = FlattenTree(Tree=思考强度_归一化, Path="{0}")
flatten_5 = FlattenTree(Tree=是否交互, Path="{0}")
suirify_3 = Suirify(flatten_3)
suirify_4 = Suirify(flatten_4)
suirify_5 = Suirify(flatten_5)
rec_2 = DataRecorder(suirify_3, DataLimit=30, RecordData=True)
rec_3 = DataRecorder(suirify_4, DataLimit=30, RecordData=True)
panel_46 = Panel(rec_3)
rec_4 = DataRecorder(suirify_5, DataLimit=30, RecordData=True)
panel_47 = Panel(rec_2)
panel_48 = Panel(rec_4)
partition = PartitionList(List=rec_2, Size=number_slider)
partition_2 = PartitionList(List=rec_4, Size=Slider(4, range=0..10))
partition_3 = PartitionList(List=rec_3, Size=number_slider_2)
tstat_2 = TreeStatistics(Tree=partition)  # -> Paths, Length, Count
tstat_3 = TreeStatistics(Tree=partition_2)  # -> Paths, Length, Count
item_14 = ListItem(List=tstat_2.Paths, Index="-2", Wrap=True)
tstat_4 = TreeStatistics(Tree=partition_3)  # -> Paths, Length, Count
item_15 = ListItem(List=tstat_3.Paths, Index="-2", Wrap=True)
branch_2 = TreeBranch(Tree=partition, Path=item_14, MaintainPaths=True)
item_16 = ListItem(List=tstat_4.Paths, Index="-2", Wrap=True)
branch_3 = TreeBranch(Tree=partition_2, Path=item_15, MaintainPaths=True)
ma = MassAddition(Input=branch_2)  # -> Result, PartialResults
division_7 = Division(A=ma.Result, B=number_slider)  # -> simplify(flatten(Result))
branch_4 = TreeBranch(Tree=partition_3, Path=item_16, MaintainPaths=True)
ma_2 = MassAddition(Input=branch_4)  # -> Result, PartialResults
division_8 = Division(A=ma_2.Result, B=number_slider_2)  # -> simplify(flatten(Result))
item_17 = ListItem(List=branch_3, Index="-1", Wrap=True)

# ---- group: 社交尺度 (continued)
panel_49 = Panel(item_17)

# ---- group: 全局身体姿态尺度 (continued)
panel_50 = Panel(division_7)

# ----
join_3 = TextJoin(Text=["Upper Limb Physical State:", division_8])
join_4 = TextJoin(Text=["Overall Physical State:", division_7])
# 上肢肘关节、肩关节角度平均值 0°-180°→数值0-1
# 0→最规整
# 1→最不规整
a_2 = Python3Script(test=division_8, adaptive=division_8, manual=subtraction_4, x=模式切换)  # -> out, a; same code as a
# 调试区
# 解释
# 区域内有两人
# 两人在分隔在两块地中，且两人不互相看对方→数值=0
# 其他情况→数值=1
# 0→中间有分隔
# 1→中间无分隔
# 膝关节、髋关节 90°-0/180°→数值0-1
# 0→最封闭
# 1→最开放
a_3 = Python3Script(test=division_7, adaptive=division_7, manual=remap_3.Mapped, x=模式切换)  # -> out, a; same code as a
a_4 = Python3Script(test=协作状态手动控制_控制中间分隔, adaptive=item_17, manual=subtraction_5, x=模式切换)  # -> out, a; same code as a
explode_tree = ExplodeTree(Data=simplify(point_5))  # -> Branch0, Branch1
flatten_6 = FlattenTree(Tree=explode_tree.Branch0, Path="{0}")
flatten_7 = FlattenTree(Tree=explode_tree.Branch1, Path="{0}")
suirify_6 = Suirify(flatten_6)
suirify_7 = Suirify(flatten_7)
a_5 = Python3Script(test=move_2.Geometry, adaptive=suirify_7, manual=move_2.Geometry, x=模式切换)  # -> out, a; same code as a
a_6 = Python3Script(test=move_4.Geometry, adaptive=suirify_6, manual=move_4.Geometry, x=模式切换)  # -> out, a; same code as a
ghpython_script_6 = GhPythonScript(x=a_2.a)  # -> out, a
# ---------- ghpython_script_6: Python ----------
__author__ = "lmh"
__version__ = "2024.06.21"

import rhinoscriptsyntax as rs
if x or x == 0:
    a = x
else:
    a = 1
# ---------- end ghpython_script_6 ----------

# ---- group: 分隔输入 规整度 (continued)
python_5 = GhPythonScript(x=ghpython_script_6.a)  # -> out, simplify(flatten(a))
# ---------- python_5: Python ----------
__author__ = "lmh"
__version__ = "2024.06.20"

import rhinoscriptsyntax as rs
if 0 <= x <= 0.3:
    a = 0
if 0.3 < x <= 0.4:
    a = 0.25
if 0.4 < x <= 0.5:
    a = 0.5
if 0.5 < x <= 0.6:
    a = 0.75
if 0.6 < x <= 1:
    a = 1
# ---------- end python_5 ----------
rec_5 = DataRecorder(python_5.a, DataLimit=30, RecordData=True)
item_18 = ListItem(List=rec_5, Index="-1", Wrap=True)
item_19 = ListItem(List=rec_5, Index="-2", Wrap=True)
subtraction_10 = Subtraction(A=item_18, B=item_19)
python_6 = GhPythonScript(x=subtraction_10)  # -> out, a
# ---------- python_6: Python ----------
__author__ = "lmh"
__version__ = "2024.06.20"

import rhinoscriptsyntax as rs
if x == 0:
    a = 0
else:
    a = 1
# ---------- end python_6 ----------
counter_4 = Counter(CountDirection=True, Step=1, StartStop=Toggle(True), Reset=python_6.a, OptionalCounterDomain=速度_值越大越慢)
remap_10 = RemapNumbers(Value=counter_4, Source=速度_值越大越慢, Target=Domain(0, 1))  # -> Mapped, Clipped
python_7 = GhPythonScript(x=remap_10.Mapped)  # -> out, a; same code as python_4
dcon_2 = DeleteConsecutive(Set=rec_5, Wrap=False)  # -> Set, Count
item_20 = ListItem(List=dcon_2.Set, Index="-1", Wrap=True)
item_21 = ListItem(List=dcon_2.Set, Index="-2", Wrap=True)
dom_4 = ConstructDomain(DomainStart=item_21, DomainEnd=item_20)
remap_11 = RemapNumbers(Value=python_7.a, Source=Domain(0, 1), Target=dom_4)  # -> Mapped, Clipped
panel_51 = Panel(remap_11.Mapped)

# ----
panel_52 = Panel(remap_10.Mapped)
panel_54 = Panel(python_5.a)
panel_56 = Panel(rec_5)
# 颜色间隔在后面
ghpython_script_7 = GhPythonScript(x=a_3.a)  # -> out, a; same code as ghpython_script

# ---- group: 分隔输入 开放度 (continued)
python_8 = GhPythonScript(x=ghpython_script_7.a)  # -> out, simplify(a)
# ---------- python_8: Python ----------
__author__ = "lmh"
__version__ = "2024.06.20"

import rhinoscriptsyntax as rs
if 0 <= x <= 0.4:
    a = 0
if 0.4 < x <= 0.6:
    a = 0.3
if 0.6 < x <= 0.8:
    a = 0.7
if 0.8 < x <= 1:
    a = 1
# ---------- end python_8 ----------
rec_6 = DataRecorder(flatten(python_8.a), DataLimit=30, RecordData=True)
item_22 = ListItem(List=rec_6, Index="-1", Wrap=True)
item_23 = ListItem(List=rec_6, Index="-2", Wrap=True)
dcon_3 = DeleteConsecutive(Set=rec_6, Wrap=False)  # -> Set, Count
subtraction_11 = Subtraction(A=item_22, B=item_23)
python_9 = GhPythonScript(x=subtraction_11)  # -> out, a; same code as python_6
counter_5 = Counter(CountDirection=True, Step=1, StartStop=Toggle(True), Reset=python_9.a, OptionalCounterDomain=速度_值越大越慢_3)
remap_12 = RemapNumbers(Value=counter_5, Source=速度_值越大越慢_3, Target=Domain(0, 1))  # -> Mapped, Clipped
python_10 = GhPythonScript(x=remap_12.Mapped)  # -> out, a; same code as python_4
item_24 = ListItem(List=dcon_3.Set, Index="-1", Wrap=True)
item_25 = ListItem(List=dcon_3.Set, Index="-2", Wrap=True)
dom_5 = ConstructDomain(DomainStart=item_25, DomainEnd=item_24)
remap_13 = RemapNumbers(Value=python_10.a, Source=Domain(0, 1), Target=dom_5)  # -> Mapped, Clipped
panel_57 = Panel(remap_13.Mapped)

# ----
panel_58 = Panel(remap_12.Mapped)
# 最终网格
# 如果要连间隔输入 连gh python后面
gate_not = GateNot(A=a_4.a)
panel_59 = Panel(a_6.a)
cp = PlaneClosestPoint(Point=a_6.a, Plane=xy_2)  # -> Point, UVPoint, Distance
crv_cp = CurveClosestPoint(Point=cp.Point, Curve=reparameterize(crv_13))  # -> Point, simplify(Parameter), Distance
# 切换时点击
cp_2 = PlaneClosestPoint(Point=a_5.a, Plane=xy_2)  # -> Point, UVPoint, Distance
points = PointList(Points=flatten([cp.Point, cp_2.Point]), Size=Slider(0.526, range=0..1))

rec_7 = DataRecorder(crv_cp.Parameter, DataLimit=-10, RecordData=True)
python_11 = GhPythonScript(x=rec_7)  # -> out, a; same code as python
null_2 = NullItem(Item=python_11.a)  # -> NullFlags, InvalidFlags, Description
dispatch_4 = Dispatch(List=rec_7, DispatchPattern=null_2.NullFlags)  # -> ListA, ListB
item_26 = ListItem(List=dispatch_4.ListB, Index="-1", Wrap=True)

panel_60 = Panel(cp.Point)
panel_62 = Panel(crv_cp.Parameter)
msphere = MeshSphere(Base=cp.Point, Radius=Slider(0.12, range=0..1), UCount="4", VCount="4")
msphere_2 = MeshSphere(Base=cp_2.Point, Radius=Slider(0.12, range=0..1), UCount="4", VCount="4")
mcol_2 = MeshColours(Mesh=msphere, Colours=ColourSwatch(SwatchColor=RGB(0, 47, 255)))
mcol_3 = MeshColours(Mesh=msphere_2, Colours=ColourSwatch(SwatchColor=RGB(0, 255, 51)))
expression_2 = Expression(x=item_26, Expression="1-x")
expression_3 = Expression(x=remap_11.Mapped, Expression="1-x")
expression_4 = Expression(x=remap_11.Mapped, Expression="1-x")
expression_5 = Expression(x=remap_11.Mapped, Expression="1-x")
eval_21 = EvaluateCurve(Curve=reparameterize(flip_3.Curve), Parameter=remap_11.Mapped)  # -> Point, Tangent, Angle
eval_22 = EvaluateCurve(Curve=reparameterize(crv_8), Parameter=expression_3)  # -> Point, Tangent, Angle
eval_23 = EvaluateCurve(Curve=reparameterize(flip_2.Curve), Parameter=remap_11.Mapped)  # -> Point, Tangent, Angle
eval_24 = EvaluateCurve(Curve=reparameterize(flip_4.Curve), Parameter=remap_11.Mapped)  # -> Point, Tangent, Angle
eval_25 = EvaluateCurve(Curve=reparameterize(flip_7.Curve), Parameter=remap_11.Mapped)  # -> Point, Tangent, Angle
eval_26 = EvaluateCurve(Curve=reparameterize(crv_4), Parameter=remap_11.Mapped)  # -> Point, Tangent, Angle
eval_27 = EvaluateCurve(Curve=reparameterize(flip.Curve), Parameter=remap_11.Mapped)  # -> Point, Tangent, Angle
eval_28 = EvaluateCurve(Curve=reparameterize(crv_19), Parameter=expression_4)  # -> Point, Tangent, Angle
eval_29 = EvaluateCurve(Curve=reparameterize(crv_18), Parameter=expression_4)  # -> Point, Tangent, Angle
eval_30 = EvaluateCurve(Curve=reparameterize(flip_8.Curve), Parameter=remap_11.Mapped)  # -> Point, Tangent, Angle
eval_31 = EvaluateCurve(Curve=reparameterize(crv_15), Parameter=expression_5)  # -> Point, Tangent, Angle
eval_32 = EvaluateCurve(Curve=reparameterize(flip_10.Curve), Parameter=remap_11.Mapped)  # -> Point, Tangent, Angle
eval_33 = EvaluateCurve(Curve=reparameterize(flip_9.Curve), Parameter=remap_11.Mapped)  # -> Point, Tangent, Angle
eval_34 = EvaluateCurve(Curve=reparameterize(flip_11.Curve), Parameter=remap_11.Mapped)  # -> Point, Tangent, Angle
ln_2 = Line(StartPoint=eval_21.Point, EndPoint=eval_23.Point)
amp_2 = Amplitude(Vector=ln_2, Amplitude=number_slider_10)
ln_3 = Line(StartPoint=eval_23.Point, EndPoint=pt_3)
amp_3 = Amplitude(Vector=ln_3, Amplitude=number_slider_10)
move_10 = Move(Geometry=pt_4, Motion=amp_2)  # -> Geometry, Transform
move_11 = Move(Geometry=eval_23.Point, Motion=amp_3)  # -> Geometry, Transform
move_12 = Move(Geometry=pt_3, Motion=amp_3)  # -> Geometry, Transform
move_13 = Move(Geometry=eval_21.Point, Motion=amp_2)  # -> Geometry, Transform
move_14 = Move(Geometry=eval_23.Point, Motion=expr("-x", amp_2))  # -> Geometry, Transform
move_15 = Move(Geometry=move_10.Geometry, Motion=amp_2)  # -> Geometry, Transform
move_16 = Move(Geometry=move_11.Geometry, Motion=amp_3)  # -> Geometry, Transform
move_17 = Move(Geometry=pt_3, Motion=expr("-x", amp_3))  # -> Geometry, Transform
ln_4 = Line(StartPoint=eval_29.Point, EndPoint=eval_28.Point)
amp_4 = Amplitude(Vector=ln_4, Amplitude=number_slider_14)
move_18 = Move(Geometry=eval_29.Point, Motion=amp_4)  # -> Geometry, Transform
move_19 = Move(Geometry=eval_28.Point, Motion=expr("-x", amp_4))  # -> Geometry, Transform
ln_5 = Line(StartPoint=eval_28.Point, EndPoint=pt_6)
amp_5 = Amplitude(Vector=ln_5, Amplitude=number_slider_14)
move_20 = Move(Geometry=pt_6, Motion=amp_5)  # -> Geometry, Transform
move_21 = Move(Geometry=eval_28.Point, Motion=amp_5)  # -> Geometry, Transform
move_22 = Move(Geometry=pt_5, Motion=amp_4)  # -> Geometry, Transform
move_23 = Move(Geometry=pt_6, Motion=expr("-x", amp_5))  # -> Geometry, Transform
move_24 = Move(Geometry=move_22.Geometry, Motion=amp_4)  # -> Geometry, Transform
move_25 = Move(Geometry=move_21.Geometry, Motion=amp_5)  # -> Geometry, Transform
tstat_5 = TreeStatistics(Tree=move_7.Geometry)  # -> Paths, Length, Count
item_27 = ListItem(List=tstat_5.Paths, Index="0", Wrap=True)  # -> Item, Item1
# 第一个人的骨骼
branch_5 = TreeBranch(Tree=move_7.Geometry, Path=item_27.Item, MaintainPaths=True)  # -> flatten(Branch)

# ---- group: 头部向量
item_28 = ListItem(List=branch_5, Index="27", Wrap=True)
item_29 = ListItem(List=branch_5, Index="28", Wrap=True)
item_30 = ListItem(List=branch_5, Index="30", Wrap=True)
pl_3pt = Plane3Pt(PointA=item_28, PointB=item_30, PointC=item_29)
srf4pt = _4PointSurface(CornerA=item_28, CornerB=item_30, CornerC=item_29)
vec_5 = Vector(pl_3pt)
area = Area(Geometry=srf4pt)  # -> Area, Centroid
pt_10 = Point(area.Centroid)
line_3 = LineSDL(Start=pt_10, Direction=expr("-x", vec_5), Length=1)

# ----
panel_63 = Panel(branch_5)
dam = DataDam(DataA=line_3, BufferDelay=10000000, BufferMode=2)
rec_8 = DataRecorder(dam, DataLimit=30, RecordData=True)
panel_64 = Panel(rec_8)
item_31 = ListItem(List=rec_8, Index="-2", Wrap=True)
item_32 = ListItem(List=rec_8, Index="-1", Wrap=True)
angle_14 = Angle(VectorA=item_31, VectorB=item_32)  # -> Angle, Reflex
deg = Degrees(Radians=angle_14.Angle)
panel_66 = Panel(deg)

# ---- group: 高度宽度 (continued)
dist = Distance(PointA=move_5.Geometry, PointB=cp.Point)
sort = SortList(Keys=dist)  # -> Keys, ValuesA
item_33 = ListItem(List=sort.Keys, Index=panel_36, Wrap=True)
incurve = PointInCurve(Point=cp.Point, Curve=crv_26)  # -> Relationship, Point
python_12 = GhPythonScript(x=incurve.Relationship, y=merge_4)  # -> out, a
# ---------- python_12: Python ----------
__author__ = "lmh"
__version__ = "2024.06.17"

import rhinoscriptsyntax as rs
if x == 1 or x == 2:
    a = y
else:
    a = 0
# ---------- end python_12 ----------
mindex_2 = MemberIndex(Set=dist, Member=item_33)  # -> flatten(Index), Count
replace = ReplaceItems(List=panel_37, Item=python_12.a, Indices=mindex_2.Index, Wrap=False)
graft_2 = GraftTree(Tree=replace, IncludeEmptyLists=True, IncludeNullItems=True)  # -> simplify(Tree)
rec_9 = DataRecorder(graft_2, DataLimit=30, RecordData=True)
item_34 = ListItem(List=rec_9, Index="-2", Wrap=True)  # -> flatten(Item)
item_35 = ListItem(List=rec_9, Index="-1", Wrap=True)  # -> flatten(Item)
subtraction_12 = Subtraction(A=item_35, B=item_34)
python_13 = GhPythonScript(x=subtraction_12)  # -> out, a
# ---------- python_13: Python ----------
__author__ = "lmh"
__version__ = "2024.06.10"

import rhinoscriptsyntax as rs
if x == 0:
    a = 0
else:
    a = 1
# ---------- end python_13 ----------
item_36 = ListItem(List=python_13.a, Index=0, Wrap=True)  # -> Item, Item1, Item2, Item3, Item4, Item5, Item6, Item7, Item8
counter_6 = Counter(CountDirection=True, Step=1, StartStop=toggle_2, Reset=item_36.Item, OptionalCounterDomain=速度_越大越慢)
counter_7 = Counter(CountDirection=True, Step=1, StartStop=toggle_2, Reset=item_36.Item1, OptionalCounterDomain=速度_越大越慢)
counter_8 = Counter(CountDirection=True, Step=1, StartStop=toggle_2, Reset=item_36.Item2, OptionalCounterDomain=速度_越大越慢)
counter_9 = Counter(CountDirection=True, Step=1, StartStop=toggle_2, Reset=item_36.Item3, OptionalCounterDomain=速度_越大越慢)
counter_10 = Counter(CountDirection=True, Step=1, StartStop=toggle_2, Reset=item_36.Item4, OptionalCounterDomain=速度_越大越慢)
counter_11 = Counter(CountDirection=True, Step=1, StartStop=toggle_2, Reset=item_36.Item6, OptionalCounterDomain=速度_越大越慢)
counter_12 = Counter(CountDirection=True, Step=1, StartStop=toggle_2, Reset=item_36.Item7, OptionalCounterDomain=速度_越大越慢)
counter_13 = Counter(CountDirection=True, Step=1, StartStop=toggle_2, Reset=item_36.Item5, OptionalCounterDomain=速度_越大越慢)
counter_14 = Counter(CountDirection=True, Step=1, StartStop=toggle_2, Reset=item_36.Item8, OptionalCounterDomain=速度_越大越慢)
merge_7 = Merge(
    Data1=counter_6,
    Data2=counter_7,
    Data3=counter_8,
    Data4=counter_9,
    Data5=counter_10,
    Data6=counter_13,
    Data7=counter_11,
    Data8=counter_12,
    Data9=counter_14)
dcon_4 = DeleteConsecutive(Set=rec_9, Wrap=False)  # -> Set, Count
item_37 = ListItem(List=dcon_4.Set, Index="-1", Wrap=True)
item_38 = ListItem(List=dcon_4.Set, Index="-2", Wrap=True)
remap_14 = RemapNumbers(Value=merge_7, Source=速度_越大越慢, Target=Domain(0, 1))  # -> Mapped, Clipped
python_14 = GhPythonScript(x=item_38, y=remap_8.Mapped, z=remap_9.Mapped)  # -> out, a; inputs x: Int32
# ---------- python_14: Python ----------
__author__ = "lmh"
__version__ = "2024.06.15"

import rhinoscriptsyntax as rs
if x == 1:
    a = y
if x == 2:
    a = z
if x == 0:
    a = 0
# ---------- end python_14 ----------
python_15 = GhPythonScript(x=remap_14.Mapped)  # -> out, a; same code as python_4
python_16 = GhPythonScript(x=item_37, y=remap_8.Mapped, z=remap_9.Mapped)  # -> out, a; inputs x: Int32; same code as python_14
dom_6 = ConstructDomain(DomainStart=python_14.a, DomainEnd=python_16.a)  # -> flatten(Domain)
remap_15 = RemapNumbers(Value=python_15.a, Source=Domain(0, 1), Target=dom_6)  # -> Mapped, Clipped
multiplication = Multiplication(A=remap_15.Mapped, B=item_26)
multiplication_2 = Multiplication(A=remap_15.Mapped, B=expression_2)
item_39 = ListItem(List=multiplication, Index=0, Wrap=True)  # -> Item, Item1, Item2, Item3, Item4, Item5, Item6, Item7, Item8
item_40 = ListItem(List=multiplication_2, Index=0, Wrap=True)  # -> Item, Item1, Item2, Item3, Item4, Item5, Item6, Item7, Item8

# ----
panel_67 = Panel(rec_9)
amp_6 = Amplitude(Vector=vec_3, Amplitude=item_39.Item6)
amp_7 = Amplitude(Vector=vec_4, Amplitude=item_39.Item7)
amp_8 = Amplitude(Vector=vec_3, Amplitude=item_39.Item8)
amp_9 = Amplitude(Vector=vec_3, Amplitude=item_39.Item4)
move_26 = Move(Geometry=eval_8.Point, Motion=amp_7)  # -> Geometry, Transform
amp_10 = Amplitude(Vector=vec_4, Amplitude=item_39.Item3)
amp_11 = Amplitude(Vector=vec_4, Amplitude=item_39.Item1)
move_27 = Move(Geometry=eval_22.Point, Motion=amp_6)  # -> Geometry, Transform
move_28 = Move(Geometry=eval_24.Point, Motion=amp_9)  # -> Geometry, Transform
move_29 = Move(Geometry=eval.Point, Motion=amp_10)  # -> Geometry, Transform
move_30 = Move(Geometry=eval_27.Point, Motion=amp_8)  # -> Geometry, Transform
amp_12 = Amplitude(Vector=vec_4, Amplitude=item_39.Item5)
amp_13 = Amplitude(Vector=vec_3, Amplitude=item_39.Item2)
move_31 = Move(Geometry=eval_25.Point, Motion=amp_13)  # -> Geometry, Transform
move_32 = Move(Geometry=eval_12.Point, Motion=amp_11)  # -> Geometry, Transform
move_33 = Move(Geometry=eval_3.Point, Motion=amp_12)  # -> Geometry, Transform
amp_14 = Amplitude(Vector=vec_3, Amplitude=item_40.Item4)  # -> expr("-x", Vector)
amp_15 = Amplitude(Vector=vec_3, Amplitude=item_39.Item)
move_34 = Move(Geometry=eval_32.Point, Motion=amp_14)  # -> Geometry, Transform
amp_16 = Amplitude(Vector=vec_3, Amplitude=item_40.Item6)  # -> expr("-x", Vector)
amp_17 = Amplitude(Vector=vec_3, Amplitude=item_40.Item8)  # -> expr("-x", Vector)
amp_18 = Amplitude(Vector=flip_5.Curve, Amplitude=item_40.Item5)  # -> expr("-x", Vector)
move_35 = Move(Geometry=eval_34.Point, Motion=amp_17)  # -> Geometry, Transform
move_36 = Move(Geometry=eval_26.Point, Motion=amp_15)  # -> Geometry, Transform
move_37 = Move(Geometry=eval_19.Point, Motion=amp_18)  # -> Geometry, Transform
amp_19 = Amplitude(Vector=flip_5.Curve, Amplitude=item_40.Item3)  # -> expr("-x", Vector)
amp_20 = Amplitude(Vector=vec_3, Amplitude=item_40.Item2)  # -> expr("-x", Vector)
amp_21 = Amplitude(Vector=flip_5.Curve, Amplitude=item_40.Item7)  # -> expr("-x", Vector)
move_38 = Move(Geometry=eval_31.Point, Motion=amp_20)  # -> Geometry, Transform
move_39 = Move(Geometry=eval_33.Point, Motion=amp_16)  # -> Geometry, Transform
move_40 = Move(Geometry=eval_20.Point, Motion=amp_21)  # -> Geometry, Transform
amp_22 = Amplitude(Vector=flip_5.Curve, Amplitude=item_40.Item1)  # -> expr("-x", Vector)
move_41 = Move(Geometry=eval_16.Point, Motion=amp_19)  # -> Geometry, Transform
amp_23 = Amplitude(Vector=vec_3, Amplitude=item_40.Item)  # -> expr("-x", Vector)
move_42 = Move(Geometry=eval_17.Point, Motion=amp_22)  # -> Geometry, Transform
move_43 = Move(Geometry=eval_30.Point, Motion=amp_23)  # -> Geometry, Transform

# ---- group: 分隔 (continued)
pt_11 = Point(move_14.Geometry)
pt_12 = Point(move_19.Geometry)
merge_8 = Merge(Data1=flatten(cp.Point), Data2=flatten(cp_2.Point))
pt_13 = Point(eval_28.Point)
pt_14 = Point(eval_23.Point)
incurves = PointInCurves(Point=merge_8, Curves=merge_5)  # -> Relationship, Index, Point
item_41 = ListItem(List=incurves.Index, Index=0, Wrap=True)  # -> Item, Item1
panel_68 = Panel(incurves.Relationship)
item_42 = ListItem(List=incurves.Relationship, Index=0, Wrap=True)  # -> Item, Item1
python_17 = GhPythonScript(x1=item_42.Item, x2=item_42.Item1, y1=item_41.Item, y2=item_41.Item1)  # -> out, a
# ---------- python_17: Python ----------
__author__ = "lmh"
__version__ = "2024.06.14"

import rhinoscriptsyntax as rs
if x1 == 2 and x2 == 2 and y1 != y2:
    a = 1
else:
    a = 0
# ---------- end python_17 ----------

# ---- group: 分隔 / 接z
python_18 = GhPythonScript(separation=python_17.a, interaction=gate_not, z=自定义人数)  # -> out, simplify(a); inputs separation: Int32, interaction: Boolean, z: Int32
# ---------- python_18: Python ----------
__author__ = "lmh"
__version__ = "2024.06.11"

import rhinoscriptsyntax as rs
if separation == 1 and z == 2 and interaction:
    a = 1
else:
    a = 0
# ---------- end python_18 ----------

# ----
panel_69 = Panel(python_17.a)
panel_71 = Panel(python_18.a)

# ---- group: 分隔 (continued)
rec_10 = DataRecorder(flatten(python_18.a), DataLimit=30, RecordData=True)
item_43 = ListItem(List=rec_10, Index="-2", Wrap=True)  # -> flatten(Item)
item_44 = ListItem(List=rec_10, Index="-1", Wrap=True)  # -> flatten(Item)
subtraction_13 = Subtraction(A=item_44, B=item_43)
abs_2 = Absolute(Value=subtraction_13)
counter_15 = Counter(CountDirection=True, Step=1, StartStop=Toggle(True), Reset=abs_2, OptionalCounterDomain=速度_越大越慢_2)
remap_16 = RemapNumbers(Value=counter_15, Source=速度_越大越慢_2, Target=Domain(0, 1))  # -> Mapped, Clipped
python_19 = GhPythonScript(x=remap_16.Mapped)  # -> out, a; same code as python_4
dcon_5 = DeleteConsecutive(Set=rec_10, Wrap=False)  # -> Set, Count
item_45 = ListItem(List=dcon_5.Set, Index="-1", Wrap=True)  # -> flatten(Item)
item_46 = ListItem(List=dcon_5.Set, Index="-2", Wrap=True)  # -> flatten(Item)
dom_7 = ConstructDomain(DomainStart=item_46, DomainEnd=item_45)
remap_17 = RemapNumbers(Value=python_19.a, Source=Domain(0, 1), Target=dom_7)  # -> Mapped, Clipped

# ----
panel_72 = Panel(rec_10)

# ---- group: 片片 (continued)
remap_numbers = RemapNumbers(Value=remap_13.Mapped, Source=Domain(0, 1), Target=construct_domain)  # -> Mapped, Clipped
remap_18 = RemapNumbers(Value=remap_numbers.Mapped, Source=Domain(0, 1), Target="1 to 0")  # -> Mapped, Clipped

# ----
阈值 = Panel("3")
缓冲值 = Panel("3")
py3 = Python3Script(x=panel_66, a=阈值, b=缓冲值)  # -> out, score
# ---------- py3: Python ----------
x = float(x)
a = float(a)
b = float(b)
if x <= a:
    score = 1
elif x > a and x <= a + b:
    score = max(0, 1 - (x - a) / b)
else:
    score = 0
# ---------- end py3 ----------

panel_73 = Panel(py3.score)

rec_11 = DataRecorder(panel_73, DataLimit=30, RecordData=True)

partition_4 = PartitionList(List=rec_11, Size=number_slider_22)
panel_74 = Panel(partition_4)
tstat_6 = TreeStatistics(Tree=partition_4)  # -> Paths, Length, Count
item_47 = ListItem(List=tstat_6.Paths, Index="-2", Wrap=True)
branch_6 = TreeBranch(Tree=panel_74, Path=item_47, MaintainPaths=True)
ma_3 = MassAddition(Input=branch_6)  # -> Result, PartialResults
division_9 = Division(A=ma_3.Result, B=number_slider_22)  # -> flatten(Result)
flatten_8 = FlattenTree(Tree=division_9, Path="{0}")
suirify_8 = Suirify(flatten_8)

# ---- group: 局部姿态尺度 (continued)
panel_75 = Panel(suirify_8)

# ----
join_5 = TextJoin(Text=["Attentional State:", suirify_8])
merge_9 = Merge(Data1=join_2, Data2=join_4, Data3=join_3, Data4=join_5, Data5=join)
panel_76 = Panel(merge_9)
# 头部晃动幅度、频率越大 → 数值趋近0
# 头部稳定 → 数值趋近于1
# 0→对侧高度最高（齐平）
# 1→对侧高度最低
a_7 = Python3Script(test=suirify_8, adaptive=suirify_8, manual=subtraction_6, x=模式切换)  # -> out, a; same code as a
ghpython_script_8 = GhPythonScript(x=a_7.a)  # -> out, a; same code as ghpython_script

# ---- group: 分隔输入 远端高度 (continued)
python_20 = GhPythonScript(x=ghpython_script_8.a)  # -> out, simplify(a)
# ---------- python_20: Python ----------
__author__ = "lmh"
__version__ = "2024.06.20"

import rhinoscriptsyntax as rs
if 0 <= x <= 0.25:
    a = 0
if 0.25 < x <= 0.5:
    a = 0.3
if 0.5 < x <= 0.75:
    a = 0.7
if 0.75 < x <= 1:
    a = 1
# ---------- end python_20 ----------
rec_12 = DataRecorder(python_20.a, DataLimit=30, RecordData=True)
item_48 = ListItem(List=rec_12, Index="-1", Wrap=True)
item_49 = ListItem(List=rec_12, Index="-2", Wrap=True)
subtraction_14 = Subtraction(A=item_48, B=item_49)
dcon_6 = DeleteConsecutive(Set=rec_12, Wrap=False)  # -> Set, Count
python_21 = GhPythonScript(x=subtraction_14)  # -> out, a; same code as python_6
counter_16 = Counter(CountDirection=True, Step=1, StartStop=Toggle(True), Reset=python_21.a, OptionalCounterDomain=速度_值越大越慢_2)
remap_19 = RemapNumbers(Value=counter_16, Source=速度_值越大越慢_2, Target=Domain(0, 1))  # -> Mapped, Clipped
python_22 = GhPythonScript(x=remap_19.Mapped)  # -> out, a; same code as python_4
item_50 = ListItem(List=dcon_6.Set, Index="-1", Wrap=True)
item_51 = ListItem(List=dcon_6.Set, Index="-2", Wrap=True)
dom_8 = ConstructDomain(DomainStart=item_51, DomainEnd=item_50)
remap_20 = RemapNumbers(Value=python_22.a, Source=Domain(0, 1), Target=dom_8)  # -> Mapped, Clipped
panel_77 = Panel(remap_20.Mapped)

# ----
panel_78 = Panel(remap_19.Mapped)
panel_79 = Panel(python_22.a)

# ---- group: 高度宽度 (continued)
remap_21 = RemapNumbers(Value=remap_20.Mapped, Source=Domain(0, 1), Target=dom_2)  # -> Mapped, Clipped
python_23 = GhPythonScript(x=item_38, y=remap_7.Mapped, z=remap_21.Mapped)  # -> out, a; inputs x: Int32; same code as python_14
python_24 = GhPythonScript(x=item_37, y=remap_7.Mapped, z=remap_21.Mapped)  # -> out, a; inputs x: Int32; same code as python_14
dom_9 = ConstructDomain(DomainStart=python_23.a, DomainEnd=python_24.a)  # -> flatten(Domain)
remap_22 = RemapNumbers(Value=python_15.a, Source=Domain(0, 1), Target=dom_9)  # -> Mapped, Clipped
item_52 = ListItem(List=remap_22.Mapped, Index=0, Wrap=True)  # -> Item, Item1, Item2, Item3, Item4, Item5, Item6, Item7, Item8

# ----
Z_3 = UnitZ(Factor=item_52.Item7)  # -> expr("-x", UnitVector)
Z_4 = UnitZ(Factor=item_52.Item6)  # -> expr("-x", UnitVector)
Z_5 = UnitZ(Factor=item_52.Item4)  # -> expr("-x", UnitVector)
Z_6 = UnitZ(Factor=item_52.Item5)  # -> expr("-x", UnitVector)
Z_7 = UnitZ(Factor=item_52.Item8)  # -> expr("-x", UnitVector)
Z_8 = UnitZ(Factor=item_52.Item3)  # -> expr("-x", UnitVector)
move_44 = Move(Geometry=move_26.Geometry, Motion=Z_3)  # -> Geometry, Transform
Z_9 = UnitZ(Factor=item_52.Item)  # -> expr("-x", UnitVector)
move_45 = Move(Geometry=move_44.Geometry, Motion=expr("-x", vec2pt.Vector))  # -> Geometry, Transform
move_46 = Move(Geometry=move_30.Geometry, Motion=Z_7)  # -> Geometry, Transform
Z_10 = UnitZ(Factor=item_52.Item1)  # -> expr("-x", UnitVector)
move_47 = Move(Geometry=move_32.Geometry, Motion=Z_10)  # -> Geometry, Transform
move_48 = Move(Geometry=move_29.Geometry, Motion=Z_8)  # -> Geometry, Transform
move_49 = Move(Geometry=move_36.Geometry, Motion=Z_9)  # -> Geometry, Transform
Z_11 = UnitZ(Factor=item_52.Item2)  # -> expr("-x", UnitVector)
move_50 = Move(Geometry=move_46.Geometry, Motion=expr("-x", amp_2))  # -> Geometry, Transform
Z_12 = UnitZ(Factor=item_52.Item)  # -> expr("-x", UnitVector)
move_51 = Move(Geometry=move_43.Geometry, Motion=Z_12)  # -> Geometry, Transform
Z_13 = UnitZ(Factor=item_52.Item1)  # -> expr("-x", UnitVector)
move_52 = Move(Geometry=move_42.Geometry, Motion=Z_13)  # -> Geometry, Transform
move_53 = Move(Geometry=move_52.Geometry, Motion=vec2pt_3.Vector)  # -> Geometry, Transform
Z_14 = UnitZ(Factor=item_52.Item2)  # -> expr("-x", UnitVector)
Z_15 = UnitZ(Factor=item_52.Item3)  # -> expr("-x", UnitVector)
Z_16 = UnitZ(Factor=item_52.Item5)  # -> expr("-x", UnitVector)
Z_17 = UnitZ(Factor=item_52.Item7)  # -> expr("-x", UnitVector)
Z_18 = UnitZ(Factor=item_52.Item8)  # -> expr("-x", UnitVector)
move_54 = Move(Geometry=move_37.Geometry, Motion=Z_16)  # -> Geometry, Transform
Z_19 = UnitZ(Factor=item_52.Item4)  # -> expr("-x", UnitVector)

# ---- group: 分隔 (continued)
move_55 = Move(Geometry=move_33.Geometry, Motion=Z_6)  # -> Geometry, Transform
move_56 = Move(Geometry=move_41.Geometry, Motion=Z_15)  # -> Geometry, Transform
ln_6 = Line(StartPoint=move_55.Geometry, EndPoint=pt_11)
plx = LinePlane(Line=ln_6, Plane=xy_3)  # -> Point, ParamL, ParamP
ln_7 = Line(StartPoint=move_56.Geometry, EndPoint=pt_12)
vec_6 = Vector(ln_6)
plx_2 = LinePlane(Line=ln_7, Plane=xy_3)  # -> Point, ParamL, ParamP
vec_7 = Vector(ln_7)
dist_2 = Distance(PointA=move_55.Geometry, PointB=plx.Point)
dist_3 = Distance(PointA=move_56.Geometry, PointB=plx_2.Point)
remap_23 = RemapNumbers(Value=remap_17.Mapped, Source=Domain(0, 1), Target=dist_2)  # -> Mapped, Clipped
amp_24 = Amplitude(Vector=vec_6, Amplitude=remap_23.Mapped)
remap_24 = RemapNumbers(Value=remap_17.Mapped, Source=Domain(0, 1), Target=dist_3)  # -> Mapped, Clipped
move_57 = Move(Geometry=move_28.Geometry, Motion=Z_5)  # -> Geometry, Transform
move_58 = Move(Geometry=move_34.Geometry, Motion=Z_19)  # -> Geometry, Transform
amp_25 = Amplitude(Vector=vec_7, Amplitude=remap_24.Mapped)
move_59 = Move(Geometry=move_56.Geometry, Motion=amp_25)  # -> Geometry, Transform
move_60 = Move(Geometry=move_55.Geometry, Motion=amp_24)  # -> Geometry, Transform
ln_8 = Line(StartPoint=move_58.Geometry, EndPoint=pt_13)
ln_9 = Line(StartPoint=pt_14, EndPoint=move_57.Geometry)
pdecon = Deconstruct(Point=move_58.Geometry)  # -> XComponent, YComponent, ZComponent
vec_8 = Vector(ln_8)
plx_3 = LinePlane(Line=ln_8, Plane=xy_3)  # -> Point, ParamL, ParamP
vec_9 = Vector(ln_9)
subtraction_15 = Subtraction(A=pdecon.ZComponent, B=分隔离地面的高度)
dist_4 = Distance(PointA=move_58.Geometry, PointB=plx_3.Point)
plx_4 = LinePlane(Line=ln_9, Plane=xy_3)  # -> Point, ParamL, ParamP
dist_5 = Distance(PointA=move_57.Geometry, PointB=plx_4.Point)
remap_25 = RemapNumbers(Value=remap_17.Mapped, Source=Domain(0, 1), Target=subtraction_15)  # -> Mapped, Clipped
remap_26 = RemapNumbers(Value=remap_17.Mapped, Source=Domain(0, 1), Target=dist_5)  # -> Mapped, Clipped
amp_26 = Amplitude(Vector=vec_9, Amplitude=remap_26.Mapped)
remap_27 = RemapNumbers(Value=remap_17.Mapped, Source=Domain(0, 1), Target=dist_4)  # -> Mapped, Clipped
amp_27 = Amplitude(Vector=vec_8, Amplitude=remap_27.Mapped)
move_61 = Move(Geometry=move_57.Geometry, Motion=expr("-x", amp_26))  # -> Geometry, Transform
move_62 = Move(Geometry=move_58.Geometry, Motion=amp_27)  # -> Geometry, Transform

# ----
move_63 = Move(Geometry=move_60.Geometry, Motion=vec2pt.Vector)  # -> Geometry, Transform
move_64 = Move(Geometry=move_61.Geometry, Motion=vec2pt_2.Vector)  # -> Geometry, Transform
move_65 = Move(Geometry=move_61.Geometry, Motion=expr("-x", vec2pt_2.Vector))  # -> Geometry, Transform
move_66 = Move(Geometry=move_59.Geometry, Motion=vec2pt_3.Vector)  # -> Geometry, Transform
Z_20 = UnitZ(Factor=item_52.Item6)  # -> expr("-x", UnitVector)
move_67 = Move(Geometry=move_40.Geometry, Motion=Z_17)  # -> Geometry, Transform
move_68 = Move(Geometry=move_35.Geometry, Motion=Z_18)  # -> Geometry, Transform
move_69 = Move(Geometry=move_31.Geometry, Motion=Z_11)  # -> Geometry, Transform
move_70 = Move(Geometry=move_69.Geometry, Motion=vec2pt_2.Vector)  # -> Geometry, Transform
move_71 = Move(Geometry=move_38.Geometry, Motion=Z_14)  # -> Geometry, Transform
move_72 = Move(Geometry=move_27.Geometry, Motion=Z_4)  # -> Geometry, Transform
move_73 = Move(Geometry=move_39.Geometry, Motion=Z_20)  # -> Geometry, Transform
move_74 = Move(Geometry=move_73.Geometry, Motion=vec2pt_3.Vector)  # -> Geometry, Transform
move_75 = Move(Geometry=move_73.Geometry, Motion=expr("-x", vec2pt_3.Vector))  # -> Geometry, Transform

move_76 = Move(Geometry=move_51.Geometry, Motion=expr("-x", amp_4))  # -> Geometry, Transform
move_77 = Move(Geometry=move_51.Geometry, Motion=amp_4)  # -> Geometry, Transform
move_78 = Move(Geometry=move_69.Geometry, Motion=expr("-x", vec2pt_2.Vector))  # -> Geometry, Transform
move_79 = Move(Geometry=move_62.Geometry, Motion=amp_4)  # -> Geometry, Transform
move_80 = Move(Geometry=move_71.Geometry, Motion=amp_4)  # -> Geometry, Transform
move_81 = Move(Geometry=move_62.Geometry, Motion=expr("-x", amp_4))  # -> Geometry, Transform
move_82 = Move(Geometry=move_72.Geometry, Motion=amp_2)  # -> Geometry, Transform
move_83 = Move(Geometry=move_72.Geometry, Motion=expr("-x", amp_2))  # -> Geometry, Transform
move_84 = Move(Geometry=move_71.Geometry, Motion=expr("-x", amp_4))  # -> Geometry, Transform
move_85 = Move(Geometry=move_46.Geometry, Motion=amp_2)  # -> Geometry, Transform
srf4pt_2 = _4PointSurface(CornerA=move_45.Geometry, CornerB=move_46.Geometry, CornerC=eval_21.Point, CornerD=move_13.Geometry)
srf4pt_3 = _4PointSurface(CornerA=pt_4, CornerB=move_13.Geometry, CornerC=move_45.Geometry, CornerD=move_44.Geometry)
srf4pt_4 = _4PointSurface(CornerA=move_72.Geometry, CornerB=move_44.Geometry, CornerC=pt_4, CornerD=move_10.Geometry)
srf4pt_5 = _4PointSurface(CornerA=move_72.Geometry, CornerB=move_60.Geometry, CornerC=move_15.Geometry, CornerD=move_10.Geometry)
srf4pt_6 = _4PointSurface(CornerA=move_14.Geometry, CornerB=move_15.Geometry, CornerC=move_60.Geometry, CornerD=move_63.Geometry)
srf4pt_7 = _4PointSurface(CornerA=move_61.Geometry, CornerB=move_63.Geometry, CornerC=move_14.Geometry, CornerD=eval_23.Point)
srf4pt_8 = _4PointSurface(CornerA=move_61.Geometry, CornerB=move_48.Geometry, CornerC=move_11.Geometry, CornerD=eval_23.Point)
srf4pt_9 = _4PointSurface(CornerA=move_69.Geometry, CornerB=move_48.Geometry, CornerC=move_11.Geometry, CornerD=move_16.Geometry)
srf4pt_10 = _4PointSurface(CornerA=move_16.Geometry, CornerB=move_17.Geometry, CornerC=move_70.Geometry, CornerD=move_69.Geometry)
srf4pt_11 = _4PointSurface(CornerA=move_70.Geometry, CornerB=move_47.Geometry, CornerC=pt_3, CornerD=move_17.Geometry)
srf4pt_12 = _4PointSurface(CornerA=move_49.Geometry, CornerB=move_47.Geometry, CornerC=pt_3, CornerD=move_12.Geometry)
srf4pt_13 = _4PointSurface(CornerA=move_68.Geometry, CornerB=move_67.Geometry, CornerC=pt_6, CornerD=move_20.Geometry)
srf4pt_14 = _4PointSurface(CornerA=move_71.Geometry, CornerB=move_59.Geometry, CornerC=move_24.Geometry, CornerD=move_22.Geometry)
srf4pt_15 = _4PointSurface(CornerA=move_19.Geometry, CornerB=move_24.Geometry, CornerC=move_59.Geometry, CornerD=move_66.Geometry)
srf4pt_16 = _4PointSurface(CornerA=move_62.Geometry, CornerB=move_54.Geometry, CornerC=move_21.Geometry, CornerD=eval_28.Point)
srf4pt_17 = _4PointSurface(CornerA=move_73.Geometry, CornerB=move_54.Geometry, CornerC=move_21.Geometry, CornerD=move_25.Geometry)
srf4pt_18 = _4PointSurface(CornerA=move_25.Geometry, CornerB=move_23.Geometry, CornerC=move_74.Geometry, CornerD=move_73.Geometry)
srf4pt_19 = _4PointSurface(CornerA=move_74.Geometry, CornerB=move_67.Geometry, CornerC=pt_6, CornerD=move_23.Geometry)
srf4pt_20 = _4PointSurface(CornerA=move_62.Geometry, CornerB=move_66.Geometry, CornerC=move_19.Geometry, CornerD=eval_28.Point)
srf4pt_21 = _4PointSurface(CornerA=move_52.Geometry, CornerB=move_51.Geometry, CornerC=eval_29.Point, CornerD=move_18.Geometry)
srf4pt_22 = _4PointSurface(CornerA=pt_5, CornerB=move_18.Geometry, CornerC=move_52.Geometry, CornerD=move_53.Geometry)
srf4pt_23 = _4PointSurface(CornerA=move_71.Geometry, CornerB=move_53.Geometry, CornerC=pt_5, CornerD=move_22.Geometry)
mesh_uv = MeshSurface(Surface=srf4pt_6, UCount=number_slider_16, VCount=number_slider_17, Overhang=True, Equalize=False)
mesh_uv_2 = MeshSurface(Surface=srf4pt_7, UCount=number_slider_16, VCount=number_slider_17, Overhang=True, Equalize=False)
srf4pt_24 = _4PointSurface(CornerA=move_77.Geometry, CornerB=move_53.Geometry, CornerC=move_69.Geometry, CornerD=move_70.Geometry)
srf4pt_25 = _4PointSurface(CornerA=move_78.Geometry, CornerB=move_69.Geometry, CornerC=move_53.Geometry, CornerD=move_84.Geometry)
srf4pt_26 = _4PointSurface(CornerA=move_84.Geometry, CornerB=move_71.Geometry, CornerC=move_48.Geometry, CornerD=move_78.Geometry)
srf4pt_27 = _4PointSurface(CornerA=move_80.Geometry, CornerB=move_71.Geometry, CornerC=move_48.Geometry, CornerD=move_64.Geometry)
srf4pt_28 = _4PointSurface(CornerA=move_64.Geometry, CornerB=move_61.Geometry, CornerC=move_59.Geometry, CornerD=move_80.Geometry)
srf4pt_29 = _4PointSurface(CornerA=move_61.Geometry, CornerB=move_65.Geometry, CornerC=move_81.Geometry, CornerD=move_59.Geometry)
srf4pt_30 = _4PointSurface(CornerA=move_62.Geometry, CornerB=move_81.Geometry, CornerC=move_65.Geometry, CornerD=move_60.Geometry)
srf4pt_31 = _4PointSurface(CornerA=move_79.Geometry, CornerB=move_62.Geometry, CornerC=move_60.Geometry, CornerD=move_82.Geometry)
srf4pt_32 = _4PointSurface(CornerA=move_83.Geometry, CornerB=move_72.Geometry, CornerC=move_54.Geometry, CornerD=move_75.Geometry)
srf4pt_33 = _4PointSurface(CornerA=move_75.Geometry, CornerB=move_73.Geometry, CornerC=move_44.Geometry, CornerD=move_83.Geometry)
srf4pt_34 = _4PointSurface(CornerA=move_44.Geometry, CornerB=move_85.Geometry, CornerC=move_74.Geometry, CornerD=move_73.Geometry)
srf4pt_35 = _4PointSurface(CornerA=move_74.Geometry, CornerB=move_67.Geometry, CornerC=move_46.Geometry, CornerD=move_85.Geometry)
srf4pt_36 = _4PointSurface(CornerA=move_82.Geometry, CornerB=move_72.Geometry, CornerC=move_54.Geometry, CornerD=move_79.Geometry)
srf4pt_37 = _4PointSurface(CornerA=move_51.Geometry, CornerB=move_76.Geometry, CornerC=move_49.Geometry, CornerD=move_47.Geometry)
srf4pt_38 = _4PointSurface(CornerA=move_77.Geometry, CornerB=move_51.Geometry, CornerC=move_47.Geometry, CornerD=move_70.Geometry)
mesh_uv_3 = MeshSurface(Surface=srf4pt_2, UCount=number_slider_16, VCount=number_slider_17, Overhang=True, Equalize=False)
mesh_uv_4 = MeshSurface(Surface=srf4pt_3, UCount=number_slider_16, VCount=number_slider_17, Overhang=True, Equalize=False)
mesh_uv_5 = MeshSurface(Surface=srf4pt_4, UCount=number_slider_16, VCount=number_slider_17, Overhang=True, Equalize=False)
mesh_uv_6 = MeshSurface(Surface=srf4pt_5, UCount=number_slider_16, VCount=number_slider_17, Overhang=True, Equalize=False)
mesh_uv_7 = MeshSurface(Surface=srf4pt_8, UCount=number_slider_16, VCount=number_slider_17, Overhang=True, Equalize=False)
mesh_uv_8 = MeshSurface(Surface=srf4pt_9, UCount=number_slider_16, VCount=number_slider_17, Overhang=True, Equalize=False)
mesh_uv_9 = MeshSurface(Surface=srf4pt_10, UCount=number_slider_18, VCount=number_slider_17, Overhang=True, Equalize=False)
mesh_uv_10 = MeshSurface(Surface=srf4pt_11, UCount=number_slider_16, VCount=number_slider_17, Overhang=True, Equalize=False)
mesh_uv_11 = MeshSurface(Surface=srf4pt_12, UCount=number_slider_16, VCount=number_slider_17, Overhang=True, Equalize=False)
mesh_uv_12 = MeshSurface(Surface=srf4pt_21, UCount=number_slider_16, VCount=number_slider_17, Overhang=True, Equalize=False)
mesh_uv_13 = MeshSurface(Surface=srf4pt_22, UCount=number_slider_16, VCount=number_slider_17, Overhang=True, Equalize=False)
mesh_uv_14 = MeshSurface(Surface=srf4pt_23, UCount=number_slider_16, VCount=number_slider_17, Overhang=True, Equalize=False)
mesh_uv_15 = MeshSurface(Surface=srf4pt_14, UCount=number_slider_16, VCount=number_slider_17, Overhang=True, Equalize=False)
mesh_uv_16 = MeshSurface(Surface=srf4pt_15, UCount=number_slider_16, VCount=number_slider_17, Overhang=True, Equalize=False)
mesh_uv_17 = MeshSurface(Surface=srf4pt_20, UCount=number_slider_16, VCount=number_slider_17, Overhang=True, Equalize=False)
mesh_uv_18 = MeshSurface(Surface=srf4pt_16, UCount=number_slider_16, VCount=number_slider_17, Overhang=True, Equalize=False)
mesh_uv_19 = MeshSurface(Surface=srf4pt_17, UCount=number_slider_16, VCount=number_slider_17, Overhang=True, Equalize=False)
mesh_uv_20 = MeshSurface(Surface=srf4pt_18, UCount=number_slider_18, VCount=number_slider_17, Overhang=True, Equalize=False)
mesh_uv_21 = MeshSurface(Surface=srf4pt_19, UCount=number_slider_16, VCount=number_slider_17, Overhang=True, Equalize=False)
mesh_uv_22 = MeshSurface(Surface=srf4pt_13, UCount=number_slider_16, VCount=number_slider_17, Overhang=True, Equalize=False)
mesh_uv_23 = MeshSurface(Surface=srf4pt_37, UCount=number_slider_16, VCount=number_slider_17, Overhang=True, Equalize=False)
mesh_uv_24 = MeshSurface(Surface=srf4pt_24, UCount=number_slider_16, VCount=number_slider_17, Overhang=True, Equalize=False)
mesh_uv_25 = MeshSurface(Surface=srf4pt_25, UCount=number_slider_16, VCount=number_slider_17, Overhang=True, Equalize=False)
srf4pt_39 = _4PointSurface(CornerA=move_46.Geometry, CornerB=move_50.Geometry, CornerC=move_68.Geometry, CornerD=move_67.Geometry)
mesh_uv_26 = MeshSurface(Surface=srf4pt_27, UCount=number_slider_16, VCount=number_slider_17, Overhang=True, Equalize=False)
mesh_uv_27 = MeshSurface(Surface=srf4pt_38, UCount=number_slider_16, VCount=number_slider_17, Overhang=True, Equalize=False)
mesh_uv_28 = MeshSurface(Surface=srf4pt_26, UCount=number_slider_16, VCount=number_slider_17, Overhang=True, Equalize=False)
mesh_uv_29 = MeshSurface(Surface=srf4pt_28, UCount=number_slider_16, VCount=number_slider_17, Overhang=True, Equalize=False)
mesh_uv_30 = MeshSurface(Surface=srf4pt_29, UCount=number_slider_16, VCount=number_slider_17, Overhang=True, Equalize=False)
mesh_uv_31 = MeshSurface(Surface=srf4pt_30, UCount=number_slider_16, VCount=number_slider_17, Overhang=True, Equalize=False)
mesh_uv_32 = MeshSurface(Surface=srf4pt_31, UCount=number_slider_16, VCount=number_slider_17, Overhang=True, Equalize=False)
mesh_uv_33 = MeshSurface(Surface=srf4pt_36, UCount=number_slider_16, VCount=number_slider_17, Overhang=True, Equalize=False)
mesh_uv_34 = MeshSurface(Surface=srf4pt_33, UCount=number_slider_16, VCount=number_slider_17, Overhang=True, Equalize=False)
mesh_uv_35 = MeshSurface(Surface=srf4pt_32, UCount=number_slider_16, VCount=number_slider_17, Overhang=True, Equalize=False)
mesh_uv_36 = MeshSurface(Surface=srf4pt_34, UCount=number_slider_16, VCount=number_slider_17, Overhang=True, Equalize=False)
mesh_uv_37 = MeshSurface(Surface=srf4pt_35, UCount=number_slider_16, VCount=number_slider_17, Overhang=True, Equalize=False)
mesh_uv_38 = MeshSurface(Surface=srf4pt_39, UCount=number_slider_16, VCount=number_slider_17, Overhang=True, Equalize=False)

flipm = FlipMesh(Mesh=mesh_uv_6, VertexNormals=True, FaceNormals=True, FaceOrientation=True)
flipm_2 = FlipMesh(Mesh=mesh_uv, VertexNormals=True, FaceNormals=True, FaceOrientation=True)
flipm_3 = FlipMesh(Mesh=mesh_uv_7, VertexNormals=True, FaceNormals=True, FaceOrientation=True)
flipm_4 = FlipMesh(Mesh=mesh_uv_4, VertexNormals=True, FaceNormals=True, FaceOrientation=True)
flipm_5 = FlipMesh(Mesh=mesh_uv_10, VertexNormals=True, FaceNormals=True, FaceOrientation=True)
flipm_6 = FlipMesh(Mesh=mesh_uv_31, VertexNormals=True, FaceNormals=True, FaceOrientation=True)
flipm_7 = FlipMesh(Mesh=mesh_uv_32, VertexNormals=True, FaceNormals=True, FaceOrientation=True)
flipm_8 = FlipMesh(Mesh=mesh_uv_30, VertexNormals=True, FaceNormals=True, FaceOrientation=True)
flipm_9 = FlipMesh(Mesh=mesh_uv_26, VertexNormals=True, FaceNormals=True, FaceOrientation=True)
flipm_10 = FlipMesh(Mesh=mesh_uv_29, VertexNormals=True, FaceNormals=True, FaceOrientation=True)
flipm_11 = FlipMesh(Mesh=mesh_uv_36, VertexNormals=True, FaceNormals=True, FaceOrientation=True)
flipm_12 = FlipMesh(Mesh=mesh_uv_33, VertexNormals=True, FaceNormals=True, FaceOrientation=True)
flipm_13 = FlipMesh(Mesh=mesh_uv_18, VertexNormals=True, FaceNormals=True, FaceOrientation=True)
flipm_14 = FlipMesh(Mesh=mesh_uv_21, VertexNormals=True, FaceNormals=True, FaceOrientation=True)
flipm_15 = FlipMesh(Mesh=mesh_uv_23, VertexNormals=True, FaceNormals=True, FaceOrientation=True)
flipm_16 = FlipMesh(Mesh=mesh_uv_27, VertexNormals=True, FaceNormals=True, FaceOrientation=True)
flipm_17 = FlipMesh(Mesh=mesh_uv_15, VertexNormals=True, FaceNormals=True, FaceOrientation=True)
flipm_18 = FlipMesh(Mesh=mesh_uv_16, VertexNormals=True, FaceNormals=True, FaceOrientation=True)
flipm_19 = FlipMesh(Mesh=mesh_uv_38, VertexNormals=True, FaceNormals=True, FaceOrientation=True)
merge_10 = Merge(
    Data1=flipm_15,
    Data2=flipm_16,
    Data3=mesh_uv_24,
    Data4=mesh_uv_25,
    Data5=mesh_uv_28,
    Data6=flipm_9,
    Data7=flipm_10,
    Data8=flipm_8,
    Data9=flipm_6,
    Data10=flipm_7,
    Data11=flipm_12,
    Data12=mesh_uv_35,
    Data13=mesh_uv_34,
    Data14=flipm_11,
    Data15=mesh_uv_37,
    Data16=flipm_19)
merge_11 = Merge(
    Data1=mesh_uv_3,
    Data2=flipm_4,
    Data3=mesh_uv_5,
    Data4=flipm,
    Data5=flipm_2,
    Data6=mesh_uv_2,
    Data7=flipm_3,
    Data8=mesh_uv_8,
    Data9=mesh_uv_9,
    Data10=flipm_5,
    Data11=mesh_uv_11)
merge_12 = Merge(Data1=mesh_uv_3, Data2=mesh_uv_5, Data3=flipm_2, Data4=flipm_3, Data5=mesh_uv_9, Data6=mesh_uv_11)
merge_13 = Merge(
    Data1=mesh_uv_12,
    Data2=mesh_uv_13,
    Data3=mesh_uv_14,
    Data4=flipm_17,
    Data5=flipm_18,
    Data6=mesh_uv_17,
    Data7=flipm_13,
    Data8=mesh_uv_19,
    Data9=mesh_uv_20,
    Data10=flipm_14,
    Data11=mesh_uv_22)
mjoin = MeshJoin(Meshes=merge_12)
mjoin_2 = MeshJoin(Meshes=merge_11)
faceb = FaceBoundaries(Mesh=mjoin)
faceb_2 = FaceBoundaries(Mesh=mjoin_2)
pcen = PolygonCenter(Polyline=faceb_2)  # -> CenterV, CenterE, CenterA
mjoin_3 = MeshJoin(Meshes=merge_13)
mjoin_4 = MeshJoin(Meshes=merge_10)
pcen_2 = PolygonCenter(Polyline=faceb)  # -> CenterV, CenterE, CenterA
smesh = SimpleMesh(Brep=faceb)
smesh_2 = SimpleMesh(Brep=faceb_2)
faceb_3 = FaceBoundaries(Mesh=mjoin_3)
scale_2 = Scale(Geometry=smesh, Center=pcen_2.CenterV, Factor=number_slider_19)  # -> Geometry, Transform
scale_3 = Scale(Geometry=smesh_2, Center=pcen.CenterV, Factor=number_slider_19)  # -> Geometry, Transform
pcen_3 = PolygonCenter(Polyline=faceb_3)  # -> CenterV, CenterE, CenterA
faceb_4 = FaceBoundaries(Mesh=mjoin_4)
pcen_4 = PolygonCenter(Polyline=faceb_4)  # -> CenterV, CenterE, CenterA
smesh_3 = SimpleMesh(Brep=faceb_3)
smesh_4 = SimpleMesh(Brep=faceb_4)
scale_4 = Scale(Geometry=smesh_3, Center=pcen_3.CenterV, Factor=number_slider_19)  # -> Geometry, Transform
scale_5 = Scale(Geometry=smesh_4, Center=pcen_4.CenterV, Factor=number_slider_19)  # -> Geometry, Transform

# ---- group: 片片 (continued)
merge_14 = Merge(Data1=scale_3.Geometry, Data2=scale_4.Geometry, Data3=scale_5.Geometry)
lng_2 = ListLength(List=merge_14)
remap_28 = RemapNumbers(Value=remap_18.Mapped, Source=Domain(0, 1), Target=lng_2)  # -> Mapped, Clipped
round = Round(Number=remap_28.Mapped)  # -> Nearest, Floor, Ceiling
reduce = RandomReduce(List=merge_14, Reduction=round.Nearest, Seed=Slider(44, range=0..100))

# ----
offmsh = OffsetMesh(Mesh=reduce, Distance=Slider(0.001, range=0..0.001), BothSides=0, CreateSolid="0")  # -> flatten(Offset)
flipm_20 = FlipMesh(Mesh=offmsh, VertexNormals=True, FaceNormals=True, FaceOrientation=True)
merge_15 = Merge(Data1=flatten(reduce), Data2=flipm_20)  # -> flatten(Result)
mesh数量 = Panel(merge_15)

move_86 = Move(Geometry=merge_15, Motion=Z_2)  # -> Geometry, Transform
move_87 = Move(Geometry=move_86.Geometry, Motion=Y_4)  # -> Geometry, Transform

mcol_4 = MeshColours(Mesh=merge_15, Colours=hsv)
mcol_5 = MeshColours(Mesh=move_87.Geometry, Colours=hsv)
panel_80 = Panel(mcol_5)
send = Send(Timestamp=receive.Timestamp, Message=panel_24, Meshes=mcol_5)
panel_82 = Panel(division_9)

# ==== cluster Cluster
list = ClusterInput()
list_2 = ClusterInput()
list_3 = ClusterInput()

# ---- group: 头部向量
left_eye = Panel("28")
head = Panel("26")
right_eye = Panel("30")
list_item = ListItem(List=list, Index=left_eye, Wrap=True)
list_item_2 = ListItem(List=list_2, Index=right_eye, Wrap=True)
list_item_3 = ListItem(List=list_3, Index=head, Wrap=True)
plane_3pt = Plane3Pt(PointA=list_item_3, PointB=list_item, PointC=list_item_2)
polyline = PolyLine(Vertices=[list_item_3, list_item, list_item_2], Closed=False)
polygon_center = PolygonCenter(Polyline=polyline)  # -> CenterV, CenterE, CenterA
vector = Vector(plane_3pt)

# ----
i = ClusterOutput(list_item_3)
vector_2 = ClusterOutput(vector)
list_item_4 = ListItem(List=flatten(polygon_center.CenterV), Index=0, Wrap=True)  # -> Item, Item1
list_item_5 = ListItem(List=flatten(vector), Index=0, Wrap=True)  # -> Item, Item1

# ---- group: 头部向量 (continued)
vector_display = VectorDisplay(Anchor=list_item_4.Item, Vector=list_item_5.Item)

# ----
vector_display_2 = VectorDisplay(Anchor=list_item_4.Item1, Vector=list_item_5.Item1)

# ==== cluster Cluster_2
L = ClusterInput()
item = ListItem(List=L, Index="26", Wrap=True)
msphere = MeshSphere(Base=item, Radius=Slider(0.1, range=0..0.1), UCount="4", VCount="4")
swatch = ClusterOutput(ColourSwatch(SwatchColor=RGB(0, 38, 255)))
M = ClusterOutput(msphere)
