# Grasshopper definition 0620(1).gh (Grasshopper 1.0.7)
# plug-ins: Firefly_X, Pufferfish, gHowl

network_source = NetworkSource()  # -> NetworkAdapterIsUp, AdapterProperties, LocalIpAddress
panel = Panel(network_source.LocalIpAddress)

# ---- group: interaction
udp_receiver = UDPReceiver(Address=network_source.LocalIpAddress, Port="2222", Pattern=0)  # -> Info, Data
panel_2 = Panel(udp_receiver.Data)

# ----
panel_3 = Panel("100")  # disabled
panel_4 = Panel("101")  # disabled
udp_receiver_2 = UDPReceiver(Address=network_source.LocalIpAddress, Port=panel_3, Pattern=0)  # -> Info, Data; disabled
udp_receiver_3 = UDPReceiver(Address=network_source.LocalIpAddress, Port=panel_4, Pattern=0)  # -> Info, Data; disabled
interaction_mode_using_global_orientatio = Panel(udp_receiver_2.Data)  # "interaction mode using global orientation"; disabled
interaction_mode_using_head = Panel(udp_receiver_3.Data)  # disabled

trigger = Trigger(Interval=1000, TimerInterval=1000, Target=unityslider)  # disabled
trigger_2 = Trigger(Interval=1000, TimerInterval=1000, Target=[unityslider, unityslider_2])  # disabled
unityslider = UnitySlider()  # -> out, HeadPosition, HeadRotation
# ---------- unityslider: C# usings ----------
using Grasshopper.Kernel.Special;
using Grasshopper.GUI.Canvas;
# ---------- unityslider: C# ----------
    Register(Component);
    HeadPosition = temp_positionRhino;
    HeadRotation = temp_rotationRhino;
# ---------- unityslider: C# additional code ----------
  Point3d temp_positionRhino;
  Vector3d temp_rotationRhino;
  void Register(IGH_Component component)
  {
    Rhino.Runtime.HostUtils.RegisterNamedCallback("ToGH_HeadPose", ToGrasshopper);

  }

  void ToGrasshopper(object sender, Rhino.Runtime.NamedParametersEventArgs args)
  {
    Point3d positionRhino;
    Vector3d rotationRhino;
    if(args.TryGetPoint("HeadPosition", out positionRhino))
    {

      args.TryGetVector("HeadRotation", out rotationRhino);
      temp_positionRhino = positionRhino;
      temp_rotationRhino = rotationRhino;
    }
  }
# ---------- end unityslider ----------
unityslider_2 = UnitySlider()  # -> out, StationaryPercentage
# ---------- unityslider_2: C# ----------
    Register(Component);
    StationaryPercentage = temp_stationaryPercentage;
# ---------- unityslider_2: C# additional code ----------
  string temp_stationaryPercentage;

  void Register(IGH_Component component)
  {
    Rhino.Runtime.HostUtils.RegisterNamedCallback("ToGH_StationaryPercentage", ToGrasshopper);
  }

  void ToGrasshopper(object sender, Rhino.Runtime.NamedParametersEventArgs args)
  {
    double percentage;
    if (args.TryGetDouble("StationaryPercentage", out percentage))
    {
      temp_stationaryPercentage = percentage.ToString();
    }
  }
# ---------- end unityslider_2 ----------
vr获取_头部向量 = Panel(unityslider.HeadRotation)
vr获取_头部坐标 = Panel(unityslider.HeadPosition)
注意力状态 = Panel(unityslider_2.StationaryPercentage)

# ----
# (1)随机拿一个人，空间识别谁是主要人（好像也说得通）
# (2)固定拿一个人，画面扰动之后会变化
panel_5 = Panel("")
text_split = TextSplit(Text=panel_2)
c_script = CSharpScript(x=text_split)  # -> out, a; inputs x: list of String
# ---------- c_script: C# usings ----------
using System.Linq;
# ---------- c_script: C# ----------
    List<List<string>> groups = new List<List<string>>();
    List<string> currentGroup = new List<string>();


    foreach (string item in x)
    {
      if (item == "")
      {
        if (currentGroup.Any())
        {
          groups.Add(currentGroup);
          currentGroup = new List<string>();
        }
      }
      else
      {
        currentGroup.Add(item);
      }
    }

    if (currentGroup.Any())
    {
      groups.Add(currentGroup);
    }

    List<string> combinedGroup = groups.Select(sublist => string.Join("\n", sublist)).ToList();
    a = combinedGroup.ToArray();
# ---------- end c_script ----------
text_split_2 = TextSplit(Text=c_script.a)
remap_numbers = RemapNumbers(Value=注意力状态, Source="0 to 100", Target=Domain(0, 1))  # -> Mapped, Clipped
construct_point = ConstructPoint(XCoordinate=0, YCoordinate=0, ZCoordinate=0)
data_recorder = DataRecorder(remap_numbers.Mapped, DataLimit=-10, RecordData=True)
partition_list = PartitionList(List=data_recorder, Size=Slider(3, range=0..100))
panel_6 = Panel(partition_list)
number = Number(partition_list)
average = Average(Input=number)
list_item = ListItem(List=text_split_2, Index="5", Wrap=True)  # -> Item, Item1, Item2, Item3, Item4, Item5, Item6, Item7
list_item_2 = ListItem(List=text_split_2, Index=0, Wrap=True)  # -> Item, Item1, Item2, Item3, Item4, Item5, Item6, Item7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
panel_7 = Panel(average)

# ---- group: head boundingbox1中心点
merge = Merge(Data1=list_item.Item, Data2=list_item.Item4, Data3=list_item.Item7, Data4=list_item.Item3)
text_split_3 = TextSplit(Text=merge, Separators=":")
list_item_3 = ListItem(List=text_split_3, Index=1, Wrap=True)
text_split_4 = TextSplit(Text=list_item_3, Separators=" ")  # -> simplify(Result)
list_item_4 = ListItem(List=text_split_4, Index=0, Wrap=True)  # -> Item, Item1, Item2
construct_point_2 = ConstructPoint(XCoordinate=list_item_4.Item, YCoordinate=list_item_4.Item1, ZCoordinate=list_item_4.Item2)
trim_tree = TrimTree(Tree=construct_point_2, Depth=1)
polyline = PolyLine(Vertices=trim_tree, Closed=True)
面部中心点_问题_不分前后 = Area(Geometry=polyline)  # -> Area, Centroid

# ----
panel_8 = Panel(data_recorder)

# ---- group: head boundingbox2中心点
merge_2 = Merge(Data1=list_item.Item1, Data2=list_item.Item2, Data3=list_item.Item6, Data4=list_item.Item5)
text_split_5 = TextSplit(Text=merge_2, Separators=":")
list_item_5 = ListItem(List=text_split_5, Index=1, Wrap=True)
text_split_6 = TextSplit(Text=list_item_5, Separators=" ")  # -> simplify(Result)
list_item_6 = ListItem(List=text_split_6, Index=0, Wrap=True)  # -> Item, Item1, Item2
construct_point_3 = ConstructPoint(XCoordinate=list_item_6.Item, YCoordinate=list_item_6.Item1, ZCoordinate=list_item_6.Item2)
trim_tree_2 = TrimTree(Tree=construct_point_3, Depth=1)
polyline_2 = PolyLine(Vertices=trim_tree_2, Closed=True)
area = Area(Geometry=polyline_2)  # -> Area, Centroid

# ---- group: head position
panel_9 = Panel(list_item_2.Item3)
text_split_7 = TextSplit(Text=panel_9, Separators=":")
list_item_7 = ListItem(List=text_split_7, Index=1, Wrap=True)
text_split_8 = TextSplit(Text=list_item_7, Separators=" ")
list_item_8 = ListItem(List=text_split_8, Index=0, Wrap=True)  # -> Item, Item1, Item2
construct_point_4 = ConstructPoint(XCoordinate=list_item_8.Item, YCoordinate=list_item_8.Item1, ZCoordinate=list_item_8.Item2)  # -> simplify(Point)

# ----
list_item_9 = ListItem(List=panel_7, Index="-2", Wrap=True)

# ---- group: global orientation
panel_10 = Panel(list_item_2.Item2)
text_split_9 = TextSplit(Text=list_item_2.Item2, Separators=":")
list_item_10 = ListItem(List=text_split_9, Index=1, Wrap=True)
text_split_10 = TextSplit(Text=list_item_10, Separators=" ")

# ---- group: position
text_split_11 = TextSplit(Text=list_item_2.Item1, Separators=":")
list_item_11 = ListItem(List=text_split_11, Index=1, Wrap=True)
text_split_12 = TextSplit(Text=list_item_11, Separators=" ")
list_item_12 = ListItem(List=text_split_12, Index=0, Wrap=True)  # -> Item, Item1, Item2
construct_point_5 = ConstructPoint(XCoordinate=list_item_12.Item, YCoordinate=list_item_12.Item1, ZCoordinate=list_item_12.Item2)  # -> flatten(Point)
persons_position = Point(construct_point_5)

# ----
null_placeholder = NullPlaceholder()
panel_11 = Panel(list_item_9)
knee = Panel("19")
panel_12 = Panel(text_split_10)
panel_13 = Panel("""1.99618572
0.02333067 
-0.02333067""")
panel_14 = Panel(persons_position)
list_item_13 = ListItem(List=panel_13, Index=0, Wrap=True)  # -> Item, Item1, Item2

# ---- group: head position / heads' position
persons_position_2 = Point(flatten(construct_point_4))

# ----
vector_xyz = VectorXYZ(XComponent=list_item_13.Item, YComponent=list_item_13.Item1, ZComponent=list_item_13.Item2)  # -> Vector, Length
number_slider = Slider(75, range=0..1000)
vector_display = VectorDisplay(Anchor=persons_position_2, Vector=vector_xyz.Vector)
list_item_14 = ListItem(List=persons_position_2, Index=0, Wrap=True)  # -> Item, Item1
merge_3 = Merge(Data1=面部中心点_问题_不分前后.Centroid, Data2=area.Centroid)
line = Line(StartPoint=list_item_14.Item, EndPoint=list_item_14.Item1)
line_2 = Line(StartPoint=list_item_14.Item1, EndPoint=list_item_14.Item)
vector_display_2 = VectorDisplay(Anchor=list_item_14.Item, Vector=line)
# 注意这里
panel_15 = Panel("360")

# ---- group: 坐标系转化
curve = Curve(<curve referenced from the Rhino model>)
curve_2 = Curve(<curve referenced from the Rhino model>)
curve_3 = Curve(<curve referenced from the Rhino model>)
curve_4 = Curve(<curve referenced from the Rhino model>)
end_points = EndPoints(Curve=curve)  # -> Start, End
end_points_2 = EndPoints(Curve=curve_3)  # -> Start, End
point = Point(end_points.End)
point_2 = Point(end_points_2.End)
line_pt = LinePt(Line=curve_2, Point=point)
line_pt_2 = LinePt(Line=curve_4, Point=point_2)
deconstruct_plane = DeconstructPlane(Plane=line_pt)  # -> Origin, XAxis, YAxis, ZAxis
deconstruct_plane_2 = DeconstructPlane(Plane=line_pt_2)  # -> Origin, XAxis, YAxis, ZAxis
vector_display_3 = VectorDisplay(Anchor=deconstruct_plane.Origin, Vector=deconstruct_plane.XAxis)
orient = Orient(Source=line_pt_2, Target=line_pt)  # -> Geometry, Transform

# ----
是否位于分隔两边 = Panel("True")
任务处理3_思维强度_规整度 = Slider(0.356, range=0..1)
任务处理2_疲惫度_开放度 = Slider(0.715, range=0..1)

# ---- group: 空间形态 / 任务处理模式 高度
任务处理1_创造性_近端高度 = Slider(0.1, range=0..1)

# ---- group: 空间形态 / 任务处理模式 宽度
远端 = Slider(0, range=0..1)
近端 = Slider(0, range=0..1)

# ---- group: 空间形态
交往模式 = Slider(1, range=0..1)

# ---- group: 副1
number_slider_2 = Slider(-0.579, range=-3..3)
number_slider_3 = Slider(-0.383, range=-2..2)

# ---- group: 点位置 调试用 主0
number_slider_4 = Slider(0.1, range=-2..2)
number_slider_5 = Slider(-0.69, range=-5..5)

# ---- group: 情绪 颜色 / 色相 / joy
number_slider_6 = Slider(0, range=0..1)
swatch = ColourSwatch(SwatchColor=RGB(224, 126, 126))

# ---- group: 情绪 颜色 / 色相 / sorrow
number_slider_7 = Slider(0.01, range=0..1)
swatch_2 = ColourSwatch(SwatchColor=RGB(148, 148, 148))

# ---- group: 空间形态 / 任务处理模式 高度
注意力状态_远端 = Slider(0.47, range=0..1)

# ---- group: 情绪 颜色 / 色相 / surprise
number_slider_8 = Slider(0.102, range=0..1)
swatch_3 = ColourSwatch(SwatchColor=RGB(114, 194, 107))

# ---- group: test null
# null 恢复到初始状态 初始状态确定 还是维持上一次状态
# trigger速度调整
# 间隔/连续输入
# 宽度要不要
# 明度 饱和度要不要
# 修改
# 网格数量
# 高宽阈值
# 颜色
# 进入空间引起高宽变化的范围
# 分隔范围
# 缝隙大小
# 开放度阈值
# 最终网格
null_empty = Panel("")
python = GhPythonScript(x=null_empty)  # -> out, a
# ---------- python: Python ----------
__author__ = "lmh"
__version__ = "2024.06.21"

import rhinoscriptsyntax as rs
if x or x == 0:
    a = x
else:
    a = null
# ---------- end python ----------

# ---- group: 情绪 颜色 / 色相 / anger
number_slider_9 = Slider(0.686, range=0..1)
swatch_4 = ColourSwatch(SwatchColor=RGB(105, 143, 209))

# ---- group: 情绪 颜色
明度 = Slider(-0.03, range=-0.1..0.1)
饱和度 = Slider(-0.033, range=-0.1..0.1)

# ----
ghpython_script = GhPythonScript(x=近端)  # -> out, a
# ---------- ghpython_script: Python ----------
__author__ = "lmh"
__version__ = "2024.06.21"

import rhinoscriptsyntax as rs
if x or x == 0:
    a = x
else:
    a = 0
# ---------- end ghpython_script ----------
ghpython_script_2 = GhPythonScript(x=远端)  # -> out, a; same code as ghpython_script
ghpython_script_3 = GhPythonScript(x=list_item_9)  # -> out, a; same code as ghpython_script

速度 = Slider(8, range=0..20)
trigger_3 = Trigger(Interval=20, TimerInterval=20, Target=counter)  # disabled
dom = ConstructDomain(DomainStart="0", DomainEnd=速度)
python_2 = GhPythonScript(x=ghpython_script_3.a)  # -> out, a
# ---------- python_2: Python ----------
__author__ = "lmh"
__version__ = "2024.06.20"

import rhinoscriptsyntax as rs
if 0 <= x <= 0.2:
    a = 0
if 0.2 < x <= 0.4:
    a = 0.25
if 0.4 < x <= 0.6:
    a = 0.5
if 0.6 < x <= 0.8:
    a = 0.75
if 0.8 < x <= 1:
    a = 1
# ---------- end python_2 ----------
rec = DataRecorder(python_2.a, DataLimit=-10, RecordData=True)
item = ListItem(List=rec, Index="-1", Wrap=True)
item_2 = ListItem(List=rec, Index="-2", Wrap=True)
dcon = DeleteConsecutive(Set=rec, Wrap=False)  # -> Set, Count
subtraction = Subtraction(A=item, B=item_2)
python_3 = GhPythonScript(x=subtraction)  # -> out, a
# ---------- python_3: Python ----------
__author__ = "lmh"
__version__ = "2024.06.20"

import rhinoscriptsyntax as rs
if x == 0:
    a = 0
else:
    a = 1
# ---------- end python_3 ----------
counter = Counter(CountDirection=True, Step=1, StartStop=Toggle(True), Reset=python_3.a, OptionalCounterDomain=Domain(0, 100))
remap = RemapNumbers(Value=counter, Source="0 to 100", Target=dom)  # -> Mapped, Clipped
python_4 = GhPythonScript(x=remap.Mapped)  # -> out, a
# ---------- python_4: Python ----------
__author__ = "lmh"
__version__ = "2024.06.11"

import rhinoscriptsyntax as rs
import math
if 0 <= x <= 1:
    a = (math.cos((x-1) * math.pi) + 1) / 2


if x > 1:
    a = 1
# ---------- end python_4 ----------
item_3 = ListItem(List=dcon.Set, Index="-1", Wrap=True)
item_4 = ListItem(List=dcon.Set, Index="-2", Wrap=True)
dom_2 = ConstructDomain(DomainStart=item_4, DomainEnd=item_3)
remap_2 = RemapNumbers(Value=python_4.a, Source=Domain(0, 1), Target=dom_2)  # -> Mapped, Clipped
panel_16 = Panel(remap_2.Mapped)

panel_17 = Panel(ghpython_script_3.a)
X = UnitX(Factor=number_slider_3)
xy = XYPlane(Origin=Point(0, 0, 0))
Y = UnitY(Factor=number_slider_2)
pt = Point(<point referenced from the Rhino model>)
move = Move(Geometry=pt, Motion=X)  # -> Geometry, Transform
Y_2 = UnitY(Factor=number_slider_5)
X_2 = UnitX(Factor=number_slider_4)
move_2 = Move(Geometry=pt, Motion=X_2)  # -> Geometry, Transform

# ---- group: 1
# 切换时点击
move_3 = Move(Geometry=move.Geometry, Motion=Y)  # -> Geometry, Transform

# ---- group: 坐标点替换 0
move_4 = Move(Geometry=move_2.Geometry, Motion=Y_2)  # -> Geometry, Transform

# ----
cp = PlaneClosestPoint(Point=move_4.Geometry, Plane=xy)  # -> Point, UVPoint, Distance
pt_2 = Point(<point referenced from the Rhino model>)
pt_3 = Point(<point referenced from the Rhino model>)
crv = Curve(<curve referenced from the Rhino model>)
crv_2 = Curve(<curve referenced from the Rhino model>)
crv_3 = Curve(<curve referenced from the Rhino model>)
crv_4 = Curve(<curve referenced from the Rhino model>)
crv_5 = Curve(<curve referenced from the Rhino model>)
crv_6 = Curve(<curve referenced from the Rhino model>)
crv_7 = Curve(<curve referenced from the Rhino model>)
crv_8 = Curve(<curve referenced from the Rhino model>)
crv_9 = Curve(<curve referenced from the Rhino model>)
crv_10 = Curve(<curve referenced from the Rhino model>)
crv_cp = CurveClosestPoint(Point=cp.Point, Curve=reparameterize(crv_10))  # -> Point, Parameter, Distance

rec_2 = DataRecorder(crv_cp.Parameter, DataLimit=-10, RecordData=True)
python_5 = GhPythonScript(x=rec_2)  # -> out, a; same code as python
null = NullItem(Item=python_5.a)  # -> NullFlags, InvalidFlags, Description
dispatch = Dispatch(List=rec_2, DispatchPattern=null.NullFlags)  # -> ListA, ListB
item_5 = ListItem(List=dispatch.ListB, Index="-1", Wrap=True)

crv_11 = Curve(<curve referenced from the Rhino model>)
flip = FlipCurve(Curve=crv_9)  # -> Curve, Flag
flip_2 = FlipCurve(Curve=crv_5)  # -> Curve, Flag
flip_3 = FlipCurve(Curve=crv_4)  # -> Curve, Flag
flip_4 = FlipCurve(Curve=crv_6)  # -> Curve, Flag
flip_5 = FlipCurve(Curve=crv_11)  # -> Curve, Flag
flip_6 = FlipCurve(Curve=crv_7)  # -> Curve, Flag
flip_7 = FlipCurve(Curve=crv_8)  # -> Curve, Flag
vec = Vector(crv_10)
vec_2 = Vector(flip_5.Curve)
expression = Expression(x=item_5, Expression="1-x")

# ---- group: 高度宽度 / 高宽阈值
高度缩小阈值 = Slider(0.761, range=0..1)
宽度缩小阈值 = Slider(0.76, range=0..1)

# ----
crv_12 = Curve(<curve referenced from the Rhino model>)
crv_13 = Curve(<curve referenced from the Rhino model>)
crv_14 = Curve(<curve referenced from the Rhino model>)
crv_15 = Curve(<curve referenced from the Rhino model>)
crv_16 = Curve(<curve referenced from the Rhino model>)
crv_17 = Curve(<curve referenced from the Rhino model>)
crv_18 = Curve(<curve referenced from the Rhino model>)
crv_19 = Curve(<curve referenced from the Rhino model>)
crv_20 = Curve(<curve referenced from the Rhino model>)
pt_4 = Point(<point referenced from the Rhino model>)
pt_5 = Point(<point referenced from the Rhino model>)
flip_8 = FlipCurve(Curve=crv_15)  # -> Curve, Flag
flip_9 = FlipCurve(Curve=crv_19)  # -> Curve, Flag
flip_10 = FlipCurve(Curve=crv_12)  # -> Curve, Flag
flip_11 = FlipCurve(Curve=crv_20)  # -> Curve, Flag

# ---- group: 分隔 / 范围线
crv_21 = Curve(<curve referenced from the Rhino model>)
crv_22 = Curve(<curve referenced from the Rhino model>)

# ----
number_slider_10 = Slider(0, range=0..1)
number_slider_11 = Slider(0.01, range=0..0.01)
number_slider_12 = Slider(0.753, range=0..1)
number_slider_13 = Slider(0.249, range=0..1)
number_slider_14 = Slider(0.757, range=0..1)
subtraction_2 = Subtraction(A=number_slider_14, B=number_slider_11)
expression_2 = Expression(x=number_slider_10, Expression="1-X")
number_slider_15 = Slider(0.01, range=0..0.01)
number_slider_16 = Slider(0.757, range=0..1)
eval = EvaluateCurve(Curve=reparameterize(flip_6.Curve), Parameter=Slider(0.25, range=0..1))  # -> Point, Tangent, Angle
eval_2 = EvaluateCurve(Curve=reparameterize(crv_3), Parameter=number_slider_13)  # -> Point, Tangent, Angle
eval_3 = EvaluateCurve(Curve=reparameterize(crv_3), Parameter=number_slider_13)  # -> Point, Tangent, Angle
eval_4 = EvaluateCurve(Curve=reparameterize(crv_3), Parameter=number_slider_14)  # -> Point, Tangent, Angle
eval_5 = EvaluateCurve(Curve=reparameterize(crv_3), Parameter=number_slider_14)  # -> Point, Tangent, Angle
eval_6 = EvaluateCurve(Curve=reparameterize(crv_3), Parameter=subtraction_2)  # -> Point, Tangent, Angle
eval_7 = EvaluateCurve(Curve=reparameterize(crv_3), Parameter=number_slider_14)  # -> Point, Tangent, Angle
eval_8 = EvaluateCurve(Curve=reparameterize(crv_3), Parameter=subtraction_2)  # -> Point, Tangent, Angle
eval_9 = EvaluateCurve(Curve=reparameterize(flip.Curve), Parameter=number_slider_10)  # -> Point, Tangent, Angle
eval_10 = EvaluateCurve(Curve=reparameterize(crv_2), Parameter=expression_2)  # -> Point, Tangent, Angle
eval_11 = EvaluateCurve(Curve=reparameterize(flip_4.Curve), Parameter=number_slider_10)  # -> Point, Tangent, Angle
eval_12 = EvaluateCurve(Curve=reparameterize(flip_6.Curve), Parameter=number_slider_12)  # -> Point, Tangent, Angle
eval_13 = EvaluateCurve(Curve=reparameterize(flip_6.Curve), Parameter=number_slider_12)  # -> Point, Tangent, Angle
eval_14 = EvaluateCurve(Curve=reparameterize(flip_7.Curve), Parameter=number_slider_10)  # -> Point, Tangent, Angle
eval_15 = EvaluateCurve(Curve=crv, Parameter=number_slider_10)  # -> Point, Tangent, Angle
subtraction_3 = Subtraction(A=number_slider_16, B=number_slider_15)
eval_16 = EvaluateCurve(Curve=reparameterize(crv_14), Parameter=Slider(0.249, range=0..1))  # -> Point, Tangent, Angle
eval_17 = EvaluateCurve(Curve=reparameterize(crv_14), Parameter=number_slider_16)  # -> Point, Tangent, Angle
eval_18 = EvaluateCurve(Curve=reparameterize(crv_14), Parameter=subtraction_3)  # -> Point, Tangent, Angle
eval_19 = EvaluateCurve(Curve=reparameterize(crv_18), Parameter=Slider(0.25, range=0..1))  # -> Point, Tangent, Angle
eval_20 = EvaluateCurve(Curve=reparameterize(crv_18), Parameter=Slider(0.753, range=0..1))  # -> Point, Tangent, Angle
trigger_4 = Trigger(Interval=200, TimerInterval=200, Target=rec_6)  # disabled
vec2pt = Vector2Pt(PointA=eval_5.Point, PointB=eval_6.Point, Unitize=False)  # -> Vector, Length
vec2pt_2 = Vector2Pt(PointA=eval_5.Point, PointB=eval_6.Point, Unitize=False)  # -> Vector, Length
vec2pt_3 = Vector2Pt(PointA=eval_17.Point, PointB=eval_18.Point, Unitize=False)  # -> Vector, Length

# ---- group: 网格数设定
number_slider_17 = Slider(1, range=0..10)
number_slider_18 = Slider(5, range=0..10)
number_slider_19 = Slider(5, range=0..10)

# ----
number_slider_20 = Slider(0.984, range=0..1)

# ---- group: emotion
panel_18 = Panel("403")

# ----
udp_receiver_4 = UDPReceiver(Address=network_source.LocalIpAddress, Port=panel_18, Pattern=0)  # -> Info, Data

# ---- group: emotion (continued)
emotion_of_headwearer = Panel(udp_receiver_4.Data)

panel_19 = Panel("4031")

# ----
udp_receiver_5 = UDPReceiver(Address=network_source.LocalIpAddress, Port=panel_19, Pattern=0)  # -> Info, Data

# ---- group: emotion (continued)
emotion_average = Panel(udp_receiver_5.Data)

# ----
data_recorder_2 = DataRecorder(emotion_average, DataLimit=-10, RecordData=True)
panel_20 = Panel(data_recorder_2)

# ---- group: emotion
panel_21 = Panel("402")

# ----
udp_receiver_6 = UDPReceiver(Address=network_source.LocalIpAddress, Port=panel_21, Pattern=0)  # -> Info, Data

# ---- group: emotion (continued)
emotion_average_2 = Panel(udp_receiver_6.Data)

# ----
# TBD：时间间隔有点问题 之前都没有我问题来着
panel_22 = Panel(""" 
:""")
text_split_13 = TextSplit(Text=emotion_average_2, Separators=panel_22)
panel_23 = Panel("""1
3
5
7""")
list_item_15 = ListItem(List=text_split_13, Index=panel_23, Wrap=True)
panel_24 = Panel(list_item_15)
remap_numbers_2 = RemapNumbers(Value=panel_24, Source="0 to 5", Target="0.1 to 1")  # -> Mapped, Clipped
list_item_16 = ListItem(List=remap_numbers_2.Mapped, Index=0, Wrap=True)  # -> Item, Item1, Item2, Item3
sorrow = Panel(list_item_16.Item1)
anger = Panel(list_item_16.Item2)
joy = Panel(list_item_16.Item)

surprise = Panel(list_item_16.Item3)
merge_4 = Merge(Data1=flatten(joy), Data2=flatten(sorrow), Data3=flatten(anger), Data4=flatten(surprise))

trigger_5 = Trigger(Interval=1000, TimerInterval=1000, Target=counter_2)  # disabled

counter_2 = Counter(CountDirection=True, Step=1, StartStop=True, Reset=Button(), OptionalCounterDomain=Domain(0, 100))

panel_25 = Panel(counter_2)
random = Random(Range=Domain(0, 1), Number=1, Seed=panel_25)
生成随机数 = Panel(random)

udp_receiver_7 = UDPReceiver(Address=network_source.LocalIpAddress, Port="1111", Pattern=0)  # -> Info, Data
text_split_14 = TextSplit(Text=udp_receiver_7.Data, Separators=panel_5)
panel_26 = Panel(udp_receiver_7.Data)
c_script_2 = CSharpScript(x=text_split_14)  # -> out, a; inputs x: list of String; same code as c_script
text_split_15 = TextSplit(Text=c_script_2.a)
split_list = SplitList(List=text_split_15, Index="1")  # -> flatten(ListA), ListB
list_item_17 = ListItem(List=flatten(split_list.ListA), Index=0, Wrap=True)
text_split_16 = TextSplit(Text=split_list.ListB, Separators=" ")  # -> simplify(Result)
panel_27 = Panel(split_list.ListA)
list_item_18 = ListItem(List=text_split_16, Index=0, Wrap=True)  # -> Item, Item1, Item2
construct_point_6 = ConstructPoint(XCoordinate=list_item_18.Item, YCoordinate=list_item_18.Item1, ZCoordinate=list_item_18.Item2)
distance = Distance(PointA=construct_point_6, PointB=construct_point)
smaller_than = SmallerThan(FirstNumber=distance, SecondNumber="0.001")  # -> SmallerThan, OrEqualTo
member_index = MemberIndex(Set=smaller_than.SmallerThan, Member=Toggle(True))  # -> Index, Count
replace_items = ReplaceItems(List=construct_point_6, Item=null_placeholder, Indices=member_index.Index, Wrap=False)
flatten_tree = FlattenTree(Tree=replace_items, Path="{0}")
member_index_2 = MemberIndex(Set=flatten(split_list.ListA), Member="Person 392:")  # -> Index, Count

trim_tree_3 = TrimTree(Tree=replace_items, Depth=1)  # disabled
flip_matrix = FlipMatrix(Data=trim_tree_3)  # disabled
panel_28 = Panel("0")  # disabled
list_item_19 = ListItem(List=flip_matrix, Index=panel_28, Wrap=True)  # -> flatten(Item); disabled

partition_list_2 = PartitionList(List=flatten_tree, Size=Slider(34, range=0..100))
panel_29 = Panel(partition_list_2)
list_item_20 = ListItem(List=partition_list_2, Index=knee, Wrap=True)
panel_30 = Panel(list_item_20)

# ---- group: 肘关节夹角
panel_31 = Panel("""18
19
20""")
panel_32 = Panel("""22
23
24""")
list_item_21 = ListItem(List=partition_list_2, Index=panel_31, Wrap=True)
list_item_22 = ListItem(List=partition_list_2, Index=panel_32, Wrap=True)
list_item_23 = ListItem(List=list_item_22, Index=0, Wrap=True)  # -> Item, Item1, Item2
list_item_24 = ListItem(List=list_item_21, Index=0, Wrap=True)  # -> Item, Item1, Item2
vector_2pt = Vector2Pt(PointA=list_item_23.Item, PointB=list_item_23.Item1, Unitize=False)  # -> Vector, Length
vector_2pt_2 = Vector2Pt(PointA=list_item_23.Item2, PointB=list_item_23.Item1, Unitize=False)  # -> Vector, Length
vector_2pt_3 = Vector2Pt(PointA=list_item_24.Item, PointB=list_item_24.Item1, Unitize=False)  # -> Vector, Length
vector_2pt_4 = Vector2Pt(PointA=list_item_24.Item2, PointB=list_item_24.Item1, Unitize=False)  # -> Vector, Length
angle = Angle(VectorA=vector_2pt.Vector, VectorB=vector_2pt_2.Vector)  # -> Angle, Reflex
angle_2 = Angle(VectorA=vector_2pt_3.Vector, VectorB=vector_2pt_4.Vector)  # -> Angle, Reflex
degrees = Degrees(Radians=angle.Angle)
degrees_2 = Degrees(Radians=angle_2.Angle)
right_膝关节夹角 = Panel(degrees_2)
left_膝关节夹角 = Panel(degrees)

# ---- group: 肩部夹角
panel_33 = Panel("""13
12
22""")
panel_34 = Panel("""6
5
18""")
list_item_25 = ListItem(List=partition_list_2, Index=panel_34, Wrap=True)
list_item_26 = ListItem(List=partition_list_2, Index=panel_33, Wrap=True)
list_item_27 = ListItem(List=list_item_26, Index=0, Wrap=True)  # -> Item, Item1, Item2
list_item_28 = ListItem(List=list_item_25, Index=0, Wrap=True)  # -> Item, Item1, Item2
vector_2pt_5 = Vector2Pt(PointA=list_item_27.Item, PointB=list_item_27.Item1, Unitize=False)  # -> Vector, Length
vector_2pt_6 = Vector2Pt(PointA=list_item_27.Item2, PointB=list_item_27.Item1, Unitize=False)  # -> Vector, Length
vector_2pt_7 = Vector2Pt(PointA=list_item_28.Item, PointB=list_item_28.Item1, Unitize=False)  # -> Vector, Length
vector_2pt_8 = Vector2Pt(PointA=list_item_28.Item2, PointB=list_item_28.Item1, Unitize=False)  # -> Vector, Length
angle_3 = Angle(VectorA=vector_2pt_5.Vector, VectorB=vector_2pt_6.Vector)  # -> Angle, Reflex
angle_4 = Angle(VectorA=vector_2pt_7.Vector, VectorB=vector_2pt_8.Vector)  # -> Angle, Reflex
degrees_3 = Degrees(Radians=angle_3.Angle)
degrees_4 = Degrees(Radians=angle_4.Angle)
right_肩部关节夹角 = Panel(degrees_4)
left_肩部关节夹角 = Panel(degrees_3)

# ---- group: 肘关节夹角
panel_35 = Panel("""5
6
7""")
panel_36 = Panel("""12
13
14""")
list_item_29 = ListItem(List=partition_list_2, Index=panel_35, Wrap=True)
list_item_30 = ListItem(List=partition_list_2, Index=panel_36, Wrap=True)
list_item_31 = ListItem(List=list_item_30, Index=0, Wrap=True)  # -> Item, Item1, Item2
list_item_32 = ListItem(List=list_item_29, Index=0, Wrap=True)  # -> Item, Item1, Item2
vector_2pt_9 = Vector2Pt(PointA=list_item_31.Item, PointB=list_item_31.Item1, Unitize=False)  # -> Vector, Length
vector_2pt_10 = Vector2Pt(PointA=list_item_31.Item2, PointB=list_item_31.Item1, Unitize=False)  # -> Vector, Length
vector_2pt_11 = Vector2Pt(PointA=list_item_32.Item, PointB=list_item_32.Item1, Unitize=False)  # -> Vector, Length
vector_2pt_12 = Vector2Pt(PointA=list_item_32.Item2, PointB=list_item_32.Item1, Unitize=False)  # -> Vector, Length
angle_5 = Angle(VectorA=vector_2pt_9.Vector, VectorB=vector_2pt_10.Vector)  # -> Angle, Reflex
angle_6 = Angle(VectorA=vector_2pt_11.Vector, VectorB=vector_2pt_12.Vector)  # -> Angle, Reflex
degrees_5 = Degrees(Radians=angle_5.Angle)
degrees_6 = Degrees(Radians=angle_6.Angle)
right_肘关节夹角 = Panel(degrees_6)
left_肘关节夹角 = Panel(degrees_5)

# ---- group: 躯干-大腿夹角
panel_37 = Panel("""4
18
19""")
panel_38 = Panel("""11
22
23""")
list_item_33 = ListItem(List=partition_list_2, Index=panel_37, Wrap=True)
list_item_34 = ListItem(List=partition_list_2, Index=panel_38, Wrap=True)
list_item_35 = ListItem(List=list_item_34, Index=0, Wrap=True)  # -> Item, Item1, Item2
list_item_36 = ListItem(List=list_item_33, Index=0, Wrap=True)  # -> Item, Item1, Item2
vector_2pt_13 = Vector2Pt(PointA=list_item_35.Item, PointB=list_item_35.Item1, Unitize=False)  # -> Vector, Length
vector_2pt_14 = Vector2Pt(PointA=list_item_35.Item2, PointB=list_item_35.Item1, Unitize=False)  # -> Vector, Length
vector_2pt_15 = Vector2Pt(PointA=list_item_36.Item, PointB=list_item_36.Item1, Unitize=False)  # -> Vector, Length
vector_2pt_16 = Vector2Pt(PointA=list_item_36.Item2, PointB=list_item_36.Item1, Unitize=False)  # -> Vector, Length
angle_7 = Angle(VectorA=vector_2pt_13.Vector, VectorB=vector_2pt_14.Vector)  # -> Angle, Reflex
angle_8 = Angle(VectorA=vector_2pt_15.Vector, VectorB=vector_2pt_16.Vector)  # -> Angle, Reflex
degrees_7 = Degrees(Radians=angle_7.Angle)
degrees_8 = Degrees(Radians=angle_8.Angle)
right_躯干_大腿夹角 = Panel(degrees_8)
left_躯干_大腿夹角 = Panel(degrees_7)

# ---- group: 脊柱前倾角
panel_39 = Panel("""2
1
0""")  # disabled
list_item_37 = ListItem(List=partition_list_2, Index=panel_39, Wrap=True)  # disabled
polyline_3 = PolyLine(Vertices=list_item_37, Closed=False)  # disabled
list_item_38 = ListItem(List=list_item_37, Index=0, Wrap=True)  # -> Item, Item1, Item2; disabled
vector_2pt_17 = Vector2Pt(PointA=list_item_38.Item, PointB=list_item_38.Item1, Unitize=False)  # -> Vector, Length; disabled
vector_2pt_18 = Vector2Pt(PointA=list_item_38.Item2, PointB=list_item_38.Item1, Unitize=False)  # -> Vector, Length; disabled
angle_9 = Angle(VectorA=vector_2pt_17.Vector, VectorB=vector_2pt_18.Vector)  # -> Angle, Reflex; disabled
degrees_9 = Degrees(Radians=angle_9.Angle)  # disabled
脊柱前倾角 = Panel(degrees_9)  # disabled

# ---- group: 肘关节夹角
polyline_4 = PolyLine(Vertices=list_item_21, Closed=False)
polyline_5 = PolyLine(Vertices=list_item_22, Closed=False)

polyline_6 = PolyLine(Vertices=list_item_29, Closed=False)
polyline_7 = PolyLine(Vertices=list_item_30, Closed=False)

# ---- group: 躯干-大腿夹角
polyline_8 = PolyLine(Vertices=list_item_34, Closed=False)
polyline_9 = PolyLine(Vertices=list_item_33, Closed=False)

# ---- group: 肩部夹角
polyline_10 = PolyLine(Vertices=list_item_25, Closed=False)
polyline_11 = PolyLine(Vertices=list_item_26, Closed=False)

# ----
distance_2 = Distance(PointA=list_item_20, PointB=面部中心点_问题_不分前后.Centroid)
distance_3 = Distance(PointA=list_item_20, PointB=area.Centroid)
merge_5 = Merge(Data1=distance_2, Data2=distance_3)
sort_list = SortList(Keys=merge_5)  # -> Keys, ValuesValuesA
list_item_39 = ListItem(List=sort_list.Keys, Index="0", Wrap=True)
member_index_3 = MemberIndex(Set=merge_5, Member=list_item_39)  # -> Index, Count
division = Division(A=脊柱前倾角, B=180)  # disabled
addition = Addition(A=right_膝关节夹角, B=left_膝关节夹角)
division_2 = Division(A=addition, B=2)
addition_2 = Addition(A=right_躯干_大腿夹角, B=left_躯干_大腿夹角)
division_3 = Division(A=addition_2, B=2)
addition_3 = Addition(A=right_肘关节夹角, B=left_肘关节夹角)
list_item_40 = ListItem(List=merge_3, Index=member_index_3.Index, Wrap=True)
line_3 = Line(StartPoint=construct_point_4, EndPoint=list_item_40)  # -> flatten(Line)
list_item_41 = ListItem(List=line_3, Index=0, Wrap=True)  # -> Item, Item1
vector_display_4 = VectorDisplay(Anchor=persons_position_2, Vector=list_item_41.Item)
angle_10 = Angle(VectorA=line, VectorB=list_item_41.Item)  # -> Angle, Reflex
angle_11 = Angle(VectorA=line_2, VectorB=list_item_41.Item1)  # -> Angle, Reflex
angle_12 = Angle(VectorA=list_item_41.Item, VectorB=list_item_41.Item1)  # -> Angle, Reflex
addition_4 = Addition(A=right_肩部关节夹角, B=left_肩部关节夹角)
subtraction_4 = Subtraction(A=division_2, B=90)
absolute = Absolute(Value=subtraction_4)
subtraction_5 = Subtraction(A=division_3, B=90)
absolute_2 = Absolute(Value=subtraction_5)
degrees_10 = Degrees(Radians=angle_10.Angle)
degrees_11 = Degrees(Radians=angle_12.Angle)
degrees_12 = Degrees(Radians=angle_11.Angle)
division_4 = Division(A=addition_3, B=panel_15)
脊柱夹角_归一化 = Panel(division)  # disabled
division_5 = Division(A=addition_4, B=panel_15)
division_6 = Division(A=absolute, B=90)
division_7 = Division(A=absolute_2, B=90)
panel_40 = Panel(list_item_40)
夹角1 = Panel(degrees_10)
夹角2 = Panel(degrees_12)
夹角 = Panel(degrees_11)
肘关节夹角均值_归一化 = Panel(division_4)
膝关节夹角与90度差_归一化 = Panel(division_6)
大腿_躯干与90度差_归一化 = Panel(division_7)
肩部关节夹角_归一化 = Panel(division_5)
smaller_than_2 = SmallerThan(FirstNumber=夹角2, SecondNumber="30")  # -> SmallerThan, OrEqualTo
smaller_than_3 = SmallerThan(FirstNumber=夹角1, SecondNumber="30")  # -> SmallerThan, OrEqualTo
addition_5 = Addition(A=division_6, B=division_7)
division_8 = Division(A=addition_5, B=2)
addition_6 = Addition(A=肩部关节夹角_归一化, B=肘关节夹角均值_归一化)
division_9 = Division(A=addition_6, B=2)
gate_and = GateAnd(A=smaller_than_3.OrEqualTo, B=smaller_than_2.OrEqualTo)
是否交互 = Panel(gate_and)
灵活度_归一化 = Panel(division_8)
思考强度_归一化 = Panel(division_9)
gate_not = GateNot(A=是否交互)
data_recorder_3 = DataRecorder(灵活度_归一化, DataLimit=-10, RecordData=True)
data_recorder_4 = DataRecorder(思考强度_归一化, DataLimit=-10, RecordData=True)
panel_41 = Panel(data_recorder_3)
partition_list_3 = PartitionList(List=panel_41, Size=Slider(25, range=0..100))
partition_list_4 = PartitionList(List=data_recorder_4, Size=Slider(25, range=0..100))
number_2 = Number(partition_list_3)
average_2 = Average(Input=number_2)
number_3 = Number(partition_list_4)
average_3 = Average(Input=number_3)
list_item_42 = ListItem(List=average_2, Index="-2", Wrap=True)
list_item_43 = ListItem(List=average_3, Index="-2", Wrap=True)
panel_42 = Panel(list_item_42)
panel_43 = Panel(list_item_43)
# 如果要连间隔输入 连gh python后面
ghpython_script_4 = GhPythonScript(x=panel_42)  # -> out, a; same code as ghpython_script

# ---- group: 分隔输入
速度_2 = Slider(16, range=0..20)
trigger_6 = Trigger(Interval=20, TimerInterval=20, Target=counter_3)  # disabled
dom_3 = ConstructDomain(DomainStart="0", DomainEnd=速度_2)
python_6 = GhPythonScript(x=ghpython_script_4.a)  # -> out, a
# ---------- python_6: Python ----------
__author__ = "lmh"
__version__ = "2024.06.20"

import rhinoscriptsyntax as rs
if 0 <= x <= 0.9:
    a = 0
if 0.9 < x <= 0.92:
    a = 0.25
if 0.92 < x <= 0.95:
    a = 0.5
if 0.95 < x <= 0.98:
    a = 0.75
if 0.98 < x <= 1:
    a = 1
# ---------- end python_6 ----------
rec_3 = DataRecorder(flatten(python_6.a), DataLimit=-10, RecordData=True)
item_6 = ListItem(List=rec_3, Index="-1", Wrap=True)
item_7 = ListItem(List=rec_3, Index="-2", Wrap=True)
dcon_2 = DeleteConsecutive(Set=rec_3, Wrap=False)  # -> Set, Count
subtraction_6 = Subtraction(A=item_6, B=item_7)
python_7 = GhPythonScript(x=subtraction_6)  # -> out, a; same code as python_3
counter_3 = Counter(CountDirection=True, Step=1, StartStop=Toggle(True), Reset=python_7.a, OptionalCounterDomain=Domain(0, 100))
remap_3 = RemapNumbers(Value=counter_3, Source="0 to 100", Target=dom_3)  # -> Mapped, Clipped
python_8 = GhPythonScript(x=remap_3.Mapped)  # -> out, a; same code as python_4
item_8 = ListItem(List=dcon_2.Set, Index="-1", Wrap=True)
item_9 = ListItem(List=dcon_2.Set, Index="-2", Wrap=True)
dom_4 = ConstructDomain(DomainStart=item_9, DomainEnd=item_8)
remap_4 = RemapNumbers(Value=python_8.a, Source=Domain(0, 1), Target=dom_4)  # -> Mapped, Clipped

# ----
panel_44 = Panel(ghpython_script_4.a)
panel_45 = Panel(remap_4.Mapped)
# 颜色间隔在后面
ghpython_script_5 = GhPythonScript(x=panel_43)  # -> out, a
# ---------- ghpython_script_5: Python ----------
__author__ = "lmh"
__version__ = "2024.06.21"

import rhinoscriptsyntax as rs
if x or x == 0:
    a = x
else:
    a = 1
# ---------- end ghpython_script_5 ----------

速度_3 = Slider(8, range=0..20)
trigger_7 = Trigger(Interval=20, TimerInterval=20, Target=counter_4)  # disabled
dom_5 = ConstructDomain(DomainStart="0", DomainEnd=速度_3)
python_9 = GhPythonScript(x=ghpython_script_5.a)  # -> out, a
# ---------- python_9: Python ----------
__author__ = "lmh"
__version__ = "2024.06.20"

import rhinoscriptsyntax as rs
if 0 <= x <= 0.3:
    a = 0
if 0.3 < x <= 0.4:
    a = 0.25
if 0.4 < x <= 0.5:
    a = 0.5
if 0.5 < x <= 0.6:
    a = 0.75
if 0.6 < x <= 1:
    a = 1
# ---------- end python_9 ----------
rec_4 = DataRecorder(python_9.a, DataLimit=-10, RecordData=True)
item_10 = ListItem(List=rec_4, Index="-1", Wrap=True)
item_11 = ListItem(List=rec_4, Index="-2", Wrap=True)
dcon_3 = DeleteConsecutive(Set=rec_4, Wrap=False)  # -> Set, Count
subtraction_7 = Subtraction(A=item_10, B=item_11)
python_10 = GhPythonScript(x=subtraction_7)  # -> out, a; same code as python_3
counter_4 = Counter(CountDirection=True, Step=1, StartStop=Toggle(True), Reset=python_10.a, OptionalCounterDomain=Domain(0, 100))
remap_5 = RemapNumbers(Value=counter_4, Source="0 to 100", Target=dom_5)  # -> Mapped, Clipped
python_11 = GhPythonScript(x=remap_5.Mapped)  # -> out, a; same code as python_4
item_12 = ListItem(List=dcon_3.Set, Index="-1", Wrap=True)
item_13 = ListItem(List=dcon_3.Set, Index="-2", Wrap=True)
dom_6 = ConstructDomain(DomainStart=item_13, DomainEnd=item_12)
remap_6 = RemapNumbers(Value=python_11.a, Source=Domain(0, 1), Target=dom_6)  # -> Mapped, Clipped
panel_46 = Panel(remap_6.Mapped)

panel_47 = Panel(ghpython_script_5.a)
expression_3 = Expression(x=remap_6.Mapped, Expression="1-x")
expression_4 = Expression(x=remap_6.Mapped, Expression="1-x")
expression_5 = Expression(x=remap_6.Mapped, Expression="1-x")
eval_21 = EvaluateCurve(Curve=reparameterize(flip_3.Curve), Parameter=remap_6.Mapped)  # -> Point, Tangent, Angle
eval_22 = EvaluateCurve(Curve=reparameterize(crv_2), Parameter=expression_3)  # -> Point, Tangent, Angle
eval_23 = EvaluateCurve(Curve=reparameterize(flip_2.Curve), Parameter=remap_6.Mapped)  # -> Point, Tangent, Angle
eval_24 = EvaluateCurve(Curve=reparameterize(flip_4.Curve), Parameter=remap_6.Mapped)  # -> Point, Tangent, Angle
eval_25 = EvaluateCurve(Curve=reparameterize(flip_7.Curve), Parameter=remap_6.Mapped)  # -> Point, Tangent, Angle
eval_26 = EvaluateCurve(Curve=reparameterize(crv), Parameter=remap_6.Mapped)  # -> Point, Tangent, Angle
eval_27 = EvaluateCurve(Curve=reparameterize(flip.Curve), Parameter=remap_6.Mapped)  # -> Point, Tangent, Angle
eval_28 = EvaluateCurve(Curve=reparameterize(crv_17), Parameter=expression_4)  # -> Point, Tangent, Angle
eval_29 = EvaluateCurve(Curve=reparameterize(crv_16), Parameter=expression_4)  # -> Point, Tangent, Angle
eval_30 = EvaluateCurve(Curve=reparameterize(flip_8.Curve), Parameter=remap_6.Mapped)  # -> Point, Tangent, Angle
eval_31 = EvaluateCurve(Curve=reparameterize(crv_13), Parameter=expression_5)  # -> Point, Tangent, Angle
eval_32 = EvaluateCurve(Curve=reparameterize(flip_10.Curve), Parameter=remap_6.Mapped)  # -> Point, Tangent, Angle
eval_33 = EvaluateCurve(Curve=reparameterize(flip_9.Curve), Parameter=remap_6.Mapped)  # -> Point, Tangent, Angle
eval_34 = EvaluateCurve(Curve=reparameterize(flip_11.Curve), Parameter=remap_6.Mapped)  # -> Point, Tangent, Angle
ln = Line(StartPoint=eval_21.Point, EndPoint=eval_23.Point)
amp = Amplitude(Vector=ln, Amplitude=number_slider_11)
ln_2 = Line(StartPoint=eval_23.Point, EndPoint=pt_3)
amp_2 = Amplitude(Vector=ln_2, Amplitude=number_slider_11)
move_5 = Move(Geometry=pt_2, Motion=amp)  # -> Geometry, Transform
move_6 = Move(Geometry=eval_23.Point, Motion=amp_2)  # -> Geometry, Transform
move_7 = Move(Geometry=pt_3, Motion=amp_2)  # -> Geometry, Transform
move_8 = Move(Geometry=eval_21.Point, Motion=amp)  # -> Geometry, Transform
move_9 = Move(Geometry=eval_23.Point, Motion=expr("-x", amp))  # -> Geometry, Transform
move_10 = Move(Geometry=move_5.Geometry, Motion=amp)  # -> Geometry, Transform
move_11 = Move(Geometry=move_6.Geometry, Motion=amp_2)  # -> Geometry, Transform
move_12 = Move(Geometry=pt_3, Motion=expr("-x", amp_2))  # -> Geometry, Transform
ln_3 = Line(StartPoint=eval_29.Point, EndPoint=eval_28.Point)
amp_3 = Amplitude(Vector=ln_3, Amplitude=number_slider_15)
move_13 = Move(Geometry=eval_29.Point, Motion=amp_3)  # -> Geometry, Transform
move_14 = Move(Geometry=eval_28.Point, Motion=expr("-x", amp_3))  # -> Geometry, Transform
ln_4 = Line(StartPoint=eval_28.Point, EndPoint=pt_5)
amp_4 = Amplitude(Vector=ln_4, Amplitude=number_slider_15)
move_15 = Move(Geometry=pt_5, Motion=amp_4)  # -> Geometry, Transform
move_16 = Move(Geometry=eval_28.Point, Motion=amp_4)  # -> Geometry, Transform
move_17 = Move(Geometry=pt_4, Motion=amp_3)  # -> Geometry, Transform
move_18 = Move(Geometry=pt_5, Motion=expr("-x", amp_4))  # -> Geometry, Transform
move_19 = Move(Geometry=move_17.Geometry, Motion=amp_3)  # -> Geometry, Transform
move_20 = Move(Geometry=move_16.Geometry, Motion=amp_4)  # -> Geometry, Transform

# ---- group: people count
list_length = ListLength(List=flatten(list_item_2.Item))
people_count = Panel(list_length)
panel_48 = Panel("2")
larger_than = LargerThan(FirstNumber=people_count, SecondNumber="3")  # -> LargerThan, OrEqualTo
smaller_than_4 = SmallerThan(FirstNumber=people_count, SecondNumber="1")  # -> SmallerThan, OrEqualTo

# ----
equality = Equality(FirstNumber=people_count, SecondNumber=panel_48)  # -> Equality, Inequality
gate_not_2 = GateNot(A=larger_than.OrEqualTo)
gate_not_3 = GateNot(A=smaller_than_4.OrEqualTo)

# ---- group: people count (continued)
是否需要分隔 = Panel(gate_not_2)
是否需要分隔_2 = Panel(gate_not_3)

# ----
是否是两个人 = Panel(equality.Equality)
gate_and_2 = GateAnd(A=是否是两个人, B=是否位于分隔两边)
gate_and_3 = GateAnd(A=gate_and_2, B=gate_not)
是否需要分隔_3 = Panel(gate_and_3)
ghpython_script_6 = GhPythonScript(x=people_count, y1=是否需要分隔_2, y2=是否需要分隔_3, y3=是否需要分隔)  # -> out, a; inputs x: Int32, y1: Boolean, y2: Boolean, y3: Boolean
# ---------- ghpython_script_6: Python ----------
__author__ = "YANGRUYI"
__version__ = "2024.06.24"

import rhinoscriptsyntax as rs

if x <= 1:
    a = y1
elif x == 2:
    a = y2
else: 
    a = y3
# ---------- end ghpython_script_6 ----------
panel_49 = Panel(people_count)
panel_50 = Panel(ghpython_script_6.a)
panel_51 = Panel(panel_50)

# ---- group: 头手距离
panel_52 = Panel("7")  # disabled
panel_53 = Panel("27")  # disabled
panel_54 = Panel("14")  # disabled
list_item_44 = ListItem(List=partition_list_2, Index=panel_52, Wrap=True)  # disabled
list_item_45 = ListItem(List=partition_list_2, Index=panel_53, Wrap=partition_list_2)  # disabled
list_item_46 = ListItem(List=partition_list_2, Index=panel_54, Wrap=True)  # disabled

# ----
line_4 = Line(StartPoint=list_item_46, EndPoint=list_item_45)  # disabled
line_5 = Line(StartPoint=list_item_45, EndPoint=list_item_44)  # disabled

# ---- group: 头手距离 (continued)
length = Length(Curve=line_5)  # disabled
length_2 = Length(Curve=line_4)  # disabled
right_头手距离 = Panel(length)  # disabled
left_头手距离 = Panel(length_2)  # disabled

# ---- group: 转
srf = Surface(<surface referenced from the Rhino model>)
pln = Plane(srf)
xy_2 = XYPlane(Origin=Point(0, 0, 0))
deplane = DeconstructPlane(Plane=xy_2)  # -> Origin, XAxis, YAxis, ZAxis
scale = Scale(Geometry=persons_position, Center=deplane.Origin, Factor=Slider(1.227, range=0..10))  # -> Geometry, Transform

# ----
flip_plane = FlipPlane(Plane=pln, ReverseX=False, ReverseY=False, SwapAxes=True)
deplane_2 = DeconstructPlane(Plane=flip_plane)  # -> Origin, XAxis, YAxis, ZAxis
vec_3 = Vector(deplane_2.ZAxis)
line_sdl = LineSDL(Start=deplane_2.Origin, Direction=vec_3, Length=Slider(1, range=0..1))
rotate_axis = RotateAxis(Geometry=flip_plane, Angle=degrees(Slider(90, range=0..100)), Axis=line_sdl)  # -> Geometry, Transform

# ---- group: 转 (continued)
deplane_3 = DeconstructPlane(Plane=flip_plane)  # -> Origin, XAxis, YAxis, ZAxis
pt_6 = Point(flip_plane)
vec_4 = Vector(deplane_3.XAxis)
vdis = VectorDisplay(Anchor=pt_6, Vector=vec_3)
orient_2 = Orient(Geometry=scale.Geometry, Source=xy_2, Target=rotate_axis.Geometry)  # -> graft(Geometry), Transform

# ----
explode_tree = ExplodeTree(Data=orient_2.Geometry)  # -> Branch0, Branch1, Branch2
panel_55 = Panel(explode_tree.Branch0)
cp_2 = PlaneClosestPoint(Point=explode_tree.Branch1, Plane=xy)  # -> Point, UVPoint, Distance
points = PointList(Points=flatten([cp.Point, cp_2.Point]), Size=Slider(0.526, range=0..1))

# ---- group: 高度宽度
ln_5 = Line(StartPoint=eval_15.Point, EndPoint=eval_13.Point)
amp_5 = Amplitude(Vector=ln_5, Amplitude=Slider(0.17, range=0..1))
dom_7 = ConstructDomain(DomainStart="0", DomainEnd=高度缩小阈值)
dom_8 = ConstructDomain(DomainStart="0", DomainEnd=宽度缩小阈值)
merge_6 = Merge(
    Data1=eval_15.Point,
    Data2=eval_13.Point,
    Data3=eval_14.Point,
    Data4=eval.Point,
    Data5=eval_11.Point,
    Data6=eval_2.Point,
    Data7=eval_10.Point,
    Data8=eval_7.Point,
    Data9=eval_9.Point)
remap_7 = RemapNumbers(Value=remap_4.Mapped, Source=Domain(0, 1), Target=dom_7)  # -> Mapped, Clipped
remap_8 = RemapNumbers(Value=remap_2.Mapped, Source=Domain(0, 1), Target=dom_7)  # -> Mapped, Clipped
crv_23 = Curve(<curve referenced from the Rhino model>)
remap_9 = RemapNumbers(Value=ghpython_script.a, Source=Domain(0, 1), Target=dom_8)  # -> Mapped, Clipped
remap_10 = RemapNumbers(Value=ghpython_script_2.a, Source=Domain(0, 1), Target=dom_8)  # -> Mapped, Clipped
panel_56 = Panel("""0
1
2
3
4
5
6
7
8""")
toggle = BooleanToggle(True)
incurve = PointInCurve(Point=cp.Point, Curve=crv_23)  # -> Relationship, Point
trigger_8 = Trigger(
    Interval=50,
    TimerInterval=50,
    Target=[counter_5, counter_6, counter_7, counter_8, counter_9, counter_12, counter_10, counter_11, counter_13])  # disabled
merge_7 = Merge(Data1="1", Data2="1", Data3="1", Data4="1", Data5="1", Data6="2", Data7="2", Data8="2", Data9="2")
python_12 = GhPythonScript(x=incurve.Relationship, y=merge_7)  # -> out, a
# ---------- python_12: Python ----------
__author__ = "lmh"
__version__ = "2024.06.17"

import rhinoscriptsyntax as rs
if x == 1 or x == 2:
    a = y
else:
    a = 0
# ---------- end python_12 ----------
panel_57 = Panel("""0
0
0
0
0
0
0
0
0""")
速度_4 = Slider(18, range=0..20)
trigger_9 = Trigger(Interval=200, TimerInterval=200, Target=rec_5)  # disabled
dom_9 = ConstructDomain(DomainStart="0", DomainEnd=速度_4)

# ----
move_21 = Move(Geometry=merge_6, Motion=amp_5)  # -> Geometry, Transform

# ---- group: 高度宽度 (continued)
dist = Distance(PointA=move_21.Geometry, PointB=cp.Point)
sort = SortList(Keys=dist)  # -> Keys, ValuesA
item_14 = ListItem(List=sort.Keys, Index=panel_56, Wrap=True)
mindex = MemberIndex(Set=dist, Member=item_14)  # -> flatten(Index), Count
replace = ReplaceItems(List=panel_57, Item=python_12.a, Indices=mindex.Index, Wrap=False)
graft = GraftTree(Tree=replace, IncludeEmptyLists=True, IncludeNullItems=True)
rec_5 = DataRecorder(graft, DataLimit=-10, RecordData=True)
item_15 = ListItem(List=rec_5, Index="-2", Wrap=True)  # -> flatten(Item)
item_16 = ListItem(List=rec_5, Index="-1", Wrap=True)  # -> flatten(Item)
subtraction_8 = Subtraction(A=item_16, B=item_15)
python_13 = GhPythonScript(x=subtraction_8)  # -> out, a
# ---------- python_13: Python ----------
__author__ = "lmh"
__version__ = "2024.06.10"

import rhinoscriptsyntax as rs
if x == 0:
    a = 0
else:
    a = 1
# ---------- end python_13 ----------
item_17 = ListItem(List=python_13.a, Index=0, Wrap=True)  # -> Item, Item1, Item2, Item3, Item4, Item5, Item6, Item7, Item8
counter_5 = Counter(CountDirection=True, Step=1, StartStop=toggle, Reset=item_17.Item, OptionalCounterDomain=Domain(0, 100))
counter_6 = Counter(CountDirection=True, Step=1, StartStop=toggle, Reset=item_17.Item1, OptionalCounterDomain=Domain(0, 100))
counter_7 = Counter(CountDirection=True, Step=1, StartStop=toggle, Reset=item_17.Item2, OptionalCounterDomain=Domain(0, 100))
counter_8 = Counter(CountDirection=True, Step=1, StartStop=toggle, Reset=item_17.Item3, OptionalCounterDomain=Domain(0, 100))
counter_9 = Counter(CountDirection=True, Step=1, StartStop=toggle, Reset=item_17.Item4, OptionalCounterDomain=Domain(0, 100))
counter_10 = Counter(CountDirection=True, Step=1, StartStop=toggle, Reset=item_17.Item6, OptionalCounterDomain=Domain(0, 100))
counter_11 = Counter(CountDirection=True, Step=1, StartStop=toggle, Reset=item_17.Item7, OptionalCounterDomain=Domain(0, 100))
counter_12 = Counter(CountDirection=True, Step=1, StartStop=toggle, Reset=item_17.Item5, OptionalCounterDomain=Domain(0, 100))
counter_13 = Counter(CountDirection=True, Step=1, StartStop=toggle, Reset=item_17.Item8, OptionalCounterDomain=Domain(0, 100))
merge_8 = Merge(
    Data1=counter_5,
    Data2=counter_6,
    Data3=counter_7,
    Data4=counter_8,
    Data5=counter_9,
    Data6=counter_12,
    Data7=counter_10,
    Data8=counter_11,
    Data9=counter_13)
dcon_4 = DeleteConsecutive(Set=rec_5, Wrap=False)  # -> Set, Count
item_18 = ListItem(List=dcon_4.Set, Index="-1", Wrap=True)
item_19 = ListItem(List=dcon_4.Set, Index="-2", Wrap=True)
remap_11 = RemapNumbers(Value=merge_8, Source="0 to 100", Target=dom_9)  # -> Mapped, Clipped
python_14 = GhPythonScript(x=item_19, y=remap_9.Mapped, z=remap_10.Mapped)  # -> out, a; inputs x: Int32
# ---------- python_14: Python ----------
__author__ = "lmh"
__version__ = "2024.06.15"

import rhinoscriptsyntax as rs
if x == 1:
    a = y
if x == 2:
    a = z
if x == 0:
    a = 0
# ---------- end python_14 ----------
python_15 = GhPythonScript(x=remap_11.Mapped)  # -> out, a; same code as python_4
python_16 = GhPythonScript(x=item_18, y=remap_9.Mapped, z=remap_10.Mapped)  # -> out, a; inputs x: Int32; same code as python_14
dom_10 = ConstructDomain(DomainStart=python_14.a, DomainEnd=python_16.a)  # -> flatten(Domain)
remap_12 = RemapNumbers(Value=python_15.a, Source=Domain(0, 1), Target=dom_10)  # -> Mapped, Clipped
multiplication = Multiplication(A=remap_12.Mapped, B=item_5)
multiplication_2 = Multiplication(A=remap_12.Mapped, B=expression)
python_17 = GhPythonScript(x=item_19, y=remap_7.Mapped, z=remap_8.Mapped)  # -> out, a; inputs x: Int32; same code as python_14
item_20 = ListItem(List=multiplication, Index=0, Wrap=True)  # -> Item, Item1, Item2, Item3, Item4, Item5, Item6, Item7, Item8
item_21 = ListItem(List=multiplication_2, Index=0, Wrap=True)  # -> Item, Item1, Item2, Item3, Item4, Item5, Item6, Item7, Item8
python_18 = GhPythonScript(x=item_18, y=remap_7.Mapped, z=remap_8.Mapped)  # -> out, a; inputs x: Int32; same code as python_14
dom_11 = ConstructDomain(DomainStart=python_17.a, DomainEnd=python_18.a)  # -> flatten(Domain)
remap_13 = RemapNumbers(Value=python_15.a, Source=Domain(0, 1), Target=dom_11)  # -> Mapped, Clipped
item_22 = ListItem(List=remap_13.Mapped, Index=0, Wrap=True)  # -> Item, Item1, Item2, Item3, Item4, Item5, Item6, Item7, Item8

# ----
amp_6 = Amplitude(Vector=vec, Amplitude=item_20.Item6)
amp_7 = Amplitude(Vector=vec_2, Amplitude=item_20.Item7)
amp_8 = Amplitude(Vector=vec, Amplitude=item_20.Item8)
Z = UnitZ(Factor=item_22.Item7)  # -> expr("-x", UnitVector)
amp_9 = Amplitude(Vector=vec, Amplitude=item_20.Item4)
Z_2 = UnitZ(Factor=item_22.Item6)  # -> expr("-x", UnitVector)
Z_3 = UnitZ(Factor=item_22.Item4)  # -> expr("-x", UnitVector)
move_22 = Move(Geometry=eval_8.Point, Motion=amp_7)  # -> Geometry, Transform
Z_4 = UnitZ(Factor=item_22.Item5)  # -> expr("-x", UnitVector)
amp_10 = Amplitude(Vector=vec_2, Amplitude=item_20.Item3)
amp_11 = Amplitude(Vector=vec_2, Amplitude=item_20.Item1)
move_23 = Move(Geometry=eval_22.Point, Motion=amp_6)  # -> Geometry, Transform
move_24 = Move(Geometry=eval_24.Point, Motion=amp_9)  # -> Geometry, Transform
move_25 = Move(Geometry=eval.Point, Motion=amp_10)  # -> Geometry, Transform
Z_5 = UnitZ(Factor=item_22.Item8)  # -> expr("-x", UnitVector)
Z_6 = UnitZ(Factor=item_22.Item3)  # -> expr("-x", UnitVector)
move_26 = Move(Geometry=move_22.Geometry, Motion=Z)  # -> Geometry, Transform
move_27 = Move(Geometry=eval_27.Point, Motion=amp_8)  # -> Geometry, Transform
amp_12 = Amplitude(Vector=vec_2, Amplitude=item_20.Item5)
amp_13 = Amplitude(Vector=vec, Amplitude=item_20.Item2)
Z_7 = UnitZ(Factor=item_22.Item)  # -> expr("-x", UnitVector)
move_28 = Move(Geometry=eval_25.Point, Motion=amp_13)  # -> Geometry, Transform
move_29 = Move(Geometry=eval_12.Point, Motion=amp_11)  # -> Geometry, Transform
move_30 = Move(Geometry=eval_3.Point, Motion=amp_12)  # -> Geometry, Transform
move_31 = Move(Geometry=move_26.Geometry, Motion=expr("-x", vec2pt.Vector))  # -> Geometry, Transform
move_32 = Move(Geometry=move_27.Geometry, Motion=Z_5)  # -> Geometry, Transform
Z_8 = UnitZ(Factor=item_22.Item1)  # -> expr("-x", UnitVector)
move_33 = Move(Geometry=move_29.Geometry, Motion=Z_8)  # -> Geometry, Transform
amp_14 = Amplitude(Vector=vec, Amplitude=item_21.Item4)  # -> expr("-x", Vector)
move_34 = Move(Geometry=move_25.Geometry, Motion=Z_6)  # -> Geometry, Transform
amp_15 = Amplitude(Vector=vec, Amplitude=item_20.Item)
move_35 = Move(Geometry=eval_32.Point, Motion=amp_14)  # -> Geometry, Transform
amp_16 = Amplitude(Vector=vec, Amplitude=item_21.Item6)  # -> expr("-x", Vector)
amp_17 = Amplitude(Vector=vec, Amplitude=item_21.Item8)  # -> expr("-x", Vector)
Z_9 = UnitZ(Factor=item_22.Item2)  # -> expr("-x", UnitVector)
amp_18 = Amplitude(Vector=flip_5.Curve, Amplitude=item_21.Item5)  # -> expr("-x", Vector)
move_36 = Move(Geometry=eval_34.Point, Motion=amp_17)  # -> Geometry, Transform
move_37 = Move(Geometry=eval_26.Point, Motion=amp_15)  # -> Geometry, Transform
move_38 = Move(Geometry=move_37.Geometry, Motion=Z_7)  # -> Geometry, Transform
move_39 = Move(Geometry=eval_19.Point, Motion=amp_18)  # -> Geometry, Transform
amp_19 = Amplitude(Vector=flip_5.Curve, Amplitude=item_21.Item3)  # -> expr("-x", Vector)
amp_20 = Amplitude(Vector=vec, Amplitude=item_21.Item2)  # -> expr("-x", Vector)
amp_21 = Amplitude(Vector=flip_5.Curve, Amplitude=item_21.Item7)  # -> expr("-x", Vector)
move_40 = Move(Geometry=eval_31.Point, Motion=amp_20)  # -> Geometry, Transform
move_41 = Move(Geometry=eval_33.Point, Motion=amp_16)  # -> Geometry, Transform
move_42 = Move(Geometry=eval_20.Point, Motion=amp_21)  # -> Geometry, Transform
amp_22 = Amplitude(Vector=flip_5.Curve, Amplitude=item_21.Item1)  # -> expr("-x", Vector)
move_43 = Move(Geometry=eval_16.Point, Motion=amp_19)  # -> Geometry, Transform
amp_23 = Amplitude(Vector=vec, Amplitude=item_21.Item)  # -> expr("-x", Vector)
move_44 = Move(Geometry=eval_17.Point, Motion=amp_22)  # -> Geometry, Transform
move_45 = Move(Geometry=move_32.Geometry, Motion=expr("-x", amp))  # -> Geometry, Transform
move_46 = Move(Geometry=eval_30.Point, Motion=amp_23)  # -> Geometry, Transform
Z_10 = UnitZ(Factor=item_22.Item)  # -> expr("-x", UnitVector)
move_47 = Move(Geometry=move_46.Geometry, Motion=Z_10)  # -> Geometry, Transform
Z_11 = UnitZ(Factor=item_22.Item1)  # -> expr("-x", UnitVector)
move_48 = Move(Geometry=move_44.Geometry, Motion=Z_11)  # -> Geometry, Transform
move_49 = Move(Geometry=move_48.Geometry, Motion=vec2pt_3.Vector)  # -> Geometry, Transform
Z_12 = UnitZ(Factor=item_22.Item2)  # -> expr("-x", UnitVector)
Z_13 = UnitZ(Factor=item_22.Item3)  # -> expr("-x", UnitVector)
Z_14 = UnitZ(Factor=item_22.Item5)  # -> expr("-x", UnitVector)
Z_15 = UnitZ(Factor=item_22.Item7)  # -> expr("-x", UnitVector)
Z_16 = UnitZ(Factor=item_22.Item8)  # -> expr("-x", UnitVector)
move_50 = Move(Geometry=move_39.Geometry, Motion=Z_14)  # -> Geometry, Transform
Z_17 = UnitZ(Factor=item_22.Item4)  # -> expr("-x", UnitVector)

# ---- group: 分隔
move_51 = Move(Geometry=move_30.Geometry, Motion=Z_4)  # -> Geometry, Transform
move_52 = Move(Geometry=move_43.Geometry, Motion=Z_13)  # -> Geometry, Transform
pt_7 = Point(move_9.Geometry)
pt_8 = Point(move_14.Geometry)
ln_6 = Line(StartPoint=move_51.Geometry, EndPoint=pt_7)
ln_7 = Line(StartPoint=move_52.Geometry, EndPoint=pt_8)
vec_5 = Vector(ln_6)
vec_6 = Vector(ln_7)
分隔离地面的高度 = Slider(0.3, range=0..1)
move_53 = Move(Geometry=move_24.Geometry, Motion=Z_3)  # -> Geometry, Transform
move_54 = Move(Geometry=move_35.Geometry, Motion=Z_17)  # -> Geometry, Transform
merge_9 = Merge(Data1=flatten(cp.Point), Data2=flatten(cp_2.Point))
pt_9 = Point(eval_28.Point)
pt_10 = Point(eval_23.Point)
merge_10 = Merge(Data1=crv_21, Data2=crv_22)
ln_8 = Line(StartPoint=move_54.Geometry, EndPoint=pt_9)
pt_11 = ConstructPoint(XCoordinate="0", YCoordinate="0", ZCoordinate=分隔离地面的高度)
incurves = PointInCurves(Point=merge_9, Curves=merge_10)  # -> Relationship, Index, Point
ln_9 = Line(StartPoint=pt_10, EndPoint=move_53.Geometry)
xy_3 = XYPlane(Origin=pt_11)
plx = LinePlane(Line=ln_6, Plane=xy_3)  # -> Point, ParamL, ParamP
plx_2 = LinePlane(Line=ln_7, Plane=xy_3)  # -> Point, ParamL, ParamP
dist_2 = Distance(PointA=move_51.Geometry, PointB=plx.Point)
dist_3 = Distance(PointA=move_52.Geometry, PointB=plx_2.Point)
pdecon = Deconstruct(Point=move_54.Geometry)  # -> XComponent, YComponent, ZComponent
vec_7 = Vector(ln_8)
item_23 = ListItem(List=incurves.Index, Index=0, Wrap=True)  # -> Item, Item1
trigger_10 = Trigger(Interval=20, TimerInterval=20, Target=counter_14)  # disabled
panel_58 = Panel(incurves.Relationship)
item_24 = ListItem(List=incurves.Relationship, Index=0, Wrap=True)  # -> Item, Item1
plx_3 = LinePlane(Line=ln_8, Plane=xy_3)  # -> Point, ParamL, ParamP
vec_8 = Vector(ln_9)
subtraction_9 = Subtraction(A=pdecon.ZComponent, B=分隔离地面的高度)
dist_4 = Distance(PointA=move_54.Geometry, PointB=plx_3.Point)
plx_4 = LinePlane(Line=ln_9, Plane=xy_3)  # -> Point, ParamL, ParamP
dist_5 = Distance(PointA=move_53.Geometry, PointB=plx_4.Point)
python_19 = GhPythonScript(x1=item_24.Item, x2=item_24.Item1, y1=item_23.Item, y2=item_23.Item1)  # -> out, a
# ---------- python_19: Python ----------
__author__ = "lmh"
__version__ = "2024.06.14"

import rhinoscriptsyntax as rs
if x1 == 2 and x2 == 2 and y1 != y2:
    a = 1
else:
    a = 0
# ---------- end python_19 ----------
速度_5 = Slider(18, range=0..20)
python_20 = GhPythonScript(separation=python_19.a, interaction=panel_50, z=people_count)  # -> out, a; inputs interaction: Boolean
# ---------- python_20: Python ----------
__author__ = "lmh"
__version__ = "2024.06.11"

import rhinoscriptsyntax as rs
if interaction and separation and z == 2:
    a = 1
else:
    a = 0
# ---------- end python_20 ----------
dom_12 = ConstructDomain(DomainStart="0", DomainEnd=速度_5)
rec_6 = DataRecorder(flatten(python_20.a), DataLimit=-10, RecordData=True)
dcon_5 = DeleteConsecutive(Set=rec_6, Wrap=False)  # -> Set, Count
item_25 = ListItem(List=rec_6, Index="-2", Wrap=True)  # -> flatten(Item)
item_26 = ListItem(List=rec_6, Index="-1", Wrap=True)  # -> flatten(Item)
subtraction_10 = Subtraction(A=item_26, B=item_25)
abs = Absolute(Value=subtraction_10)
counter_14 = Counter(CountDirection=True, Step=1, StartStop=Toggle(True), Reset=abs, OptionalCounterDomain=Domain(0, 100))
remap_14 = RemapNumbers(Value=counter_14, Source="0 to 100", Target=dom_12)  # -> Mapped, Clipped
python_21 = GhPythonScript(x=remap_14.Mapped)  # -> out, a; same code as python_4
item_27 = ListItem(List=dcon_5.Set, Index="-1", Wrap=True)  # -> flatten(Item)
item_28 = ListItem(List=dcon_5.Set, Index="-2", Wrap=True)  # -> flatten(Item)
dom_13 = ConstructDomain(DomainStart=item_28, DomainEnd=item_27)
remap_15 = RemapNumbers(Value=python_21.a, Source=Domain(0, 1), Target=dom_13)  # -> Mapped, Clipped
remap_16 = RemapNumbers(Value=remap_15.Mapped, Source=Domain(0, 1), Target=dist_2)  # -> Mapped, Clipped
amp_24 = Amplitude(Vector=vec_5, Amplitude=remap_16.Mapped)
remap_17 = RemapNumbers(Value=remap_15.Mapped, Source=Domain(0, 1), Target=dist_3)  # -> Mapped, Clipped
amp_25 = Amplitude(Vector=vec_6, Amplitude=remap_17.Mapped)
move_55 = Move(Geometry=move_52.Geometry, Motion=amp_25)  # -> Geometry, Transform
move_56 = Move(Geometry=move_51.Geometry, Motion=amp_24)  # -> Geometry, Transform
remap_18 = RemapNumbers(Value=remap_15.Mapped, Source=Domain(0, 1), Target=subtraction_9)  # -> Mapped, Clipped
remap_19 = RemapNumbers(Value=remap_15.Mapped, Source=Domain(0, 1), Target=dist_5)  # -> Mapped, Clipped
amp_26 = Amplitude(Vector=vec_8, Amplitude=remap_19.Mapped)
remap_20 = RemapNumbers(Value=remap_15.Mapped, Source=Domain(0, 1), Target=dist_4)  # -> Mapped, Clipped
amp_27 = Amplitude(Vector=vec_7, Amplitude=remap_20.Mapped)
move_57 = Move(Geometry=move_53.Geometry, Motion=expr("-x", amp_26))  # -> Geometry, Transform
move_58 = Move(Geometry=move_54.Geometry, Motion=amp_27)  # -> Geometry, Transform

# ----
panel_59 = Panel(python_20.a)
panel_60 = Panel(rec_6)
move_59 = Move(Geometry=move_56.Geometry, Motion=vec2pt.Vector)  # -> Geometry, Transform
move_60 = Move(Geometry=move_57.Geometry, Motion=vec2pt_2.Vector)  # -> Geometry, Transform
move_61 = Move(Geometry=move_57.Geometry, Motion=expr("-x", vec2pt_2.Vector))  # -> Geometry, Transform
move_62 = Move(Geometry=move_55.Geometry, Motion=vec2pt_3.Vector)  # -> Geometry, Transform
Z_18 = UnitZ(Factor=item_22.Item6)  # -> expr("-x", UnitVector)
move_63 = Move(Geometry=move_42.Geometry, Motion=Z_15)  # -> Geometry, Transform
move_64 = Move(Geometry=move_36.Geometry, Motion=Z_16)  # -> Geometry, Transform
move_65 = Move(Geometry=move_28.Geometry, Motion=Z_9)  # -> Geometry, Transform
move_66 = Move(Geometry=move_65.Geometry, Motion=vec2pt_2.Vector)  # -> Geometry, Transform
move_67 = Move(Geometry=move_40.Geometry, Motion=Z_12)  # -> Geometry, Transform
move_68 = Move(Geometry=move_23.Geometry, Motion=Z_2)  # -> Geometry, Transform
move_69 = Move(Geometry=move_41.Geometry, Motion=Z_18)  # -> Geometry, Transform
move_70 = Move(Geometry=move_69.Geometry, Motion=vec2pt_3.Vector)  # -> Geometry, Transform
move_71 = Move(Geometry=move_69.Geometry, Motion=expr("-x", vec2pt_3.Vector))  # -> Geometry, Transform

number_slider_21 = Slider(5, range=0..10)
number_slider_22 = Slider(1, range=0..10)
move_72 = Move(Geometry=move_47.Geometry, Motion=expr("-x", amp_3))  # -> Geometry, Transform
move_73 = Move(Geometry=move_47.Geometry, Motion=amp_3)  # -> Geometry, Transform
move_74 = Move(Geometry=move_65.Geometry, Motion=expr("-x", vec2pt_2.Vector))  # -> Geometry, Transform
move_75 = Move(Geometry=move_58.Geometry, Motion=amp_3)  # -> Geometry, Transform
move_76 = Move(Geometry=move_67.Geometry, Motion=amp_3)  # -> Geometry, Transform
move_77 = Move(Geometry=move_58.Geometry, Motion=expr("-x", amp_3))  # -> Geometry, Transform
move_78 = Move(Geometry=move_68.Geometry, Motion=amp)  # -> Geometry, Transform
move_79 = Move(Geometry=move_68.Geometry, Motion=expr("-x", amp))  # -> Geometry, Transform
move_80 = Move(Geometry=move_67.Geometry, Motion=expr("-x", amp_3))  # -> Geometry, Transform
move_81 = Move(Geometry=move_32.Geometry, Motion=amp)  # -> Geometry, Transform
srf4pt = _4PointSurface(CornerA=move_31.Geometry, CornerB=move_32.Geometry, CornerC=eval_21.Point, CornerD=move_8.Geometry)
srf4pt_2 = _4PointSurface(CornerA=pt_2, CornerB=move_8.Geometry, CornerC=move_31.Geometry, CornerD=move_26.Geometry)
srf4pt_3 = _4PointSurface(CornerA=move_68.Geometry, CornerB=move_26.Geometry, CornerC=pt_2, CornerD=move_5.Geometry)
srf4pt_4 = _4PointSurface(CornerA=move_68.Geometry, CornerB=move_56.Geometry, CornerC=move_10.Geometry, CornerD=move_5.Geometry)
srf4pt_5 = _4PointSurface(CornerA=move_9.Geometry, CornerB=move_10.Geometry, CornerC=move_56.Geometry, CornerD=move_59.Geometry)
srf4pt_6 = _4PointSurface(CornerA=move_57.Geometry, CornerB=move_59.Geometry, CornerC=move_9.Geometry, CornerD=eval_23.Point)
srf4pt_7 = _4PointSurface(CornerA=move_57.Geometry, CornerB=move_34.Geometry, CornerC=move_6.Geometry, CornerD=eval_23.Point)
srf4pt_8 = _4PointSurface(CornerA=move_65.Geometry, CornerB=move_34.Geometry, CornerC=move_6.Geometry, CornerD=move_11.Geometry)
srf4pt_9 = _4PointSurface(CornerA=move_11.Geometry, CornerB=move_12.Geometry, CornerC=move_66.Geometry, CornerD=move_65.Geometry)
srf4pt_10 = _4PointSurface(CornerA=move_66.Geometry, CornerB=move_33.Geometry, CornerC=pt_3, CornerD=move_12.Geometry)
srf4pt_11 = _4PointSurface(CornerA=move_38.Geometry, CornerB=move_33.Geometry, CornerC=pt_3, CornerD=move_7.Geometry)
srf4pt_12 = _4PointSurface(CornerA=move_64.Geometry, CornerB=move_63.Geometry, CornerC=pt_5, CornerD=move_15.Geometry)
srf4pt_13 = _4PointSurface(CornerA=move_67.Geometry, CornerB=move_55.Geometry, CornerC=move_19.Geometry, CornerD=move_17.Geometry)
srf4pt_14 = _4PointSurface(CornerA=move_14.Geometry, CornerB=move_19.Geometry, CornerC=move_55.Geometry, CornerD=move_62.Geometry)
srf4pt_15 = _4PointSurface(CornerA=move_58.Geometry, CornerB=move_50.Geometry, CornerC=move_16.Geometry, CornerD=eval_28.Point)
srf4pt_16 = _4PointSurface(CornerA=move_69.Geometry, CornerB=move_50.Geometry, CornerC=move_16.Geometry, CornerD=move_20.Geometry)
srf4pt_17 = _4PointSurface(CornerA=move_20.Geometry, CornerB=move_18.Geometry, CornerC=move_70.Geometry, CornerD=move_69.Geometry)
srf4pt_18 = _4PointSurface(CornerA=move_70.Geometry, CornerB=move_63.Geometry, CornerC=pt_5, CornerD=move_18.Geometry)
srf4pt_19 = _4PointSurface(CornerA=move_58.Geometry, CornerB=move_62.Geometry, CornerC=move_14.Geometry, CornerD=eval_28.Point)
srf4pt_20 = _4PointSurface(CornerA=move_48.Geometry, CornerB=move_47.Geometry, CornerC=eval_29.Point, CornerD=move_13.Geometry)
srf4pt_21 = _4PointSurface(CornerA=pt_4, CornerB=move_13.Geometry, CornerC=move_48.Geometry, CornerD=move_49.Geometry)
srf4pt_22 = _4PointSurface(CornerA=move_67.Geometry, CornerB=move_49.Geometry, CornerC=pt_4, CornerD=move_17.Geometry)
mesh_uv = MeshSurface(Surface=srf4pt_5, UCount=number_slider_17, VCount=number_slider_18, Overhang=True, Equalize=False)
mesh_uv_2 = MeshSurface(Surface=srf4pt_6, UCount=number_slider_17, VCount=number_slider_18, Overhang=True, Equalize=False)
srf4pt_23 = _4PointSurface(CornerA=move_73.Geometry, CornerB=move_49.Geometry, CornerC=move_65.Geometry, CornerD=move_66.Geometry)
srf4pt_24 = _4PointSurface(CornerA=move_74.Geometry, CornerB=move_65.Geometry, CornerC=move_49.Geometry, CornerD=move_80.Geometry)
srf4pt_25 = _4PointSurface(CornerA=move_80.Geometry, CornerB=move_67.Geometry, CornerC=move_34.Geometry, CornerD=move_74.Geometry)
srf4pt_26 = _4PointSurface(CornerA=move_76.Geometry, CornerB=move_67.Geometry, CornerC=move_34.Geometry, CornerD=move_60.Geometry)
srf4pt_27 = _4PointSurface(CornerA=move_60.Geometry, CornerB=move_57.Geometry, CornerC=move_55.Geometry, CornerD=move_76.Geometry)
srf4pt_28 = _4PointSurface(CornerA=move_57.Geometry, CornerB=move_61.Geometry, CornerC=move_77.Geometry, CornerD=move_55.Geometry)
srf4pt_29 = _4PointSurface(CornerA=move_58.Geometry, CornerB=move_77.Geometry, CornerC=move_61.Geometry, CornerD=move_56.Geometry)
srf4pt_30 = _4PointSurface(CornerA=move_75.Geometry, CornerB=move_58.Geometry, CornerC=move_56.Geometry, CornerD=move_78.Geometry)
srf4pt_31 = _4PointSurface(CornerA=move_79.Geometry, CornerB=move_68.Geometry, CornerC=move_50.Geometry, CornerD=move_71.Geometry)
srf4pt_32 = _4PointSurface(CornerA=move_71.Geometry, CornerB=move_69.Geometry, CornerC=move_26.Geometry, CornerD=move_79.Geometry)
srf4pt_33 = _4PointSurface(CornerA=move_26.Geometry, CornerB=move_81.Geometry, CornerC=move_70.Geometry, CornerD=move_69.Geometry)
srf4pt_34 = _4PointSurface(CornerA=move_70.Geometry, CornerB=move_63.Geometry, CornerC=move_32.Geometry, CornerD=move_81.Geometry)
srf4pt_35 = _4PointSurface(CornerA=move_78.Geometry, CornerB=move_68.Geometry, CornerC=move_50.Geometry, CornerD=move_75.Geometry)
srf4pt_36 = _4PointSurface(CornerA=move_47.Geometry, CornerB=move_72.Geometry, CornerC=move_38.Geometry, CornerD=move_33.Geometry)
srf4pt_37 = _4PointSurface(CornerA=move_73.Geometry, CornerB=move_47.Geometry, CornerC=move_33.Geometry, CornerD=move_66.Geometry)
mesh_uv_3 = MeshSurface(Surface=srf4pt, UCount=number_slider_17, VCount=number_slider_18, Overhang=True, Equalize=False)
mesh_uv_4 = MeshSurface(Surface=srf4pt_2, UCount=number_slider_17, VCount=number_slider_18, Overhang=True, Equalize=False)
mesh_uv_5 = MeshSurface(Surface=srf4pt_3, UCount=number_slider_17, VCount=number_slider_18, Overhang=True, Equalize=False)
mesh_uv_6 = MeshSurface(Surface=srf4pt_4, UCount=number_slider_17, VCount=number_slider_18, Overhang=True, Equalize=False)
mesh_uv_7 = MeshSurface(Surface=srf4pt_7, UCount=number_slider_17, VCount=number_slider_18, Overhang=True, Equalize=False)
mesh_uv_8 = MeshSurface(Surface=srf4pt_8, UCount=number_slider_17, VCount=number_slider_18, Overhang=True, Equalize=False)
mesh_uv_9 = MeshSurface(Surface=srf4pt_9, UCount=number_slider_19, VCount=number_slider_18, Overhang=True, Equalize=False)
mesh_uv_10 = MeshSurface(Surface=srf4pt_10, UCount=number_slider_17, VCount=number_slider_18, Overhang=True, Equalize=False)
mesh_uv_11 = MeshSurface(Surface=srf4pt_11, UCount=number_slider_17, VCount=number_slider_18, Overhang=True, Equalize=False)
mesh_uv_12 = MeshSurface(Surface=srf4pt_20, UCount=number_slider_17, VCount=number_slider_18, Overhang=True, Equalize=False)
mesh_uv_13 = MeshSurface(Surface=srf4pt_21, UCount=number_slider_17, VCount=number_slider_18, Overhang=True, Equalize=False)
mesh_uv_14 = MeshSurface(Surface=srf4pt_22, UCount=number_slider_17, VCount=number_slider_18, Overhang=True, Equalize=False)
mesh_uv_15 = MeshSurface(Surface=srf4pt_13, UCount=number_slider_17, VCount=number_slider_18, Overhang=True, Equalize=False)
mesh_uv_16 = MeshSurface(Surface=srf4pt_14, UCount=number_slider_17, VCount=number_slider_18, Overhang=True, Equalize=False)
mesh_uv_17 = MeshSurface(Surface=srf4pt_19, UCount=number_slider_17, VCount=number_slider_18, Overhang=True, Equalize=False)
mesh_uv_18 = MeshSurface(Surface=srf4pt_15, UCount=number_slider_17, VCount=number_slider_18, Overhang=True, Equalize=False)
mesh_uv_19 = MeshSurface(Surface=srf4pt_16, UCount=number_slider_17, VCount=number_slider_18, Overhang=True, Equalize=False)
mesh_uv_20 = MeshSurface(Surface=srf4pt_17, UCount=number_slider_19, VCount=number_slider_18, Overhang=True, Equalize=False)
mesh_uv_21 = MeshSurface(Surface=srf4pt_18, UCount=number_slider_17, VCount=number_slider_18, Overhang=True, Equalize=False)
mesh_uv_22 = MeshSurface(Surface=srf4pt_12, UCount=number_slider_17, VCount=number_slider_18, Overhang=True, Equalize=False)
mesh_uv_23 = MeshSurface(Surface=srf4pt_36, UCount=number_slider_17, VCount=number_slider_18, Overhang=True, Equalize=False)
mesh_uv_24 = MeshSurface(Surface=srf4pt_23, UCount=number_slider_17, VCount=number_slider_18, Overhang=True, Equalize=False)
mesh_uv_25 = MeshSurface(Surface=srf4pt_24, UCount=number_slider_17, VCount=number_slider_18, Overhang=True, Equalize=False)
srf4pt_38 = _4PointSurface(CornerA=move_32.Geometry, CornerB=move_45.Geometry, CornerC=move_64.Geometry, CornerD=move_63.Geometry)
mesh_uv_26 = MeshSurface(Surface=srf4pt_26, UCount=number_slider_17, VCount=number_slider_18, Overhang=True, Equalize=False)
mesh_uv_27 = MeshSurface(Surface=srf4pt_37, UCount=number_slider_17, VCount=number_slider_18, Overhang=True, Equalize=False)
mesh_uv_28 = MeshSurface(Surface=srf4pt_25, UCount=number_slider_17, VCount=number_slider_18, Overhang=True, Equalize=False)
mesh_uv_29 = MeshSurface(Surface=srf4pt_27, UCount=number_slider_17, VCount=number_slider_18, Overhang=True, Equalize=False)
mesh_uv_30 = MeshSurface(Surface=srf4pt_28, UCount=number_slider_17, VCount=number_slider_18, Overhang=True, Equalize=False)
mesh_uv_31 = MeshSurface(Surface=srf4pt_29, UCount=number_slider_17, VCount=number_slider_18, Overhang=True, Equalize=False)
mesh_uv_32 = MeshSurface(Surface=srf4pt_30, UCount=number_slider_17, VCount=number_slider_18, Overhang=True, Equalize=False)
mesh_uv_33 = MeshSurface(Surface=srf4pt_35, UCount=number_slider_17, VCount=number_slider_18, Overhang=True, Equalize=False)
mesh_uv_34 = MeshSurface(Surface=srf4pt_32, UCount=number_slider_17, VCount=number_slider_18, Overhang=True, Equalize=False)
mesh_uv_35 = MeshSurface(Surface=srf4pt_31, UCount=number_slider_17, VCount=number_slider_18, Overhang=True, Equalize=False)
mesh_uv_36 = MeshSurface(Surface=srf4pt_33, UCount=number_slider_17, VCount=number_slider_18, Overhang=True, Equalize=False)
mesh_uv_37 = MeshSurface(Surface=srf4pt_34, UCount=number_slider_17, VCount=number_slider_18, Overhang=True, Equalize=False)
mesh_uv_38 = MeshSurface(Surface=srf4pt_38, UCount=number_slider_17, VCount=number_slider_18, Overhang=True, Equalize=False)

flipm = FlipMesh(Mesh=mesh_uv_6, VertexNormals=True, FaceNormals=True, FaceOrientation=True)
flipm_2 = FlipMesh(Mesh=mesh_uv, VertexNormals=True, FaceNormals=True, FaceOrientation=True)
flipm_3 = FlipMesh(Mesh=mesh_uv_7, VertexNormals=True, FaceNormals=True, FaceOrientation=True)
flipm_4 = FlipMesh(Mesh=mesh_uv_4, VertexNormals=True, FaceNormals=True, FaceOrientation=True)
flipm_5 = FlipMesh(Mesh=mesh_uv_10, VertexNormals=True, FaceNormals=True, FaceOrientation=True)
flipm_6 = FlipMesh(Mesh=mesh_uv_31, VertexNormals=True, FaceNormals=True, FaceOrientation=True)
flipm_7 = FlipMesh(Mesh=mesh_uv_32, VertexNormals=True, FaceNormals=True, FaceOrientation=True)
flipm_8 = FlipMesh(Mesh=mesh_uv_30, VertexNormals=True, FaceNormals=True, FaceOrientation=True)
flipm_9 = FlipMesh(Mesh=mesh_uv_26, VertexNormals=True, FaceNormals=True, FaceOrientation=True)
flipm_10 = FlipMesh(Mesh=mesh_uv_29, VertexNormals=True, FaceNormals=True, FaceOrientation=True)
flipm_11 = FlipMesh(Mesh=mesh_uv_33, VertexNormals=True, FaceNormals=True, FaceOrientation=True)
flipm_12 = FlipMesh(Mesh=mesh_uv_36, VertexNormals=True, FaceNormals=True, FaceOrientation=True)
flipm_13 = FlipMesh(Mesh=mesh_uv_18, VertexNormals=True, FaceNormals=True, FaceOrientation=True)
flipm_14 = FlipMesh(Mesh=mesh_uv_21, VertexNormals=True, FaceNormals=True, FaceOrientation=True)
flipm_15 = FlipMesh(Mesh=mesh_uv_23, VertexNormals=True, FaceNormals=True, FaceOrientation=True)
flipm_16 = FlipMesh(Mesh=mesh_uv_27, VertexNormals=True, FaceNormals=True, FaceOrientation=True)
flipm_17 = FlipMesh(Mesh=mesh_uv_15, VertexNormals=True, FaceNormals=True, FaceOrientation=True)
flipm_18 = FlipMesh(Mesh=mesh_uv_16, VertexNormals=True, FaceNormals=True, FaceOrientation=True)
flipm_19 = FlipMesh(Mesh=mesh_uv_38, VertexNormals=True, FaceNormals=True, FaceOrientation=True)
merge_11 = Merge(
    Data1=flipm_15,
    Data2=flipm_16,
    Data3=mesh_uv_24,
    Data4=mesh_uv_25,
    Data5=mesh_uv_28,
    Data6=flipm_9,
    Data7=flipm_10,
    Data8=flipm_8,
    Data9=flipm_6,
    Data10=flipm_7,
    Data11=flipm_11,
    Data12=mesh_uv_35,
    Data13=mesh_uv_34,
    Data14=flipm_12,
    Data15=mesh_uv_37,
    Data16=flipm_19)
merge_12 = Merge(
    Data1=mesh_uv_3,
    Data2=flipm_4,
    Data3=mesh_uv_5,
    Data4=flipm,
    Data5=flipm_2,
    Data6=mesh_uv_2,
    Data7=flipm_3,
    Data8=mesh_uv_8,
    Data9=mesh_uv_9,
    Data10=flipm_5,
    Data11=mesh_uv_11)
merge_13 = Merge(Data1=mesh_uv_3, Data2=mesh_uv_5, Data3=flipm_2, Data4=flipm_3, Data5=mesh_uv_9, Data6=mesh_uv_11)
merge_14 = Merge(
    Data1=mesh_uv_12,
    Data2=mesh_uv_13,
    Data3=mesh_uv_14,
    Data4=flipm_17,
    Data5=flipm_18,
    Data6=mesh_uv_17,
    Data7=flipm_13,
    Data8=mesh_uv_19,
    Data9=mesh_uv_20,
    Data10=flipm_14,
    Data11=mesh_uv_22)
mjoin = MeshJoin(Meshes=merge_13)
mjoin_2 = MeshJoin(Meshes=merge_12)
faceb = FaceBoundaries(Mesh=mjoin)
faceb_2 = FaceBoundaries(Mesh=mjoin_2)
pcen = PolygonCenter(Polyline=faceb_2)  # -> CenterV, CenterE, CenterA
mjoin_3 = MeshJoin(Meshes=merge_14)
mjoin_4 = MeshJoin(Meshes=merge_11)
pcen_2 = PolygonCenter(Polyline=faceb)  # -> CenterV, CenterE, CenterA
smesh = SimpleMesh(Brep=faceb)
smesh_2 = SimpleMesh(Brep=faceb_2)
faceb_3 = FaceBoundaries(Mesh=mjoin_3)
scale_2 = Scale(Geometry=smesh, Center=pcen_2.CenterV, Factor=number_slider_20)  # -> Geometry, Transform
scale_3 = Scale(Geometry=smesh_2, Center=pcen.CenterV, Factor=number_slider_20)  # -> Geometry, Transform
pcen_3 = PolygonCenter(Polyline=faceb_3)  # -> CenterV, CenterE, CenterA
faceb_4 = FaceBoundaries(Mesh=mjoin_4)
pcen_4 = PolygonCenter(Polyline=faceb_4)  # -> CenterV, CenterE, CenterA
smesh_3 = SimpleMesh(Brep=faceb_3)
smesh_4 = SimpleMesh(Brep=faceb_4)
scale_4 = Scale(Geometry=smesh_3, Center=pcen_3.CenterV, Factor=number_slider_20)  # -> Geometry, Transform
scale_5 = Scale(Geometry=smesh_4, Center=pcen_4.CenterV, Factor=number_slider_20)  # -> Geometry, Transform

# ---- group: 片片
开放度最小百分比 = Slider(0.7, range=0..1)
construct_domain = ConstructDomain(DomainStart=开放度最小百分比, DomainEnd="1")
merge_15 = Merge(Data1=scale_3.Geometry, Data2=scale_4.Geometry, Data3=scale_5.Geometry)
remap_numbers_3 = RemapNumbers(Value=任务处理2_疲惫度_开放度, Source=Domain(0, 1), Target=construct_domain)  # -> Mapped, Clipped
lng = ListLength(List=merge_15)
ghpython_script_7 = GhPythonScript(x=remap_numbers_3.Mapped)  # -> out, a; same code as ghpython_script_5
remap_21 = RemapNumbers(Value=ghpython_script_7.a, Source=Domain(0, 1), Target="1 to 0")  # -> Mapped, Clipped
remap_22 = RemapNumbers(Value=remap_21.Mapped, Source=Domain(0, 1), Target=lng)  # -> Mapped, Clipped
round = Round(Number=remap_22.Mapped)  # -> Nearest, Floor, Ceiling
reduce = RandomReduce(List=merge_15, Reduction=round.Nearest, Seed=Slider(44, range=0..100))

# ----
offmsh = OffsetMesh(Mesh=reduce, Distance=Slider(0.001, range=0..0.001), BothSides=0, CreateSolid="0")  # -> flatten(Offset)
flipm_20 = FlipMesh(Mesh=offmsh, VertexNormals=True, FaceNormals=True, FaceOrientation=True)
merge_16 = Merge(Data1=flatten(reduce), Data2=flipm_20)  # -> flatten(Result)
mesh数量 = Panel(merge_16)

# ---- group: 颜色
python_22 = GhPythonScript(x=merge_4)  # -> out, a; same code as python
null_2 = NullItem(Item=python_22.a)  # -> NullFlags, InvalidFlags, Description
or = GateOr(A=null_2.NullFlags, B=null_2.InvalidFlags)
not = GateNot(A=or)
python_23 = GhPythonScript(x=python_22.a, y=not)  # -> out, a; inputs y: Int32
# ---------- python_23: Python ----------
__author__ = "lmh"
__version__ = "2024.06.20"

import rhinoscriptsyntax as rs
if y:
    if 0 <= x <= 0.3:
        a = 0
    if 0.3 < x <= 0.4:
        a = 0.25
    if 0.4 < x <= 0.6:
        a =0.5
    if 0.6 < x <= 0.8:
        a =0.75
    if 0.8 < x <= 1:
        a = 1
else:
    a = 0
# ---------- end python_23 ----------
item_29 = ListItem(List=python_23.a, Index=0, Wrap=True)  # -> Item, Item1, Item2, Item3
addition_7 = Addition(A=item_29.Item, B=item_29.Item1, C=item_29.Item2, D=item_29.Item3)
python_24 = GhPythonScript(x=addition_7)  # -> out, a
# ---------- python_24: Python ----------
__author__ = "lmh"
__version__ = "2024.06.21"

import rhinoscriptsyntax as rs
if x == 0:
    a = 1
else:
    a = x
# ---------- end python_24 ----------
division_10 = Division(A=item_29.Item2, B=python_24.a)
division_11 = Division(A=item_29.Item, B=python_24.a)
division_12 = Division(A=item_29.Item1, B=python_24.a)
division_13 = Division(A=item_29.Item3, B=python_24.a)
python_25 = GhPythonScript(x=item_29.Item, y=item_29.Item1, z=item_29.Item2, u=item_29.Item3)  # -> out, a
# ---------- python_25: Python ----------
__author__ = "lmh"
__version__ = "2024.06.21"

import rhinoscriptsyntax as rs

if x == y == z == u:
    a = 0
else:
    a = 1
# ---------- end python_25 ----------
argb = SplitARGB(Colour=swatch_2)  # -> Alpha, Red, Green, Blue
argb_2 = SplitARGB(Colour=swatch)  # -> Alpha, Red, Green, Blue
argb_3 = SplitARGB(Colour=swatch_4)  # -> Alpha, Red, Green, Blue
argb_4 = SplitARGB(Colour=swatch_3)  # -> Alpha, Red, Green, Blue
merge_17 = Merge(Data1=argb_2.Red, Data2=argb_2.Green, Data3=argb_2.Blue)
merge_18 = Merge(Data1=argb.Red, Data2=argb.Green, Data3=argb.Blue)
merge_19 = Merge(Data1=argb_3.Red, Data2=argb_3.Green, Data3=argb_3.Blue)
merge_20 = Merge(Data1=argb_4.Red, Data2=argb_4.Green, Data3=argb_4.Blue)
multiplication_3 = Multiplication(A=merge_17, B=division_11)
multiplication_4 = Multiplication(A=merge_18, B=division_12)
multiplication_5 = Multiplication(A=merge_20, B=division_13)
multiplication_6 = Multiplication(A=merge_19, B=division_10)
addition_8 = Addition(A=multiplication_3, B=multiplication_4, C=multiplication_6, D=multiplication_5)
python_26 = GhPythonScript(x=addition_8, y=not, z=python_25.a)  # -> out, a; inputs y: list
# ---------- python_26: Python ----------
__author__ = "lmh"
__version__ = "2024.06.21"

import rhinoscriptsyntax as rs
if 0 in y or z == 0:
    a = 1
else:
    a = x
# ---------- end python_26 ----------

# ----
panel_61 = Panel(python_22.a)
panel_62 = Panel(python_23.a)

graft_2 = GraftTree(Tree=python_26.a, IncludeEmptyLists=True, IncludeNullItems=True)
速度_6 = Slider(18, range=0..20)
trigger_11 = Trigger(Interval=200, TimerInterval=200, Target=rec_7)  # disabled
toggle_2 = BooleanToggle(True)
rec_7 = DataRecorder(graft_2, DataLimit=-10, RecordData=True)
trigger_12 = Trigger(Interval=20, TimerInterval=20, Target=[counter_17, counter_16, counter_15])  # disabled
item_30 = ListItem(List=rec_7, Index="-2", Wrap=True)  # -> flatten(Item)
item_31 = ListItem(List=rec_7, Index="-1", Wrap=True)  # -> flatten(Item)
dom_14 = ConstructDomain(DomainStart="0", DomainEnd=速度_6)
dcon_6 = DeleteConsecutive(Set=rec_7, Wrap=False)  # -> Set, Count
subtraction_11 = Subtraction(A=item_31, B=item_30)
abs_2 = Absolute(Value=subtraction_11)
item_32 = ListItem(List=abs_2, Index=0, Wrap=True)  # -> Item, Item1, Item2
counter_15 = Counter(CountDirection=True, Step=1, StartStop=toggle_2, Reset=item_32.Item2, OptionalCounterDomain=Domain(0, 100))
counter_16 = Counter(CountDirection=True, Step=1, StartStop=toggle_2, Reset=item_32.Item1, OptionalCounterDomain=Domain(0, 100))
counter_17 = Counter(CountDirection=True, Step=1, StartStop=toggle_2, Reset=item_32.Item, OptionalCounterDomain=Domain(0, 100))
merge_21 = Merge(Data1=counter_17, Data2=counter_16, Data3=counter_15)
item_33 = ListItem(List=dcon_6.Set, Index="-2", Wrap=True)  # -> flatten(Item)
item_34 = ListItem(List=dcon_6.Set, Index="-1", Wrap=True)  # -> flatten(Item)
remap_23 = RemapNumbers(Value=merge_21, Source="0 to 100", Target=dom_14)  # -> Mapped, Clipped
dom_15 = ConstructDomain(DomainStart=item_33, DomainEnd=item_34)
python_27 = GhPythonScript(x=remap_23.Mapped)  # -> out, a; same code as python_4
remap_24 = RemapNumbers(Value=python_27.a, Source=Domain(0, 1), Target=dom_15)  # -> Mapped, Clipped

# ---- group: 颜色 (continued)
item_35 = ListItem(List=remap_24.Mapped, Index=0, Wrap=True)  # -> Item, Item1, Item2
frgb = ColourRGBF(Alpha=1, Red=item_35.Item, Green=item_35.Item1, Blue=item_35.Item2)
ahsv = SplitAHSV(Colour=frgb)  # -> Alpha, Hue, Saturation, Value
addition_9 = Addition(A=ahsv.Saturation, B=饱和度)
addition_10 = Addition(A=ahsv.Value, B=明度)
hsv = ColourHSV(Alpha="1", Hue=ahsv.Hue, Saturation=addition_9, Value=addition_10)

# ----
panel_63 = Panel(frgb)
mcol = MeshColours(Mesh=merge_16, Colours=hsv)
# 网格线（待定）
c_script_3 = CSharpScript(mesh=mcol)  # inputs mesh: list of Mesh
# ---------- c_script_3: C# ----------
    using(var args = new Rhino.Runtime.NamedParametersEventArgs())
    {
      args.Set("mesh", mesh.ToArray());
      Rhino.Runtime.HostUtils.ExecuteNamedCallback("Unity:FromGrasshopper", args);
    }
# ---------- end c_script_3 ----------
