# Grasshopper definition 0627_simplified.gh (Grasshopper 1.0.7)
# plug-ins: gHowl, Pufferfish

network_source = NetworkSource()  # -> NetworkAdapterIsUp, AdapterProperties, LocalIpAddress
panel = Panel(network_source.LocalIpAddress)
construct_point = ConstructPoint(XCoordinate=0, YCoordinate=0, ZCoordinate=0)
null_placeholder = NullPlaceholder()
relay = Relay()

# ---- group: 所有人的点
point = Point(relay)

# ----
partition_list = PartitionList(List=relay, Size="34")

# ---- group: 选中的人
explode_tree = ExplodeTree(Data=partition_list)  # -> Branch0, Branch1, Branch2
point_2 = Point(explode_tree.Branch0)

# ---- group: 肘关节夹角
肘关节夹角 = Panel("""18
19
20""")
肘关节夹角_2 = Panel("""22
23
24""")
list_item = ListItem(List=explode_tree.Branch0, Index=肘关节夹角, Wrap=True)
list_item_2 = ListItem(List=explode_tree.Branch0, Index=肘关节夹角_2, Wrap=True)
polyline = PolyLine(Vertices=list_item, Closed=False)
polyline_2 = PolyLine(Vertices=list_item_2, Closed=False)
list_item_3 = ListItem(List=list_item_2, Index=0, Wrap=True)  # -> Item, Item1, Item2
list_item_4 = ListItem(List=list_item, Index=0, Wrap=True)  # -> Item, Item1, Item2
vector_2pt = Vector2Pt(PointA=list_item_3.Item, PointB=list_item_3.Item1, Unitize=False)  # -> Vector, Length
vector_2pt_2 = Vector2Pt(PointA=list_item_3.Item2, PointB=list_item_3.Item1, Unitize=False)  # -> Vector, Length
vector_2pt_3 = Vector2Pt(PointA=list_item_4.Item, PointB=list_item_4.Item1, Unitize=False)  # -> Vector, Length
vector_2pt_4 = Vector2Pt(PointA=list_item_4.Item2, PointB=list_item_4.Item1, Unitize=False)  # -> Vector, Length
angle = Angle(VectorA=vector_2pt.Vector, VectorB=vector_2pt_2.Vector)  # -> Angle, Reflex
angle_2 = Angle(VectorA=vector_2pt_3.Vector, VectorB=vector_2pt_4.Vector)  # -> Angle, Reflex
degrees = Degrees(Radians=angle.Angle)
degrees_2 = Degrees(Radians=angle_2.Angle)
right_膝关节夹角 = Panel(degrees_2)
left_膝关节夹角 = Panel(degrees)

# ---- group: 肩部夹角
肩部夹角 = Panel("""6
5
18""")
肩部夹角_2 = Panel("""13
12
22""")
list_item_5 = ListItem(List=explode_tree.Branch0, Index=肩部夹角, Wrap=True)
list_item_6 = ListItem(List=explode_tree.Branch0, Index=肩部夹角_2, Wrap=True)
polyline_3 = PolyLine(Vertices=list_item_5, Closed=False)
polyline_4 = PolyLine(Vertices=list_item_6, Closed=False)
list_item_7 = ListItem(List=list_item_6, Index=0, Wrap=True)  # -> Item, Item1, Item2
list_item_8 = ListItem(List=list_item_5, Index=0, Wrap=True)  # -> Item, Item1, Item2
vector_2pt_5 = Vector2Pt(PointA=list_item_7.Item, PointB=list_item_7.Item1, Unitize=False)  # -> Vector, Length
vector_2pt_6 = Vector2Pt(PointA=list_item_7.Item2, PointB=list_item_7.Item1, Unitize=False)  # -> Vector, Length
vector_2pt_7 = Vector2Pt(PointA=list_item_8.Item, PointB=list_item_8.Item1, Unitize=False)  # -> Vector, Length
vector_2pt_8 = Vector2Pt(PointA=list_item_8.Item2, PointB=list_item_8.Item1, Unitize=False)  # -> Vector, Length
angle_3 = Angle(VectorA=vector_2pt_5.Vector, VectorB=vector_2pt_6.Vector)  # -> Angle, Reflex
angle_4 = Angle(VectorA=vector_2pt_7.Vector, VectorB=vector_2pt_8.Vector)  # -> Angle, Reflex
degrees_3 = Degrees(Radians=angle_3.Angle)
degrees_4 = Degrees(Radians=angle_4.Angle)
right_肩部关节夹角 = Panel(degrees_4)
left_肩部关节夹角 = Panel(degrees_3)

# ---- group: 躯干-大腿夹角
躯干_大腿夹角 = Panel("""4
18
19""")
躯干_大腿夹角_2 = Panel("""11
22
23""")
list_item_9 = ListItem(List=explode_tree.Branch0, Index=躯干_大腿夹角, Wrap=True)
list_item_10 = ListItem(List=explode_tree.Branch0, Index=躯干_大腿夹角_2, Wrap=True)
polyline_5 = PolyLine(Vertices=list_item_10, Closed=False)
polyline_6 = PolyLine(Vertices=list_item_9, Closed=False)
list_item_11 = ListItem(List=list_item_10, Index=0, Wrap=True)  # -> Item, Item1, Item2
list_item_12 = ListItem(List=list_item_9, Index=0, Wrap=True)  # -> Item, Item1, Item2
vector_2pt_9 = Vector2Pt(PointA=list_item_11.Item, PointB=list_item_11.Item1, Unitize=False)  # -> Vector, Length
vector_2pt_10 = Vector2Pt(PointA=list_item_11.Item2, PointB=list_item_11.Item1, Unitize=False)  # -> Vector, Length
vector_2pt_11 = Vector2Pt(PointA=list_item_12.Item, PointB=list_item_12.Item1, Unitize=False)  # -> Vector, Length
vector_2pt_12 = Vector2Pt(PointA=list_item_12.Item2, PointB=list_item_12.Item1, Unitize=False)  # -> Vector, Length
angle_5 = Angle(VectorA=vector_2pt_9.Vector, VectorB=vector_2pt_10.Vector)  # -> Angle, Reflex
angle_6 = Angle(VectorA=vector_2pt_11.Vector, VectorB=vector_2pt_12.Vector)  # -> Angle, Reflex
degrees_5 = Degrees(Radians=angle_5.Angle)
degrees_6 = Degrees(Radians=angle_6.Angle)
right_躯干_大腿夹角 = Panel(degrees_6)
left_躯干_大腿夹角 = Panel(degrees_5)

# ---- group: 肘关节夹角
肘关节夹角_3 = Panel("""5
6
7""")
肘关节夹角_4 = Panel("""12
13
14""")
list_item_13 = ListItem(List=explode_tree.Branch0, Index=肘关节夹角_3, Wrap=True)
list_item_14 = ListItem(List=explode_tree.Branch0, Index=肘关节夹角_4, Wrap=True)
polyline_7 = PolyLine(Vertices=list_item_13, Closed=False)
polyline_8 = PolyLine(Vertices=list_item_14, Closed=False)
list_item_15 = ListItem(List=list_item_14, Index=0, Wrap=True)  # -> Item, Item1, Item2
list_item_16 = ListItem(List=list_item_13, Index=0, Wrap=True)  # -> Item, Item1, Item2
vector_2pt_13 = Vector2Pt(PointA=list_item_15.Item, PointB=list_item_15.Item1, Unitize=False)  # -> Vector, Length
vector_2pt_14 = Vector2Pt(PointA=list_item_15.Item2, PointB=list_item_15.Item1, Unitize=False)  # -> Vector, Length
vector_2pt_15 = Vector2Pt(PointA=list_item_16.Item, PointB=list_item_16.Item1, Unitize=False)  # -> Vector, Length
vector_2pt_16 = Vector2Pt(PointA=list_item_16.Item2, PointB=list_item_16.Item1, Unitize=False)  # -> Vector, Length
angle_7 = Angle(VectorA=vector_2pt_13.Vector, VectorB=vector_2pt_14.Vector)  # -> Angle, Reflex
angle_8 = Angle(VectorA=vector_2pt_15.Vector, VectorB=vector_2pt_16.Vector)  # -> Angle, Reflex
degrees_7 = Degrees(Radians=angle_7.Angle)
degrees_8 = Degrees(Radians=angle_8.Angle)
right_肘关节夹角 = Panel(degrees_8)
left_肘关节夹角 = Panel(degrees_7)

# ---- group: 骨骼连线（人形）
panel_2 = Panel("""27
30
31""")
panel_3 = Panel("""2
11
12
13
14
15
16""")
panel_4 = Panel("""14
17""")
panel_5 = Panel("""0
22
23
24
25""")
panel_6 = Panel("""0
1
2
3
26
27""")
panel_7 = Panel("""27
28
29""")
panel_8 = Panel("""2
4
5
6
7
8
9""")
panel_9 = Panel("""7
10""")
panel_10 = Panel("""24
33""")
panel_11 = Panel("""0
18
19
20
21""")
panel_12 = Panel("""20
32""")
list_item_17 = ListItem(List=partition_list, Index=panel_7, Wrap=True)  # -> simplify(Item)
list_item_18 = ListItem(List=partition_list, Index=panel_6, Wrap=True)
list_item_19 = ListItem(List=partition_list, Index=panel_2, Wrap=True)
list_item_20 = ListItem(List=partition_list, Index=panel_8, Wrap=True)
list_item_21 = ListItem(List=partition_list, Index=panel_9, Wrap=True)
list_item_22 = ListItem(List=partition_list, Index=panel_3, Wrap=True)
list_item_23 = ListItem(List=partition_list, Index=panel_4, Wrap=True)
list_item_24 = ListItem(List=partition_list, Index=panel_5, Wrap=True)
list_item_25 = ListItem(List=partition_list, Index=panel_10, Wrap=True)
list_item_26 = ListItem(List=partition_list, Index=panel_11, Wrap=True)
list_item_27 = ListItem(List=partition_list, Index=panel_12, Wrap=True)
polyline_9 = PolyLine(Vertices=list_item_18, Closed=False)
polyline_10 = PolyLine(Vertices=list_item_17, Closed=False)
polyline_11 = PolyLine(Vertices=list_item_19, Closed=False)
polyline_12 = PolyLine(Vertices=list_item_20, Closed=False)
polyline_13 = PolyLine(Vertices=list_item_21, Closed=False)
polyline_14 = PolyLine(Vertices=list_item_22, Closed=False)
polyline_15 = PolyLine(Vertices=list_item_23, Closed=False)
polyline_16 = PolyLine(Vertices=list_item_24, Closed=False)
polyline_17 = PolyLine(Vertices=list_item_25, Closed=False)
polyline_18 = PolyLine(Vertices=list_item_26, Closed=False)
polyline_19 = PolyLine(Vertices=list_item_27, Closed=False)
merge = Merge(
    Data1=polyline_9,
    Data2=polyline_10,
    Data3=polyline_11,
    Data4=polyline_12,
    Data5=polyline_13,
    Data6=polyline_14,
    Data7=polyline_15,
    Data8=polyline_16,
    Data9=polyline_17,
    Data10=polyline_18,
    Data11=polyline_19)

# ----
udp_receiver = UDPReceiver(Address=network_source.LocalIpAddress, Port="1111", Pattern=0)  # -> Info, Data

骨骼点 = Panel(udp_receiver.Data)

text_split = TextSplit(Text=udp_receiver.Data)
c_script = CSharpScript(x=text_split)  # -> out, a; inputs x: list of String
# ---------- c_script: C# usings ----------
using System.Linq;
# ---------- c_script: C# ----------
    List<List<string>> groups = new List<List<string>>();
    List<string> currentGroup = new List<string>();


    foreach (string item in x)
    {
      if (item == "")
      {
        if (currentGroup.Any())
        {
          groups.Add(currentGroup);
          currentGroup = new List<string>();
        }
      }
      else
      {
        currentGroup.Add(item);
      }
    }

    if (currentGroup.Any())
    {
      groups.Add(currentGroup);
    }

    List<string> combinedGroup = groups.Select(sublist => string.Join("\n", sublist)).ToList();
    a = combinedGroup.ToArray();
# ---------- end c_script ----------
text_split_2 = TextSplit(Text=c_script.a)
split_list = SplitList(List=text_split_2, Index="1")  # -> flatten(ListA), ListB
list_item_28 = ListItem(List=flatten(split_list.ListA), Index=0, Wrap=True)
text_split_3 = TextSplit(Text=split_list.ListB, Separators=" ")  # -> simplify(Result)
panel_13 = Panel(split_list.ListA)
list_item_29 = ListItem(List=text_split_3, Index=0, Wrap=True)  # -> Item, Item1, Item2
construct_point_2 = ConstructPoint(XCoordinate=list_item_29.Item, YCoordinate=list_item_29.Item1, ZCoordinate=list_item_29.Item2)
distance = Distance(PointA=construct_point_2, PointB=construct_point)
smaller_than = SmallerThan(FirstNumber=distance, SecondNumber="0.001")  # -> SmallerThan, OrEqualTo
member_index = MemberIndex(Set=smaller_than.SmallerThan, Member=Toggle(True))  # -> Index, Count
replace_items = ReplaceItems(List=construct_point_2, Item=null_placeholder, Indices=member_index.Index, Wrap=False)
flatten_tree = FlattenTree(Tree=replace_items, Path="{0}")

# ---- group: 头部向量
head = Panel("26")
left_eye = Panel("28")
right_eye = Panel("30")
list_item_30 = ListItem(List=partition_list, Index=head, Wrap=True)
list_item_31 = ListItem(List=partition_list, Index=left_eye, Wrap=True)
list_item_32 = ListItem(List=partition_list, Index=right_eye, Wrap=True)
plane_3pt = Plane3Pt(PointA=list_item_30, PointB=list_item_31, PointC=list_item_32)
polyline_20 = PolyLine(Vertices=[list_item_30, list_item_31, list_item_32], Closed="1")
polygon_center = PolygonCenter(Polyline=polyline_20)  # -> CenterV, CenterE, CenterA
vector = Vector(plane_3pt)

# ----
panel_14 = Panel(list_item_30)
list_item_33 = ListItem(List=flatten(polygon_center.CenterV), Index=0, Wrap=True)  # -> Item, Item1
list_item_34 = ListItem(List=flatten(vector), Index=0, Wrap=True)  # -> Item, Item1

# ---- group: 头部向量 (continued)
vector_display = VectorDisplay(Anchor=list_item_33.Item, Vector=list_item_34.Item)

# ----
vector_display_2 = VectorDisplay(Anchor=list_item_33.Item1, Vector=list_item_34.Item1)

addition = Addition(A=right_膝关节夹角, B=left_膝关节夹角)
division = Division(A=addition, B=2)
addition_2 = Addition(A=right_躯干_大腿夹角, B=left_躯干_大腿夹角)
division_2 = Division(A=addition_2, B=2)
addition_3 = Addition(A=right_肘关节夹角, B=left_肘关节夹角)
addition_4 = Addition(A=right_肩部关节夹角, B=left_肩部关节夹角)
division_3 = Division(A=addition_3, B="360")
division_4 = Division(A=addition_4, B="360")
肘关节夹角均值_归一化 = Panel(division_3)
肩部关节夹角_归一化 = Panel(division_4)
addition_5 = Addition(A=肩部关节夹角_归一化, B=肘关节夹角均值_归一化)
division_5 = Division(A=addition_5, B=2)

ghpython_script = GhPythonScript(x=division)  # -> out, a
# ---------- ghpython_script: Python ----------
__author__ = "Lenovo"
__version__ = "2024.06.30"

import rhinoscriptsyntax as rs
if x:
    a = abs(90-x)/90
# ---------- end ghpython_script ----------
ghpython_script_2 = GhPythonScript(x=division_2)  # -> out, a; same code as ghpython_script

膝关节夹角与90度差_归一化 = Panel(ghpython_script.a)
大腿_躯干与90度差_归一化 = Panel(ghpython_script_2.a)
addition_6 = Addition(A=ghpython_script.a, B=ghpython_script_2.a)
division_6 = Division(A=addition_6, B=2)

灵活度_归一化 = Panel(division_6)
思考强度_归一化 = Panel(division_5)
