# Grasshopper definition 0705.gh (Grasshopper 1.0.7)
# plug-ins: Firefly_X, Pufferfish, gHowl

# 看看取的是谁的
network_source = NetworkSource()  # -> NetworkAdapterIsUp, AdapterProperties, LocalIpAddress
panel = Panel(network_source.LocalIpAddress)

udp_receiver = UDPReceiver(Address=network_source.LocalIpAddress, Port="3333", Pattern=0)  # -> Info, Data
panel_2 = Panel(udp_receiver.Data)
text_split = TextSplit(Text=panel_2, Separators="*")
list_item = ListItem(List=text_split, Index=0, Wrap=True)  # -> Item, Item1

# ----
# - Interaction 交互状态
# 
# - Task 任务处理模式
# 
# - attention 注意力状态
# 
# - emotion 情绪状态
骨骼点 = Panel(list_item.Item)

trigger = Trigger(Interval=1000, TimerInterval=1000, Target=counter)  # disabled
button = Button()  # disabled
counter = Counter(CountDirection=True, Step=1, StartStop=True, Reset=button, OptionalCounterDomain=Domain(0, 100))  # disabled
panel_3 = Panel(counter)  # disabled
random = Random(Range=Domain(0, 1), Number=1, Seed=panel_3)  # disabled
生成随机数 = Panel(random)  # disabled

# ----
# (1)随机拿一个人，空间识别谁是主要人（好像也说得通）
# (2)固定拿一个人，画面扰动之后会变化
cluster = Cluster(data=list_item.Item)
crv = Curve(<curve referenced from the Rhino model>)
point = Point(cluster)

# ---- group: 坐标系转化
srf = Surface(<surface referenced from the Rhino model>)
pln = Plane(srf)
flip_plane = FlipPlane(Plane=pln, ReverseX=False, ReverseY=False, SwapAxes=True)
deplane = DeconstructPlane(Plane=flip_plane)  # -> Origin, XAxis, YAxis, ZAxis
deplane_2 = DeconstructPlane(Plane=flip_plane)  # -> Origin, XAxis, YAxis, ZAxis
vec = Vector(deplane_2.XAxis)
vec_2 = Vector(deplane.ZAxis)
line_sdl = LineSDL(Start=deplane.Origin, Direction=vec_2, Length=Slider(1, range=0..1))
pt = Point(flip_plane)
vdis = VectorDisplay(Anchor=pt, Vector=vec_2)
rotate_axis = RotateAxis(Geometry=flip_plane, Angle=degrees(Slider(90, range=0..100)), Axis=line_sdl)  # -> Geometry, Transform
xy = XYPlane(Origin=Point(0, 0, 0))
zed深度相机缩放比例 = Slider(1.129, range=0..10)
deplane_3 = DeconstructPlane(Plane=xy)  # -> Origin, XAxis, YAxis, ZAxis
scale = Scale(Geometry=point, Center=deplane_3.Origin, Factor=zed深度相机缩放比例)  # -> Geometry, Transform
orient = Orient(Geometry=scale.Geometry, Source=xy, Target=rotate_axis.Geometry)  # -> Geometry, Transform

# ----
partition_list = PartitionList(List=orient.Geometry, Size="34")

# ---- group: 可视化
cluster_2 = Cluster_3(
    list_2=partition_list,
    list=partition_list,
    list_3=partition_list,
    list_4=partition_list,
    list_5=partition_list,
    list_6=partition_list,
    list_7=partition_list,
    list_8=partition_list,
    list_9=partition_list,
    list_10=partition_list,
    list_11=partition_list)

# ---- group: 头部向量及位置
cluster_3 = Cluster_4(list_3=partition_list, list=partition_list, list_2=partition_list)  # -> vector_2, i

# ---- group: 所有人的头
point_2 = Point(cluster_3.i)

# ----
point_in_curve = PointInCurve(Point=point_2, Curve=crv)  # -> Relationship, Point

# ---- group: 所有人的点
point_3 = Point(orient.Geometry)

# ----
equality = Equality(FirstNumber=point_in_curve.Relationship, SecondNumber=2)  # -> Equality, Inequality
# 检查一下这样有没有问题
dispatch = Dispatch(List=partition_list, DispatchPattern=equality.Equality)  # -> ListA, ListB

# ---- group: 选中的人
explode_tree = ExplodeTree(Data=dispatch.ListA)  # -> Branch0, Branch1, Branch2
point_4 = Point(explode_tree.Branch0)

# ---- group: 肘关节夹角
肘关节夹角 = Panel("""18
19
20""")
肘关节夹角_2 = Panel("""22
23
24""")
list_item_2 = ListItem(List=point_4, Index=肘关节夹角, Wrap=True)
list_item_3 = ListItem(List=point_4, Index=肘关节夹角_2, Wrap=True)
polyline = PolyLine(Vertices=list_item_2, Closed=False)
polyline_2 = PolyLine(Vertices=list_item_3, Closed=False)
list_item_4 = ListItem(List=list_item_3, Index=0, Wrap=True)  # -> Item, Item1, Item2
list_item_5 = ListItem(List=list_item_2, Index=0, Wrap=True)  # -> Item, Item1, Item2
vector_2pt = Vector2Pt(PointA=list_item_4.Item, PointB=list_item_4.Item1, Unitize=False)  # -> Vector, Length
vector_2pt_2 = Vector2Pt(PointA=list_item_4.Item2, PointB=list_item_4.Item1, Unitize=False)  # -> Vector, Length
vector_2pt_3 = Vector2Pt(PointA=list_item_5.Item, PointB=list_item_5.Item1, Unitize=False)  # -> Vector, Length
vector_2pt_4 = Vector2Pt(PointA=list_item_5.Item2, PointB=list_item_5.Item1, Unitize=False)  # -> Vector, Length
angle = Angle(VectorA=vector_2pt.Vector, VectorB=vector_2pt_2.Vector)  # -> Angle, Reflex
angle_2 = Angle(VectorA=vector_2pt_3.Vector, VectorB=vector_2pt_4.Vector)  # -> Angle, Reflex
degrees = Degrees(Radians=angle.Angle)
degrees_2 = Degrees(Radians=angle_2.Angle)
right_膝关节夹角 = Panel(degrees_2)
left_膝关节夹角 = Panel(degrees)

# ---- group: 肩部夹角
肩部夹角 = Panel("""13
12
22""")
肩部夹角_2 = Panel("""6
5
18""")
list_item_6 = ListItem(List=point_4, Index=肩部夹角_2, Wrap=True)
list_item_7 = ListItem(List=point_4, Index=肩部夹角, Wrap=True)
polyline_3 = PolyLine(Vertices=list_item_6, Closed=False)
polyline_4 = PolyLine(Vertices=list_item_7, Closed=False)
list_item_8 = ListItem(List=list_item_7, Index=0, Wrap=True)  # -> Item, Item1, Item2
list_item_9 = ListItem(List=list_item_6, Index=0, Wrap=True)  # -> Item, Item1, Item2
vector_2pt_5 = Vector2Pt(PointA=list_item_8.Item, PointB=list_item_8.Item1, Unitize=False)  # -> Vector, Length
vector_2pt_6 = Vector2Pt(PointA=list_item_8.Item2, PointB=list_item_8.Item1, Unitize=False)  # -> Vector, Length
vector_2pt_7 = Vector2Pt(PointA=list_item_9.Item, PointB=list_item_9.Item1, Unitize=False)  # -> Vector, Length
vector_2pt_8 = Vector2Pt(PointA=list_item_9.Item2, PointB=list_item_9.Item1, Unitize=False)  # -> Vector, Length
angle_3 = Angle(VectorA=vector_2pt_5.Vector, VectorB=vector_2pt_6.Vector)  # -> Angle, Reflex
angle_4 = Angle(VectorA=vector_2pt_7.Vector, VectorB=vector_2pt_8.Vector)  # -> Angle, Reflex
degrees_3 = Degrees(Radians=angle_3.Angle)
degrees_4 = Degrees(Radians=angle_4.Angle)
right_肩部关节夹角 = Panel(degrees_4)
left_肩部关节夹角 = Panel(degrees_3)

# ---- group: 躯干-大腿夹角
躯干_大腿夹角 = Panel("""4
18
19""")
躯干_大腿夹角_2 = Panel("""11
22
23""")
list_item_10 = ListItem(List=point_4, Index=躯干_大腿夹角, Wrap=True)
list_item_11 = ListItem(List=point_4, Index=躯干_大腿夹角_2, Wrap=True)
polyline_5 = PolyLine(Vertices=list_item_11, Closed=False)
polyline_6 = PolyLine(Vertices=list_item_10, Closed=False)
list_item_12 = ListItem(List=list_item_11, Index=0, Wrap=True)  # -> Item, Item1, Item2
list_item_13 = ListItem(List=list_item_10, Index=0, Wrap=True)  # -> Item, Item1, Item2
vector_2pt_9 = Vector2Pt(PointA=list_item_12.Item, PointB=list_item_12.Item1, Unitize=False)  # -> Vector, Length
vector_2pt_10 = Vector2Pt(PointA=list_item_12.Item2, PointB=list_item_12.Item1, Unitize=False)  # -> Vector, Length
vector_2pt_11 = Vector2Pt(PointA=list_item_13.Item, PointB=list_item_13.Item1, Unitize=False)  # -> Vector, Length
vector_2pt_12 = Vector2Pt(PointA=list_item_13.Item2, PointB=list_item_13.Item1, Unitize=False)  # -> Vector, Length
angle_5 = Angle(VectorA=vector_2pt_9.Vector, VectorB=vector_2pt_10.Vector)  # -> Angle, Reflex
angle_6 = Angle(VectorA=vector_2pt_11.Vector, VectorB=vector_2pt_12.Vector)  # -> Angle, Reflex
degrees_5 = Degrees(Radians=angle_5.Angle)
degrees_6 = Degrees(Radians=angle_6.Angle)
right_躯干_大腿夹角 = Panel(degrees_6)
left_躯干_大腿夹角 = Panel(degrees_5)

# ---- group: 肘关节夹角
肘关节夹角_3 = Panel("""5
6
7""")
肘关节夹角_4 = Panel("""12
13
14""")
list_item_14 = ListItem(List=point_4, Index=肘关节夹角_3, Wrap=True)
list_item_15 = ListItem(List=point_4, Index=肘关节夹角_4, Wrap=True)
polyline_7 = PolyLine(Vertices=list_item_14, Closed=False)
polyline_8 = PolyLine(Vertices=list_item_15, Closed=False)
list_item_16 = ListItem(List=list_item_15, Index=0, Wrap=True)  # -> Item, Item1, Item2
list_item_17 = ListItem(List=list_item_14, Index=0, Wrap=True)  # -> Item, Item1, Item2
vector_2pt_13 = Vector2Pt(PointA=list_item_16.Item, PointB=list_item_16.Item1, Unitize=False)  # -> Vector, Length
vector_2pt_14 = Vector2Pt(PointA=list_item_16.Item2, PointB=list_item_16.Item1, Unitize=False)  # -> Vector, Length
vector_2pt_15 = Vector2Pt(PointA=list_item_17.Item, PointB=list_item_17.Item1, Unitize=False)  # -> Vector, Length
vector_2pt_16 = Vector2Pt(PointA=list_item_17.Item2, PointB=list_item_17.Item1, Unitize=False)  # -> Vector, Length
angle_7 = Angle(VectorA=vector_2pt_13.Vector, VectorB=vector_2pt_14.Vector)  # -> Angle, Reflex
angle_8 = Angle(VectorA=vector_2pt_15.Vector, VectorB=vector_2pt_16.Vector)  # -> Angle, Reflex
degrees_7 = Degrees(Radians=angle_7.Angle)
degrees_8 = Degrees(Radians=angle_8.Angle)
right_肘关节夹角 = Panel(degrees_8)
left_肘关节夹角 = Panel(degrees_7)

# ----
dispatch_2 = Dispatch(List=point_in_curve.Point, DispatchPattern=equality.Equality)  # -> ListA, ListB

# ---- group: 范围内人的头映射
point_5 = Point(dispatch_2.ListA)

# ----
list_item_18 = ListItem(List=flatten(point_5), Index=0, Wrap=True)  # -> Item, Item1
line = Line(StartPoint=list_item_18.Item, EndPoint=list_item_18.Item1)
line_2 = Line(StartPoint=list_item_18.Item1, EndPoint=list_item_18.Item)
list_item_19 = ListItem(List=flatten(cluster_3.vector_2), Index=0, Wrap=True)  # -> Item, Item1
vector_display = VectorDisplay(Anchor=list_item_18.Item, Vector=line)
angle_9 = Angle(VectorA=line_2, VectorB=list_item_19.Item1)  # -> Angle, Reflex
angle_10 = Angle(VectorA=line, VectorB=list_item_19.Item)  # -> Angle, Reflex
angle_11 = Angle(VectorA=list_item_19.Item, VectorB=list_item_19.Item1)  # -> Angle, Reflex
degrees_9 = Degrees(Radians=angle_10.Angle)
degrees_10 = Degrees(Radians=angle_11.Angle)
degrees_11 = Degrees(Radians=angle_9.Angle)
阈值角度 = Slider(45, range=0..100)
夹角2 = Panel(degrees_11)
夹角1 = Panel(degrees_9)
夹角 = Panel(degrees_10)
smaller_than = SmallerThan(FirstNumber=夹角2, SecondNumber=阈值角度)  # -> SmallerThan, OrEqualTo
smaller_than_2 = SmallerThan(FirstNumber=夹角1, SecondNumber=阈值角度)  # -> SmallerThan, OrEqualTo
gate_and = GateAnd(A=smaller_than_2.OrEqualTo, B=smaller_than.OrEqualTo)
是否交互 = Panel(gate_and)

list_length = ListLength(List=flatten(point_5))
范围内person_count = Panel(list_length)

addition = Addition(A=right_膝关节夹角, B=left_膝关节夹角)
division = Division(A=addition, B=2)
addition_2 = Addition(A=right_躯干_大腿夹角, B=left_躯干_大腿夹角)
division_2 = Division(A=addition_2, B=2)
addition_3 = Addition(A=right_肘关节夹角, B=left_肘关节夹角)
addition_4 = Addition(A=right_肩部关节夹角, B=left_肩部关节夹角)
ghpython_script = GhPythonScript(x=division)  # -> out, a
# ---------- ghpython_script: Python ----------
__author__ = "Lenovo"
__version__ = "2024.06.30"

import rhinoscriptsyntax as rs
if x:
    a = abs(90-x)/90
# ---------- end ghpython_script ----------
ghpython_script_2 = GhPythonScript(x=division_2)  # -> out, a; same code as ghpython_script
division_3 = Division(A=addition_3, B="360")
division_4 = Division(A=addition_4, B="360")
肩部关节夹角_归一化 = Panel(division_4)
肘关节夹角均值_归一化 = Panel(division_3)
膝关节夹角与90度差_归一化 = Panel(ghpython_script.a)
大腿_躯干与90度差_归一化 = Panel(ghpython_script_2.a)
addition_5 = Addition(A=ghpython_script.a, B=ghpython_script_2.a)
division_5 = Division(A=addition_5, B=2)
addition_6 = Addition(A=肩部关节夹角_归一化, B=肘关节夹角均值_归一化)
division_6 = Division(A=addition_6, B=2)

灵活度_归一化 = Panel(division_5)
思考强度_归一化 = Panel(division_6)

deplane_4 = DeconstructPlane(Plane=rotate_axis.Geometry)  # -> Origin, XAxis, YAxis, ZAxis

# ---- group: 相机位置信息 / 设定线
line_3 = Line()

# ---- group: 相机位置信息
xy_plane = XYPlane(Origin=Point(0, 0, 0))
unit_z = UnitZ(Factor=1)
vector = Vector(deplane_4.XAxis)
vector_2 = Vector(line_3)
vector_3 = Vector(deplane_4.YAxis)
deconstruct = Deconstruct(Point=deplane_4.Origin)  # -> XComponent, YComponent, ZComponent
plane_closest_point = PlaneClosestPoint(Point=deplane_4.Origin, Plane=xy_plane)  # -> Point, UVPoint, Distance
angle_12 = Angle(VectorA=vector, VectorB=vector_2)  # -> Angle, Reflex
angle_13 = Angle(VectorA=vector_3, VectorB=unit_z)  # -> Angle, Reflex
degrees_12 = Degrees(Radians=angle_13.Angle)
degrees_13 = Degrees(Radians=angle_12.Angle)
distance = Distance()
相机高度 = Panel(deconstruct.ZComponent)
pull_point = PullPoint(ClosestOnly=True)  # -> ClosestPoint, Distance
相机水平角度 = Panel(degrees_13)
相机垂直角度 = Panel(degrees_12)

# ----
vector_4 = Vector(rotate_axis.Geometry)

data_recorder = DataRecorder(DataLimit=-10, RecordData=False)  # disabled
number_slider = Slider(3, range=0..100)  # disabled
partition_list_2 = PartitionList(List=data_recorder, Size=number_slider)  # disabled
panel_4 = Panel("0")  # disabled
list_item_20 = ListItem(List=partition_list_2, Index=panel_4, Wrap=True)  # -> flatten(Item); disabled
panel_5 = Panel(partition_list_2)  # disabled
panel_6 = Panel("-1")  # disabled
list_item_21 = ListItem(List=list_item_20, Index=panel_6, Wrap=True)  # disabled
panel_7 = Panel(list_item_21)  # disabled

vector_display_2 = VectorDisplay(Anchor=deplane_4.Origin, Vector=vector_4)
explode_tree_2 = ExplodeTree(Data=simplify(point_5))  # -> Branch0, Branch1
速度_值越大越慢 = Slider(5, range=0..100)
速度_值越大越慢_2 = Slider(5, range=0..100)
速度_值越大越慢_3 = Slider(5, range=0..100)
trigger_2 = Trigger(Interval=200, TimerInterval=200, Target=rec_5)  # disabled
trigger_3 = Trigger(Interval=200, TimerInterval=200, Target=rec_4)  # disabled
trigger_4 = Trigger(Interval=200, TimerInterval=200, Target=rec_6)  # disabled

# ----
# 切换时点击
任务处理3_思维强度_规整度 = Slider(0.477, range=0..1)

# ---- group: 空间形态 / 任务处理模式 高度
# 切换时点击
注意力状态_远端 = Slider(0, range=0..1)

# ---- group: 空间形态 / 任务处理模式 宽度
近端 = Slider(0, range=0..1)
远端 = Slider(0, range=0..1)

# ----
# 切换时点击
任务处理2_灵活度_开放度 = Slider(0.531, range=0..1)

# ---- group: 空间形态 / 任务处理模式 高度
任务处理1_创造性_近端高度 = Slider(0, range=0..1)

# ---- group: 情绪 颜色 / 色相 / joy
number_slider_2 = Slider(0, range=0..1)
swatch = ColourSwatch(SwatchColor=RGB(224, 126, 126))

# ---- group: 情绪 颜色 / 色相 / sorrow
number_slider_3 = Slider(0.01, range=0..1)
swatch_2 = ColourSwatch(SwatchColor=RGB(148, 148, 148))

# ---- group: 情绪 颜色 / 色相 / surprise
number_slider_4 = Slider(0.102, range=0..1)
swatch_3 = ColourSwatch(SwatchColor=RGB(114, 194, 107))

# ---- group: 情绪 颜色 / 色相 / anger
number_slider_5 = Slider(0.686, range=0..1)
# 颜色间隔在后面
swatch_4 = ColourSwatch(SwatchColor=RGB(105, 143, 209))

# ---- group: 情绪 颜色
饱和度 = Slider(-0.033, range=-0.1..0.1)
明度 = Slider(-0.03, range=-0.1..0.1)

# ---- group: 空间形态
# 打开文件时：
# 1、先换一下单一红色的线
# 2、换回来
# 3、点一下recorder×
# 蓝色框为最终效应部分
# 换线的时候记得关一下recorder：
# 1、先点⚪
# 2、换线
# 3、再点×
# 4、再点⚪
# 切换时改z
交往模式 = Slider(1, range=0..1)

# ---- group: 副1
number_slider_6 = Slider(-0.579, range=-3..3)
number_slider_7 = Slider(-0.383, range=-2..2)

# ---- group: 点位置 调试用 主0
number_slider_8 = Slider(0.497, range=-2..2)
number_slider_9 = Slider(0.79, range=-5..5)

# ----
ghpython_script_3 = GhPythonScript(x=任务处理1_创造性_近端高度)  # -> out, a
# ---------- ghpython_script_3: Python ----------
__author__ = "lmh"
__version__ = "2024.06.21"

import rhinoscriptsyntax as rs
if x or x == 0:
    a = x
else:
    a = 0
# ---------- end ghpython_script_3 ----------

# ---- group: 分隔输入 近端高度
panel_8 = Panel("0 to 100")  # disabled
toggle = BooleanToggle(True)  # disabled
速度 = Slider(19, range=0..20)  # disabled
panel_9 = Panel("0")  # disabled
trigger_5 = Trigger(Interval=20, TimerInterval=20, Target=counter_2)  # disabled
dom = ConstructDomain(DomainStart=panel_9, DomainEnd=速度)  # disabled
python = GhPythonScript(x=ghpython_script_3.a)  # -> out, a; disabled
# ---------- python: Python ----------
__author__ = "lmh"
__version__ = "2024.06.20"

import rhinoscriptsyntax as rs
if 0 <= x <= 0.9:
    a = 0
if 0.9 < x <= 0.92:
    a = 0.25
if 0.92 < x <= 0.95:
    a = 0.5
if 0.95 < x <= 0.98:
    a = 0.75
if 0.98 < x <= 1:
    a = 1
# ---------- end python ----------
panel_10 = Panel("-1")  # disabled
panel_11 = Panel("-2")  # disabled
rec = DataRecorder(flatten(python.a), DataLimit=-10, RecordData=True)  # disabled
item = ListItem(List=rec, Index=panel_10, Wrap=True)  # disabled
item_2 = ListItem(List=rec, Index=panel_11, Wrap=True)  # disabled
dcon = DeleteConsecutive(Set=rec, Wrap=False)  # -> Set, Count; disabled
subtraction = Subtraction(A=item, B=item_2)  # disabled
python_2 = GhPythonScript(x=subtraction)  # -> out, a; disabled
# ---------- python_2: Python ----------
__author__ = "lmh"
__version__ = "2024.06.20"

import rhinoscriptsyntax as rs
if x == 0:
    a = 0
else:
    a = 1
# ---------- end python_2 ----------
counter_2 = Counter(CountDirection=True, Step=1, StartStop=toggle, Reset=python_2.a, OptionalCounterDomain=Domain(0, 100))  # disabled
remap = RemapNumbers(Value=counter_2, Source=panel_8, Target=dom)  # -> Mapped, Clipped; disabled
python_3 = GhPythonScript(x=remap.Mapped)  # -> out, a; disabled
# ---------- python_3: Python ----------
__author__ = "lmh"
__version__ = "2024.06.11"

import rhinoscriptsyntax as rs
import math
if 0 <= x <= 1:
    a = (math.cos((x-1) * math.pi) + 1) / 2


if x > 1:
    a = 1
# ---------- end python_3 ----------
panel_12 = Panel("-1")  # disabled
panel_13 = Panel("-2")  # disabled
item_3 = ListItem(List=dcon.Set, Index=panel_12, Wrap=True)  # disabled
item_4 = ListItem(List=dcon.Set, Index=panel_13, Wrap=True)  # disabled
dom_2 = ConstructDomain(DomainStart=item_4, DomainEnd=item_3)  # disabled
remap_2 = RemapNumbers(Value=python_3.a, Source=Domain(0, 1), Target=dom_2)  # -> Mapped, Clipped; disabled

# ----
ghpython_script_4 = GhPythonScript(x=近端)  # -> out, a; same code as ghpython_script_3

ghpython_script_5 = GhPythonScript(x=思考强度_归一化)  # -> out, a
# ---------- ghpython_script_5: Python ----------
__author__ = "lmh"
__version__ = "2024.06.21"

import rhinoscriptsyntax as rs
if x or x == 0:
    a = x
else:
    a = 1
# ---------- end ghpython_script_5 ----------

ghpython_script_6 = GhPythonScript(x=远端)  # -> out, a; same code as ghpython_script_3

ghpython_script_7 = GhPythonScript(x=灵活度_归一化)  # -> out, a; same code as ghpython_script_3

X = UnitX(Factor=number_slider_7)
xy_2 = XYPlane(Origin=Point(0, 0, 0))
Y = UnitY(Factor=number_slider_6)
pt_2 = Point(<point referenced from the Rhino model>)
move = Move(Geometry=pt_2, Motion=X)  # -> Geometry, Transform
Y_2 = UnitY(Factor=number_slider_9)
X_2 = UnitX(Factor=number_slider_8)
# 如果要连间隔输入 连gh python后面
gate_not = GateNot(A=交往模式)
move_2 = Move(Geometry=pt_2, Motion=X_2)  # -> Geometry, Transform

# ---- group: 1
# 切换时点击
move_3 = Move(Geometry=move.Geometry, Motion=Y)  # -> Geometry, Transform

# ---- group: 坐标点替换 0
move_4 = Move(Geometry=move_2.Geometry, Motion=Y_2)  # -> Geometry, Transform

# ----
panel_14 = Panel(move_4.Geometry)
cp = PlaneClosestPoint(Point=move_4.Geometry, Plane=xy_2)  # -> Point, UVPoint, Distance
cp_2 = PlaneClosestPoint(Point=move_3.Geometry, Plane=xy_2)  # -> Point, UVPoint, Distance
points = PointList(Points=flatten([cp.Point, cp_2.Point]), Size=Slider(0.526, range=0..1))

# ---- group: test null
# 修改
# 网格数量
# 高宽阈值
# 进入空间引起高宽变化的范围
# 分隔范围
# 缝隙大小
# 开放度阈值
# 档位调试
# 最终网格
null_empty = Panel("")
python_4 = GhPythonScript(x=null_empty)  # -> out, a
# ---------- python_4: Python ----------
__author__ = "lmh"
__version__ = "2024.06.21"

import rhinoscriptsyntax as rs
if x or x == 0:
    a = x
else:
    a = null
# ---------- end python_4 ----------

# ----
pt_3 = Point(<point referenced from the Rhino model>)
pt_4 = Point(<point referenced from the Rhino model>)
crv_2 = Curve(<curve referenced from the Rhino model>)
crv_3 = Curve(<curve referenced from the Rhino model>)
crv_4 = Curve(<curve referenced from the Rhino model>)
crv_5 = Curve(<curve referenced from the Rhino model>)
crv_6 = Curve(<curve referenced from the Rhino model>)
crv_7 = Curve(<curve referenced from the Rhino model>)
crv_8 = Curve(<curve referenced from the Rhino model>)
crv_9 = Curve(<curve referenced from the Rhino model>)
crv_10 = Curve(<curve referenced from the Rhino model>)
crv_11 = Curve(<curve referenced from the Rhino model>)
crv_cp = CurveClosestPoint(Point=cp.Point, Curve=reparameterize(crv_11))  # -> Point, Parameter, Distance

rec_2 = DataRecorder(crv_cp.Parameter, DataLimit=-10, RecordData=True)
python_5 = GhPythonScript(x=rec_2)  # -> out, a; same code as python_4
null = NullItem(Item=python_5.a)  # -> NullFlags, InvalidFlags, Description
dispatch_3 = Dispatch(List=rec_2, DispatchPattern=null.NullFlags)  # -> ListA, ListB
item_5 = ListItem(List=dispatch_3.ListB, Index="-1", Wrap=True)

crv_12 = Curve(<curve referenced from the Rhino model>)
flip = FlipCurve(Curve=crv_8)  # -> Curve, Flag
flip_2 = FlipCurve(Curve=crv_3)  # -> Curve, Flag
flip_3 = FlipCurve(Curve=crv_9)  # -> Curve, Flag
flip_4 = FlipCurve(Curve=crv_4)  # -> Curve, Flag
flip_5 = FlipCurve(Curve=crv_12)  # -> Curve, Flag
flip_6 = FlipCurve(Curve=crv_10)  # -> Curve, Flag
flip_7 = FlipCurve(Curve=crv_5)  # -> Curve, Flag
vec_3 = Vector(crv_11)
vec_4 = Vector(flip_5.Curve)
expression = Expression(x=item_5, Expression="1-x")

# ---- group: 高度宽度 / 高宽阈值
高度缩小阈值 = Slider(1, range=0..1)
宽度缩小阈值 = Slider(0.76, range=0..1)

# ----
crv_13 = Curve(<curve referenced from the Rhino model>)
crv_14 = Curve(<curve referenced from the Rhino model>)
crv_15 = Curve(<curve referenced from the Rhino model>)
crv_16 = Curve(<curve referenced from the Rhino model>)
crv_17 = Curve(<curve referenced from the Rhino model>)
crv_18 = Curve(<curve referenced from the Rhino model>)
crv_19 = Curve(<curve referenced from the Rhino model>)
crv_20 = Curve(<curve referenced from the Rhino model>)
crv_21 = Curve(<curve referenced from the Rhino model>)
pt_5 = Point(<point referenced from the Rhino model>)
pt_6 = Point(<point referenced from the Rhino model>)
flip_8 = FlipCurve(Curve=crv_15)  # -> Curve, Flag
flip_9 = FlipCurve(Curve=crv_20)  # -> Curve, Flag
flip_10 = FlipCurve(Curve=crv_18)  # -> Curve, Flag
flip_11 = FlipCurve(Curve=crv_21)  # -> Curve, Flag
速度_越大越慢 = Slider(5, range=0..100)

# ---- group: 高度宽度
crv_22 = Curve(<curve referenced from the Rhino model>)

# ---- group: 分隔 / 范围线
crv_23 = Curve(<curve referenced from the Rhino model>)
crv_24 = Curve(<curve referenced from the Rhino model>)

# ----
number_slider_10 = Slider(0, range=0..1)
number_slider_11 = Slider(0.01, range=0..0.01)
number_slider_12 = Slider(0.753, range=0..1)
number_slider_13 = Slider(0.249, range=0..1)
number_slider_14 = Slider(0.757, range=0..1)
subtraction_2 = Subtraction(A=number_slider_14, B=number_slider_11)
expression_2 = Expression(x=number_slider_10, Expression="1-X")
number_slider_15 = Slider(0.01, range=0..0.01)
number_slider_16 = Slider(0.757, range=0..1)
eval = EvaluateCurve(Curve=reparameterize(flip_6.Curve), Parameter=Slider(0.25, range=0..1))  # -> Point, Tangent, Angle
eval_2 = EvaluateCurve(Curve=reparameterize(crv_7), Parameter=number_slider_13)  # -> Point, Tangent, Angle
eval_3 = EvaluateCurve(Curve=reparameterize(crv_7), Parameter=number_slider_13)  # -> Point, Tangent, Angle
eval_4 = EvaluateCurve(Curve=reparameterize(crv_7), Parameter=number_slider_14)  # -> Point, Tangent, Angle
eval_5 = EvaluateCurve(Curve=reparameterize(crv_7), Parameter=number_slider_14)  # -> Point, Tangent, Angle
eval_6 = EvaluateCurve(Curve=reparameterize(crv_7), Parameter=subtraction_2)  # -> Point, Tangent, Angle
eval_7 = EvaluateCurve(Curve=reparameterize(crv_7), Parameter=number_slider_14)  # -> Point, Tangent, Angle
eval_8 = EvaluateCurve(Curve=reparameterize(crv_7), Parameter=subtraction_2)  # -> Point, Tangent, Angle
eval_9 = EvaluateCurve(Curve=reparameterize(flip.Curve), Parameter=number_slider_10)  # -> Point, Tangent, Angle
eval_10 = EvaluateCurve(Curve=reparameterize(crv_6), Parameter=expression_2)  # -> Point, Tangent, Angle
eval_11 = EvaluateCurve(Curve=reparameterize(flip_4.Curve), Parameter=number_slider_10)  # -> Point, Tangent, Angle
eval_12 = EvaluateCurve(Curve=reparameterize(flip_6.Curve), Parameter=number_slider_12)  # -> Point, Tangent, Angle
eval_13 = EvaluateCurve(Curve=reparameterize(flip_6.Curve), Parameter=number_slider_12)  # -> Point, Tangent, Angle
eval_14 = EvaluateCurve(Curve=reparameterize(flip_7.Curve), Parameter=number_slider_10)  # -> Point, Tangent, Angle
eval_15 = EvaluateCurve(Curve=crv_2, Parameter=number_slider_10)  # -> Point, Tangent, Angle
subtraction_3 = Subtraction(A=number_slider_16, B=number_slider_15)
速度_越大越慢_2 = Slider(5, range=0..100)
eval_16 = EvaluateCurve(Curve=reparameterize(crv_14), Parameter=Slider(0.249, range=0..1))  # -> Point, Tangent, Angle
eval_17 = EvaluateCurve(Curve=reparameterize(crv_14), Parameter=number_slider_16)  # -> Point, Tangent, Angle
eval_18 = EvaluateCurve(Curve=reparameterize(crv_14), Parameter=subtraction_3)  # -> Point, Tangent, Angle
eval_19 = EvaluateCurve(Curve=reparameterize(crv_19), Parameter=Slider(0.25, range=0..1))  # -> Point, Tangent, Angle
eval_20 = EvaluateCurve(Curve=reparameterize(crv_19), Parameter=Slider(0.753, range=0..1))  # -> Point, Tangent, Angle
panel_15 = Panel("1")
trigger_6 = Trigger(Interval=200, TimerInterval=200, Target=rec_8)  # disabled
vec2pt = Vector2Pt(PointA=eval_5.Point, PointB=eval_6.Point, Unitize=False)  # -> Vector, Length
vec2pt_2 = Vector2Pt(PointA=eval_5.Point, PointB=eval_6.Point, Unitize=False)  # -> Vector, Length
vec2pt_3 = Vector2Pt(PointA=eval_17.Point, PointB=eval_18.Point, Unitize=False)  # -> Vector, Length

# ---- group: 网格数设定
number_slider_17 = Slider(1, range=0..10)
number_slider_18 = Slider(5, range=0..10)
number_slider_19 = Slider(5, range=0..10)

# ----
number_slider_20 = Slider(0.984, range=0..1)
panel_16 = Panel("1")  # disabled

trigger_7 = Trigger(Interval=1000, TimerInterval=1000, Target=[unityslider, unityslider_2])  # disabled
trigger_8 = Trigger(Interval=1000, TimerInterval=1000, Target=unityslider)  # disabled
unityslider = UnitySlider()  # -> out, HeadPosition, HeadRotation
# ---------- unityslider: C# usings ----------
using Grasshopper.Kernel.Special;
using Grasshopper.GUI.Canvas;
# ---------- unityslider: C# ----------
    Register(Component);
    HeadPosition = temp_positionRhino;
    HeadRotation = temp_rotationRhino;
# ---------- unityslider: C# additional code ----------
  Point3d temp_positionRhino;
  Vector3d temp_rotationRhino;
  void Register(IGH_Component component)
  {
    Rhino.Runtime.HostUtils.RegisterNamedCallback("ToGH_HeadPose", ToGrasshopper);

  }

  void ToGrasshopper(object sender, Rhino.Runtime.NamedParametersEventArgs args)
  {
    Point3d positionRhino;
    Vector3d rotationRhino;
    if(args.TryGetPoint("HeadPosition", out positionRhino))
    {

      args.TryGetVector("HeadRotation", out rotationRhino);
      temp_positionRhino = positionRhino;
      temp_rotationRhino = rotationRhino;
    }
  }
# ---------- end unityslider ----------
unityslider_2 = UnitySlider()  # -> out, StationaryPercentage
# ---------- unityslider_2: C# ----------
    Register(Component);
    StationaryPercentage = temp_stationaryPercentage;
# ---------- unityslider_2: C# additional code ----------
  string temp_stationaryPercentage;

  void Register(IGH_Component component)
  {
    Rhino.Runtime.HostUtils.RegisterNamedCallback("ToGH_StationaryPercentage", ToGrasshopper);
  }

  void ToGrasshopper(object sender, Rhino.Runtime.NamedParametersEventArgs args)
  {
    double percentage;
    if (args.TryGetDouble("StationaryPercentage", out percentage))
    {
      temp_stationaryPercentage = percentage.ToString();
    }
  }
# ---------- end unityslider_2 ----------
vr获取_头部坐标 = Panel(unityslider.HeadPosition)
vr获取_头部向量 = Panel(unityslider.HeadRotation)

remap_numbers = RemapNumbers(Value=unityslider_2.StationaryPercentage, Source="0 to 100", Target=Domain(0, 1))  # -> Mapped, Clipped

注意力状态 = Panel(remap_numbers.Mapped)

ghpython_script_8 = GhPythonScript(x=remap_numbers.Mapped)  # -> out, a; same code as ghpython_script_3

# ----
# 取场景中所有人的表情的均值连这个
# 取场景中戴头显(headwear>threshold)的人
# 的表情的均值连这个
cluster_4 = Cluster_2(data=list_item.Item1)
headset_probability_threshold = Slider(2, range=0..10)

headset = Panel("9")
list_item_22 = ListItem(List=cluster_4, Index=headset, Wrap=True)

emotion = Panel("""1
3
5
7""")
list_item_23 = ListItem(List=cluster_4, Index=emotion, Wrap=True)

larger_than = LargerThan(FirstNumber=list_item_22, SecondNumber=headset_probability_threshold)  # -> LargerThan, OrEqualTo
remap_numbers_2 = RemapNumbers(Value=list_item_23, Source="1 to 5", Target="0.1 to 1")  # -> simplify(Mapped), Clipped
dispatch_4 = Dispatch(List=remap_numbers_2.Mapped, DispatchPattern=larger_than.OrEqualTo)  # -> simplify(ListA), ListB

# ---- group: 求平均
flip_matrix = FlipMatrix(Data=remap_numbers_2.Mapped)
# 特殊情况考虑：
# 没有人或者识别到两个人戴眼镜（去均值）
number = Number(flip_matrix)
average = Average(Input=number)

# ----
list_item_24 = ListItem(List=flatten(average), Index=0, Wrap=True)  # -> Item, Item1, Item2, Item3

# ---- group: emtion
anger = Panel(list_item_24.Item2)
surprise = Panel(list_item_24.Item3)
joy = Panel(list_item_24.Item)
sorrow = Panel(list_item_24.Item1)

# ---- group: 单一红色
joy_2 = Slider(0, range=0..1)
# 切换时点击
python_6 = GhPythonScript(x=joy)  # -> out, a; same code as python_4
swatch_5 = ColourSwatch(SwatchColor=RGB(224, 144, 144))
swatch_6 = ColourSwatch(SwatchColor=RGB(235, 91, 91))
swatch_7 = ColourSwatch(SwatchColor=RGB(240, 194, 194))
swatch_8 = ColourSwatch(SwatchColor=RGB(227, 107, 107))
swatch_9 = ColourSwatch(SwatchColor=RGB(255, 255, 255))

# ----
data_recorder_2 = DataRecorder(flatten(python_6.a), DataLimit=-10, RecordData=True)
null_2 = NullItem(Item=data_recorder_2)  # -> NullFlags, InvalidFlags, Description
panel_17 = Panel(python_6.a)
not = GateNot(A=null_2.NullFlags)
panel_19 = Panel(data_recorder_2)
dispatch_5 = Dispatch(List=data_recorder_2, DispatchPattern=not)  # -> ListA, ListB
list_item_25 = ListItem(List=dispatch_5.ListA, Index="-1", Wrap=True)
python_7 = GhPythonScript(x=list_item_25, w=swatch_9, z1=swatch_7, z2=swatch_5, z3=swatch_8, z4=swatch_6)  # -> out, a
# ---------- python_7: Python ----------
__author__ = "lmh"
__version__ = "2024.06.20"

import rhinoscriptsyntax as rs

if 0 <= x <= 0.2:
    a = w
if 0.2 < x <= 0.4:
    a = z1
if 0.4 < x <= 0.6:
    a = z2
if 0.6 < x <= 0.8:
    a = z3
if 0.8 < x <= 1:
    a = z4
# ---------- end python_7 ----------
panel_20 = Panel(dispatch_5.ListA)
argb = SplitARGB(Colour=python_7.a)  # -> Alpha, Red, Green, Blue
merge = Merge(Data1=argb.Red, Data2=argb.Green, Data3=argb.Blue)

number_slider_21 = Slider(11, range=0..100)
graft = GraftTree(Tree=merge, IncludeEmptyLists=True, IncludeNullItems=True)
toggle_2 = BooleanToggle(True)
rec_3 = DataRecorder(graft, DataLimit=-10, RecordData=True)
trigger_9 = Trigger(Interval=200, TimerInterval=200, Target=rec_3)  # disabled
trigger_10 = Trigger(Interval=20, TimerInterval=20, Target=[counter_5, counter_4, counter_3])  # disabled
item_6 = ListItem(List=rec_3, Index="-2", Wrap=True)  # -> flatten(Item)
item_7 = ListItem(List=rec_3, Index="-1", Wrap=True)  # -> flatten(Item)
dcon_2 = DeleteConsecutive(Set=rec_3, Wrap=False)  # -> Set, Count
subtraction_4 = Subtraction(A=item_7, B=item_6)
abs = Absolute(Value=subtraction_4)
item_8 = ListItem(List=abs, Index=0, Wrap=True)  # -> Item, Item1, Item2
counter_3 = Counter(CountDirection=True, Step=1, StartStop=toggle_2, Reset=item_8.Item2, OptionalCounterDomain=number_slider_21)
counter_4 = Counter(CountDirection=True, Step=1, StartStop=toggle_2, Reset=item_8.Item1, OptionalCounterDomain=number_slider_21)
counter_5 = Counter(CountDirection=True, Step=1, StartStop=toggle_2, Reset=item_8.Item, OptionalCounterDomain=number_slider_21)
item_9 = ListItem(List=dcon_2.Set, Index="-2", Wrap=True)  # -> flatten(Item)
item_10 = ListItem(List=dcon_2.Set, Index="-1", Wrap=True)  # -> flatten(Item)
dom_3 = ConstructDomain(DomainStart=item_9, DomainEnd=item_10)
merge_2 = Merge(Data1=counter_5, Data2=counter_4, Data3=counter_3)
remap_3 = RemapNumbers(Value=merge_2, Source=number_slider_21, Target=Domain(0, 1))  # -> Mapped, Clipped
python_8 = GhPythonScript(x=remap_3.Mapped)  # -> out, a; same code as python_3
remap_4 = RemapNumbers(Value=python_8.a, Source=Domain(0, 1), Target=dom_3)  # -> Mapped, Clipped

item_11 = ListItem(List=remap_4.Mapped, Index=0, Wrap=True)  # -> Item, Item1, Item2
frgb = ColourRGBF(Alpha=1, Red=item_11.Item, Green=item_11.Item1, Blue=item_11.Item2)
ahsv = SplitAHSV(Colour=frgb)  # -> Alpha, Hue, Saturation, Value
addition_7 = Addition(A=ahsv.Saturation, B=饱和度)
addition_8 = Addition(A=ahsv.Value, B=明度)
hsv = ColourHSV(Alpha="1", Hue=ahsv.Hue, Saturation=addition_7, Value=addition_8)

# ---- group: test
geo = Geometry(<brep referenced from the Rhino model>)  # disabled
preview = CustomPreview(Geometry=geo, Material=hsv)  # disabled

# ----
panel_21 = Panel(hsv)
merge_3 = Merge(Data1=flatten(joy), Data2=flatten(sorrow), Data3=flatten(anger), Data4=flatten(surprise))  # disabled

# ---- group: 分隔输入 远端高度
trigger_11 = Trigger(Interval=10, TimerInterval=10, Target=counter_6)  # disabled
python_9 = GhPythonScript(x=ghpython_script_8.a)  # -> out, a
# ---------- python_9: Python ----------
__author__ = "lmh"
__version__ = "2024.06.20"

import rhinoscriptsyntax as rs
if 0 <= x <= 0.25:
    a = 0
if 0.25 < x <= 0.5:
    a = 0.3
if 0.5 < x <= 0.75:
    a = 0.7
if 0.75 < x <= 1:
    a = 1
# ---------- end python_9 ----------

# ----
rec_4 = DataRecorder(python_9.a, DataLimit=-10, RecordData=True)

# ---- group: 分隔输入 远端高度 (continued)
item_12 = ListItem(List=rec_4, Index="-1", Wrap=True)
item_13 = ListItem(List=rec_4, Index="-2", Wrap=True)
subtraction_5 = Subtraction(A=item_12, B=item_13)
dcon_3 = DeleteConsecutive(Set=rec_4, Wrap=False)  # -> Set, Count
python_10 = GhPythonScript(x=subtraction_5)  # -> out, a; same code as python_2
counter_6 = Counter(CountDirection=True, Step=1, StartStop=Toggle(True), Reset=python_10.a, OptionalCounterDomain=速度_值越大越慢_2)
remap_5 = RemapNumbers(Value=counter_6, Source=速度_值越大越慢_2, Target=Domain(0, 1))  # -> Mapped, Clipped
python_11 = GhPythonScript(x=remap_5.Mapped)  # -> out, a; same code as python_3
item_14 = ListItem(List=dcon_3.Set, Index="-1", Wrap=True)
item_15 = ListItem(List=dcon_3.Set, Index="-2", Wrap=True)
dom_4 = ConstructDomain(DomainStart=item_15, DomainEnd=item_14)
remap_6 = RemapNumbers(Value=python_11.a, Source=Domain(0, 1), Target=dom_4)  # -> Mapped, Clipped
panel_22 = Panel(remap_6.Mapped)

# ----
panel_23 = Panel(remap_5.Mapped)
panel_24 = Panel(python_11.a)

# ---- group: 分隔输入 开放度
trigger_12 = Trigger(Interval=10, TimerInterval=10, Target=counter_7)  # disabled
python_12 = GhPythonScript(x=ghpython_script_7.a)  # -> out, a; same code as python_9

# ----
rec_5 = DataRecorder(flatten(python_12.a), DataLimit=-10, RecordData=True)

# ---- group: 分隔输入 开放度 (continued)
item_16 = ListItem(List=rec_5, Index="-1", Wrap=True)
item_17 = ListItem(List=rec_5, Index="-2", Wrap=True)
dcon_4 = DeleteConsecutive(Set=rec_5, Wrap=False)  # -> Set, Count
subtraction_6 = Subtraction(A=item_16, B=item_17)
python_13 = GhPythonScript(x=subtraction_6)  # -> out, a; same code as python_2
counter_7 = Counter(CountDirection=True, Step=1, StartStop=Toggle(True), Reset=python_13.a, OptionalCounterDomain=速度_值越大越慢_3)
remap_7 = RemapNumbers(Value=counter_7, Source=速度_值越大越慢_3, Target=Domain(0, 1))  # -> Mapped, Clipped
python_14 = GhPythonScript(x=remap_7.Mapped)  # -> out, a; same code as python_3
item_18 = ListItem(List=dcon_4.Set, Index="-1", Wrap=True)
item_19 = ListItem(List=dcon_4.Set, Index="-2", Wrap=True)
dom_5 = ConstructDomain(DomainStart=item_19, DomainEnd=item_18)
remap_8 = RemapNumbers(Value=python_14.a, Source=Domain(0, 1), Target=dom_5)  # -> Mapped, Clipped
panel_25 = Panel(remap_8.Mapped)

# ----
panel_26 = Panel(remap_7.Mapped)

# ---- group: 分隔输入 规整度
trigger_13 = Trigger(Interval=10, TimerInterval=10, Target=counter_8)  # disabled
python_15 = GhPythonScript(x=ghpython_script_5.a)  # -> out, a
# ---------- python_15: Python ----------
__author__ = "lmh"
__version__ = "2024.06.20"

import rhinoscriptsyntax as rs
if 0 <= x <= 0.3:
    a = 0
if 0.3 < x <= 0.4:
    a = 0.25
if 0.4 < x <= 0.5:
    a = 0.5
if 0.5 < x <= 0.6:
    a = 0.75
if 0.6 < x <= 1:
    a = 1
# ---------- end python_15 ----------

# ----
rec_6 = DataRecorder(python_15.a, DataLimit=-10, RecordData=True)

# ---- group: 分隔输入 规整度 (continued)
item_20 = ListItem(List=rec_6, Index="-1", Wrap=True)
item_21 = ListItem(List=rec_6, Index="-2", Wrap=True)
subtraction_7 = Subtraction(A=item_20, B=item_21)
python_16 = GhPythonScript(x=subtraction_7)  # -> out, a; same code as python_2
counter_8 = Counter(CountDirection=True, Step=1, StartStop=Toggle(True), Reset=python_16.a, OptionalCounterDomain=速度_值越大越慢)
remap_9 = RemapNumbers(Value=counter_8, Source=速度_值越大越慢, Target=Domain(0, 1))  # -> Mapped, Clipped
python_17 = GhPythonScript(x=remap_9.Mapped)  # -> out, a; same code as python_3
dcon_5 = DeleteConsecutive(Set=rec_6, Wrap=False)  # -> Set, Count
item_22 = ListItem(List=dcon_5.Set, Index="-1", Wrap=True)
item_23 = ListItem(List=dcon_5.Set, Index="-2", Wrap=True)
dom_6 = ConstructDomain(DomainStart=item_23, DomainEnd=item_22)
remap_10 = RemapNumbers(Value=python_17.a, Source=Domain(0, 1), Target=dom_6)  # -> Mapped, Clipped
panel_27 = Panel(remap_10.Mapped)

# ----
panel_28 = Panel(remap_9.Mapped)

panel_30 = Panel(python_15.a)
panel_31 = Panel(remap_2.Mapped)  # disabled

panel_32 = Panel(rec_6)
expression_3 = Expression(x=remap_10.Mapped, Expression="1-x")
expression_4 = Expression(x=remap_10.Mapped, Expression="1-x")
expression_5 = Expression(x=remap_10.Mapped, Expression="1-x")
eval_21 = EvaluateCurve(Curve=reparameterize(flip_3.Curve), Parameter=remap_10.Mapped)  # -> Point, Tangent, Angle
eval_22 = EvaluateCurve(Curve=reparameterize(crv_6), Parameter=expression_3)  # -> Point, Tangent, Angle
eval_23 = EvaluateCurve(Curve=reparameterize(flip_2.Curve), Parameter=remap_10.Mapped)  # -> Point, Tangent, Angle
eval_24 = EvaluateCurve(Curve=reparameterize(flip_4.Curve), Parameter=remap_10.Mapped)  # -> Point, Tangent, Angle
eval_25 = EvaluateCurve(Curve=reparameterize(flip_7.Curve), Parameter=remap_10.Mapped)  # -> Point, Tangent, Angle
eval_26 = EvaluateCurve(Curve=reparameterize(crv_2), Parameter=remap_10.Mapped)  # -> Point, Tangent, Angle
eval_27 = EvaluateCurve(Curve=reparameterize(flip.Curve), Parameter=remap_10.Mapped)  # -> Point, Tangent, Angle
eval_28 = EvaluateCurve(Curve=reparameterize(crv_17), Parameter=expression_4)  # -> Point, Tangent, Angle
eval_29 = EvaluateCurve(Curve=reparameterize(crv_16), Parameter=expression_4)  # -> Point, Tangent, Angle
eval_30 = EvaluateCurve(Curve=reparameterize(flip_8.Curve), Parameter=remap_10.Mapped)  # -> Point, Tangent, Angle
eval_31 = EvaluateCurve(Curve=reparameterize(crv_13), Parameter=expression_5)  # -> Point, Tangent, Angle
eval_32 = EvaluateCurve(Curve=reparameterize(flip_10.Curve), Parameter=remap_10.Mapped)  # -> Point, Tangent, Angle
eval_33 = EvaluateCurve(Curve=reparameterize(flip_9.Curve), Parameter=remap_10.Mapped)  # -> Point, Tangent, Angle
eval_34 = EvaluateCurve(Curve=reparameterize(flip_11.Curve), Parameter=remap_10.Mapped)  # -> Point, Tangent, Angle
ln = Line(StartPoint=eval_21.Point, EndPoint=eval_23.Point)
amp = Amplitude(Vector=ln, Amplitude=number_slider_11)
ln_2 = Line(StartPoint=eval_23.Point, EndPoint=pt_3)
amp_2 = Amplitude(Vector=ln_2, Amplitude=number_slider_11)
move_5 = Move(Geometry=pt_4, Motion=amp)  # -> Geometry, Transform
move_6 = Move(Geometry=eval_23.Point, Motion=amp_2)  # -> Geometry, Transform
move_7 = Move(Geometry=pt_3, Motion=amp_2)  # -> Geometry, Transform
move_8 = Move(Geometry=eval_21.Point, Motion=amp)  # -> Geometry, Transform
move_9 = Move(Geometry=eval_23.Point, Motion=expr("-x", amp))  # -> Geometry, Transform
move_10 = Move(Geometry=move_5.Geometry, Motion=amp)  # -> Geometry, Transform
move_11 = Move(Geometry=move_6.Geometry, Motion=amp_2)  # -> Geometry, Transform
move_12 = Move(Geometry=pt_3, Motion=expr("-x", amp_2))  # -> Geometry, Transform
ln_3 = Line(StartPoint=eval_29.Point, EndPoint=eval_28.Point)
amp_3 = Amplitude(Vector=ln_3, Amplitude=number_slider_15)
move_13 = Move(Geometry=eval_29.Point, Motion=amp_3)  # -> Geometry, Transform
move_14 = Move(Geometry=eval_28.Point, Motion=expr("-x", amp_3))  # -> Geometry, Transform
ln_4 = Line(StartPoint=eval_28.Point, EndPoint=pt_6)
amp_4 = Amplitude(Vector=ln_4, Amplitude=number_slider_15)
move_15 = Move(Geometry=pt_6, Motion=amp_4)  # -> Geometry, Transform
move_16 = Move(Geometry=eval_28.Point, Motion=amp_4)  # -> Geometry, Transform
move_17 = Move(Geometry=pt_5, Motion=amp_3)  # -> Geometry, Transform
move_18 = Move(Geometry=pt_6, Motion=expr("-x", amp_4))  # -> Geometry, Transform
move_19 = Move(Geometry=move_17.Geometry, Motion=amp_3)  # -> Geometry, Transform
move_20 = Move(Geometry=move_16.Geometry, Motion=amp_4)  # -> Geometry, Transform

# ---- group: 高度宽度
ln_5 = Line(StartPoint=eval_15.Point, EndPoint=eval_13.Point)
amp_5 = Amplitude(Vector=ln_5, Amplitude=Slider(0.17, range=0..1))
dom_7 = ConstructDomain(DomainStart="0", DomainEnd=高度缩小阈值)
dom_8 = ConstructDomain(DomainStart="0", DomainEnd=宽度缩小阈值)
remap_11 = RemapNumbers(Value=ghpython_script_3.a, Source=Domain(0, 1), Target=dom_7)  # -> Mapped, Clipped
remap_12 = RemapNumbers(Value=remap_6.Mapped, Source=Domain(0, 1), Target=dom_7)  # -> Mapped, Clipped
merge_4 = Merge(
    Data1=eval_15.Point,
    Data2=eval_13.Point,
    Data3=eval_14.Point,
    Data4=eval.Point,
    Data5=eval_11.Point,
    Data6=eval_2.Point,
    Data7=eval_10.Point,
    Data8=eval_7.Point,
    Data9=eval_9.Point)
remap_13 = RemapNumbers(Value=ghpython_script_4.a, Source=Domain(0, 1), Target=dom_8)  # -> Mapped, Clipped
remap_14 = RemapNumbers(Value=ghpython_script_6.a, Source=Domain(0, 1), Target=dom_8)  # -> Mapped, Clipped
panel_33 = Panel("""0
1
2
3
4
5
6
7
8""")
toggle_3 = BooleanToggle(True)
incurve = PointInCurve(Point=cp.Point, Curve=crv_22)  # -> Relationship, Point
trigger_14 = Trigger(
    Interval=20,
    TimerInterval=20,
    Target=[counter_9, counter_10, counter_11, counter_12, counter_13, counter_16, counter_14, counter_15, counter_17])  # disabled
merge_5 = Merge(Data1="1", Data2="1", Data3="1", Data4="1", Data5="1", Data6="2", Data7="2", Data8="2", Data9="2")
python_18 = GhPythonScript(x=incurve.Relationship, y=merge_5)  # -> out, a
# ---------- python_18: Python ----------
__author__ = "lmh"
__version__ = "2024.06.17"

import rhinoscriptsyntax as rs
if x == 1 or x == 2:
    a = y
else:
    a = 0
# ---------- end python_18 ----------
panel_34 = Panel("""0
0
0
0
0
0
0
0
0""")
trigger_15 = Trigger(Interval=200, TimerInterval=200, Target=rec_7)  # disabled

# ----
move_21 = Move(Geometry=merge_4, Motion=amp_5)  # -> Geometry, Transform

# ---- group: 高度宽度 (continued)
dist = Distance(PointA=move_21.Geometry, PointB=cp.Point)
sort = SortList(Keys=dist)  # -> Keys, ValuesA
item_24 = ListItem(List=sort.Keys, Index=panel_33, Wrap=True)
mindex = MemberIndex(Set=dist, Member=item_24)  # -> flatten(Index), Count
replace = ReplaceItems(List=panel_34, Item=python_18.a, Indices=mindex.Index, Wrap=False)
graft_2 = GraftTree(Tree=replace, IncludeEmptyLists=True, IncludeNullItems=True)

# ----
rec_7 = DataRecorder(graft_2, DataLimit=-10, RecordData=True)

# ---- group: 高度宽度 (continued)
item_25 = ListItem(List=rec_7, Index="-2", Wrap=True)  # -> flatten(Item)
item_26 = ListItem(List=rec_7, Index="-1", Wrap=True)  # -> flatten(Item)
subtraction_8 = Subtraction(A=item_26, B=item_25)
python_19 = GhPythonScript(x=subtraction_8)  # -> out, a
# ---------- python_19: Python ----------
__author__ = "lmh"
__version__ = "2024.06.10"

import rhinoscriptsyntax as rs
if x == 0:
    a = 0
else:
    a = 1
# ---------- end python_19 ----------
item_27 = ListItem(List=python_19.a, Index=0, Wrap=True)  # -> Item, Item1, Item2, Item3, Item4, Item5, Item6, Item7, Item8
counter_9 = Counter(CountDirection=True, Step=1, StartStop=toggle_3, Reset=item_27.Item, OptionalCounterDomain=速度_越大越慢)
counter_10 = Counter(CountDirection=True, Step=1, StartStop=toggle_3, Reset=item_27.Item1, OptionalCounterDomain=速度_越大越慢)
counter_11 = Counter(CountDirection=True, Step=1, StartStop=toggle_3, Reset=item_27.Item2, OptionalCounterDomain=速度_越大越慢)
counter_12 = Counter(CountDirection=True, Step=1, StartStop=toggle_3, Reset=item_27.Item3, OptionalCounterDomain=速度_越大越慢)
counter_13 = Counter(CountDirection=True, Step=1, StartStop=toggle_3, Reset=item_27.Item4, OptionalCounterDomain=速度_越大越慢)
counter_14 = Counter(CountDirection=True, Step=1, StartStop=toggle_3, Reset=item_27.Item6, OptionalCounterDomain=速度_越大越慢)
counter_15 = Counter(CountDirection=True, Step=1, StartStop=toggle_3, Reset=item_27.Item7, OptionalCounterDomain=速度_越大越慢)
counter_16 = Counter(CountDirection=True, Step=1, StartStop=toggle_3, Reset=item_27.Item5, OptionalCounterDomain=速度_越大越慢)
counter_17 = Counter(CountDirection=True, Step=1, StartStop=toggle_3, Reset=item_27.Item8, OptionalCounterDomain=速度_越大越慢)
merge_6 = Merge(
    Data1=counter_9,
    Data2=counter_10,
    Data3=counter_11,
    Data4=counter_12,
    Data5=counter_13,
    Data6=counter_16,
    Data7=counter_14,
    Data8=counter_15,
    Data9=counter_17)
dcon_6 = DeleteConsecutive(Set=rec_7, Wrap=False)  # -> Set, Count
item_28 = ListItem(List=dcon_6.Set, Index="-1", Wrap=True)
item_29 = ListItem(List=dcon_6.Set, Index="-2", Wrap=True)
remap_15 = RemapNumbers(Value=merge_6, Source=速度_越大越慢, Target=Domain(0, 1))  # -> Mapped, Clipped
python_20 = GhPythonScript(x=item_29, y=remap_13.Mapped, z=remap_14.Mapped)  # -> out, a; inputs x: Int32
# ---------- python_20: Python ----------
__author__ = "lmh"
__version__ = "2024.06.15"

import rhinoscriptsyntax as rs
if x == 1:
    a = y
if x == 2:
    a = z
if x == 0:
    a = 0
# ---------- end python_20 ----------
python_21 = GhPythonScript(x=remap_15.Mapped)  # -> out, a; same code as python_3
python_22 = GhPythonScript(x=item_28, y=remap_13.Mapped, z=remap_14.Mapped)  # -> out, a; inputs x: Int32; same code as python_20
dom_9 = ConstructDomain(DomainStart=python_20.a, DomainEnd=python_22.a)  # -> flatten(Domain)
remap_16 = RemapNumbers(Value=python_21.a, Source=Domain(0, 1), Target=dom_9)  # -> Mapped, Clipped
multiplication = Multiplication(A=remap_16.Mapped, B=item_5)
multiplication_2 = Multiplication(A=remap_16.Mapped, B=expression)
python_23 = GhPythonScript(x=item_29, y=remap_11.Mapped, z=remap_12.Mapped)  # -> out, a; inputs x: Int32; same code as python_20
item_30 = ListItem(List=multiplication, Index=0, Wrap=True)  # -> Item, Item1, Item2, Item3, Item4, Item5, Item6, Item7, Item8
item_31 = ListItem(List=multiplication_2, Index=0, Wrap=True)  # -> Item, Item1, Item2, Item3, Item4, Item5, Item6, Item7, Item8
python_24 = GhPythonScript(x=item_28, y=remap_11.Mapped, z=remap_12.Mapped)  # -> out, a; inputs x: Int32; same code as python_20
dom_10 = ConstructDomain(DomainStart=python_23.a, DomainEnd=python_24.a)  # -> flatten(Domain)
remap_17 = RemapNumbers(Value=python_21.a, Source=Domain(0, 1), Target=dom_10)  # -> Mapped, Clipped
item_32 = ListItem(List=remap_17.Mapped, Index=0, Wrap=True)  # -> Item, Item1, Item2, Item3, Item4, Item5, Item6, Item7, Item8

# ----
amp_6 = Amplitude(Vector=vec_3, Amplitude=item_30.Item6)
amp_7 = Amplitude(Vector=vec_4, Amplitude=item_30.Item7)
amp_8 = Amplitude(Vector=vec_3, Amplitude=item_30.Item8)
Z = UnitZ(Factor=item_32.Item7)  # -> expr("-x", UnitVector)
amp_9 = Amplitude(Vector=vec_3, Amplitude=item_30.Item4)
Z_2 = UnitZ(Factor=item_32.Item6)  # -> expr("-x", UnitVector)
Z_3 = UnitZ(Factor=item_32.Item4)  # -> expr("-x", UnitVector)
move_22 = Move(Geometry=eval_8.Point, Motion=amp_7)  # -> Geometry, Transform
Z_4 = UnitZ(Factor=item_32.Item5)  # -> expr("-x", UnitVector)
amp_10 = Amplitude(Vector=vec_4, Amplitude=item_30.Item3)
amp_11 = Amplitude(Vector=vec_4, Amplitude=item_30.Item1)
move_23 = Move(Geometry=eval_22.Point, Motion=amp_6)  # -> Geometry, Transform
move_24 = Move(Geometry=eval_24.Point, Motion=amp_9)  # -> Geometry, Transform
move_25 = Move(Geometry=eval.Point, Motion=amp_10)  # -> Geometry, Transform
Z_5 = UnitZ(Factor=item_32.Item8)  # -> expr("-x", UnitVector)
Z_6 = UnitZ(Factor=item_32.Item3)  # -> expr("-x", UnitVector)
move_26 = Move(Geometry=move_22.Geometry, Motion=Z)  # -> Geometry, Transform
move_27 = Move(Geometry=eval_27.Point, Motion=amp_8)  # -> Geometry, Transform
amp_12 = Amplitude(Vector=vec_4, Amplitude=item_30.Item5)
amp_13 = Amplitude(Vector=vec_3, Amplitude=item_30.Item2)
Z_7 = UnitZ(Factor=item_32.Item)  # -> expr("-x", UnitVector)
move_28 = Move(Geometry=eval_25.Point, Motion=amp_13)  # -> Geometry, Transform
move_29 = Move(Geometry=eval_12.Point, Motion=amp_11)  # -> Geometry, Transform
move_30 = Move(Geometry=eval_3.Point, Motion=amp_12)  # -> Geometry, Transform
move_31 = Move(Geometry=move_26.Geometry, Motion=expr("-x", vec2pt.Vector))  # -> Geometry, Transform
move_32 = Move(Geometry=move_27.Geometry, Motion=Z_5)  # -> Geometry, Transform
Z_8 = UnitZ(Factor=item_32.Item1)  # -> expr("-x", UnitVector)
move_33 = Move(Geometry=move_29.Geometry, Motion=Z_8)  # -> Geometry, Transform
amp_14 = Amplitude(Vector=vec_3, Amplitude=item_31.Item4)  # -> expr("-x", Vector)
move_34 = Move(Geometry=move_25.Geometry, Motion=Z_6)  # -> Geometry, Transform
amp_15 = Amplitude(Vector=vec_3, Amplitude=item_30.Item)
move_35 = Move(Geometry=eval_32.Point, Motion=amp_14)  # -> Geometry, Transform
amp_16 = Amplitude(Vector=vec_3, Amplitude=item_31.Item6)  # -> expr("-x", Vector)
amp_17 = Amplitude(Vector=vec_3, Amplitude=item_31.Item8)  # -> expr("-x", Vector)
Z_9 = UnitZ(Factor=item_32.Item2)  # -> expr("-x", UnitVector)
amp_18 = Amplitude(Vector=flip_5.Curve, Amplitude=item_31.Item5)  # -> expr("-x", Vector)
move_36 = Move(Geometry=eval_34.Point, Motion=amp_17)  # -> Geometry, Transform
move_37 = Move(Geometry=eval_26.Point, Motion=amp_15)  # -> Geometry, Transform
move_38 = Move(Geometry=move_37.Geometry, Motion=Z_7)  # -> Geometry, Transform
move_39 = Move(Geometry=eval_19.Point, Motion=amp_18)  # -> Geometry, Transform
amp_19 = Amplitude(Vector=flip_5.Curve, Amplitude=item_31.Item3)  # -> expr("-x", Vector)
amp_20 = Amplitude(Vector=vec_3, Amplitude=item_31.Item2)  # -> expr("-x", Vector)
amp_21 = Amplitude(Vector=flip_5.Curve, Amplitude=item_31.Item7)  # -> expr("-x", Vector)
move_40 = Move(Geometry=eval_31.Point, Motion=amp_20)  # -> Geometry, Transform
move_41 = Move(Geometry=eval_33.Point, Motion=amp_16)  # -> Geometry, Transform
move_42 = Move(Geometry=eval_20.Point, Motion=amp_21)  # -> Geometry, Transform
amp_22 = Amplitude(Vector=flip_5.Curve, Amplitude=item_31.Item1)  # -> expr("-x", Vector)
move_43 = Move(Geometry=eval_16.Point, Motion=amp_19)  # -> Geometry, Transform
amp_23 = Amplitude(Vector=vec_3, Amplitude=item_31.Item)  # -> expr("-x", Vector)
move_44 = Move(Geometry=eval_17.Point, Motion=amp_22)  # -> Geometry, Transform
move_45 = Move(Geometry=move_32.Geometry, Motion=expr("-x", amp))  # -> Geometry, Transform
move_46 = Move(Geometry=eval_30.Point, Motion=amp_23)  # -> Geometry, Transform
Z_10 = UnitZ(Factor=item_32.Item)  # -> expr("-x", UnitVector)
move_47 = Move(Geometry=move_46.Geometry, Motion=Z_10)  # -> Geometry, Transform
Z_11 = UnitZ(Factor=item_32.Item1)  # -> expr("-x", UnitVector)
move_48 = Move(Geometry=move_44.Geometry, Motion=Z_11)  # -> Geometry, Transform
move_49 = Move(Geometry=move_48.Geometry, Motion=vec2pt_3.Vector)  # -> Geometry, Transform
Z_12 = UnitZ(Factor=item_32.Item2)  # -> expr("-x", UnitVector)
Z_13 = UnitZ(Factor=item_32.Item3)  # -> expr("-x", UnitVector)
Z_14 = UnitZ(Factor=item_32.Item5)  # -> expr("-x", UnitVector)
Z_15 = UnitZ(Factor=item_32.Item7)  # -> expr("-x", UnitVector)
Z_16 = UnitZ(Factor=item_32.Item8)  # -> expr("-x", UnitVector)
move_50 = Move(Geometry=move_39.Geometry, Motion=Z_14)  # -> Geometry, Transform
Z_17 = UnitZ(Factor=item_32.Item4)  # -> expr("-x", UnitVector)
Z_18 = UnitZ(Factor=item_32.Item6)  # -> expr("-x", UnitVector)
move_51 = Move(Geometry=move_42.Geometry, Motion=Z_15)  # -> Geometry, Transform
move_52 = Move(Geometry=move_36.Geometry, Motion=Z_16)  # -> Geometry, Transform
move_53 = Move(Geometry=move_28.Geometry, Motion=Z_9)  # -> Geometry, Transform
move_54 = Move(Geometry=move_53.Geometry, Motion=vec2pt_2.Vector)  # -> Geometry, Transform
move_55 = Move(Geometry=move_40.Geometry, Motion=Z_12)  # -> Geometry, Transform
move_56 = Move(Geometry=move_23.Geometry, Motion=Z_2)  # -> Geometry, Transform
move_57 = Move(Geometry=move_41.Geometry, Motion=Z_18)  # -> Geometry, Transform
move_58 = Move(Geometry=move_57.Geometry, Motion=vec2pt_3.Vector)  # -> Geometry, Transform
move_59 = Move(Geometry=move_57.Geometry, Motion=expr("-x", vec2pt_3.Vector))  # -> Geometry, Transform

# ---- group: 分隔
move_60 = Move(Geometry=move_30.Geometry, Motion=Z_4)  # -> Geometry, Transform
move_61 = Move(Geometry=move_43.Geometry, Motion=Z_13)  # -> Geometry, Transform
pt_7 = Point(move_9.Geometry)
pt_8 = Point(move_14.Geometry)
ln_6 = Line(StartPoint=move_60.Geometry, EndPoint=pt_7)
ln_7 = Line(StartPoint=move_61.Geometry, EndPoint=pt_8)
vec_5 = Vector(ln_6)
vec_6 = Vector(ln_7)
分隔离地面的高度 = Slider(0.3, range=0..1)
move_62 = Move(Geometry=move_24.Geometry, Motion=Z_3)  # -> Geometry, Transform
move_63 = Move(Geometry=move_35.Geometry, Motion=Z_17)  # -> Geometry, Transform
merge_7 = Merge(Data1=flatten(cp.Point), Data2=flatten(cp_2.Point))
pt_9 = Point(eval_28.Point)
pt_10 = Point(eval_23.Point)
merge_8 = Merge(Data1=crv_23, Data2=crv_24)
ln_8 = Line(StartPoint=move_63.Geometry, EndPoint=pt_9)
pt_11 = ConstructPoint(XCoordinate="0", YCoordinate="0", ZCoordinate=分隔离地面的高度)
incurves = PointInCurves(Point=merge_7, Curves=merge_8)  # -> Relationship, Index, Point
ln_9 = Line(StartPoint=pt_10, EndPoint=move_62.Geometry)
xy_3 = XYPlane(Origin=pt_11)
plx = LinePlane(Line=ln_6, Plane=xy_3)  # -> Point, ParamL, ParamP
plx_2 = LinePlane(Line=ln_7, Plane=xy_3)  # -> Point, ParamL, ParamP
dist_2 = Distance(PointA=move_60.Geometry, PointB=plx.Point)
dist_3 = Distance(PointA=move_61.Geometry, PointB=plx_2.Point)
pdecon = Deconstruct(Point=move_63.Geometry)  # -> XComponent, YComponent, ZComponent
vec_7 = Vector(ln_8)
item_33 = ListItem(List=incurves.Index, Index=0, Wrap=True)  # -> Item, Item1
panel_35 = Panel(incurves.Relationship)
item_34 = ListItem(List=incurves.Relationship, Index=0, Wrap=True)  # -> Item, Item1
plx_3 = LinePlane(Line=ln_8, Plane=xy_3)  # -> Point, ParamL, ParamP
vec_8 = Vector(ln_9)
subtraction_9 = Subtraction(A=pdecon.ZComponent, B=分隔离地面的高度)
dist_4 = Distance(PointA=move_63.Geometry, PointB=plx_3.Point)
trigger_16 = Trigger(Interval=20, TimerInterval=20, Target=counter_18)  # disabled
plx_4 = LinePlane(Line=ln_9, Plane=xy_3)  # -> Point, ParamL, ParamP
dist_5 = Distance(PointA=move_62.Geometry, PointB=plx_4.Point)
python_25 = GhPythonScript(x1=item_34.Item, x2=item_34.Item1, y1=item_33.Item, y2=item_33.Item1)  # -> out, a
# ---------- python_25: Python ----------
__author__ = "lmh"
__version__ = "2024.06.14"

import rhinoscriptsyntax as rs
if x1 == 2 and x2 == 2 and y1 != y2:
    a = 1
else:
    a = 0
# ---------- end python_25 ----------

# ----
panel_36 = Panel(python_25.a)

# ---- group: 分隔 / 接z
python_26 = GhPythonScript(separation=python_25.a, interaction=gate_not, z=Slider(2, range=0..10))  # -> out, a; inputs separation: Int32, interaction: Boolean, z: Int32
# ---------- python_26: Python ----------
__author__ = "lmh"
__version__ = "2024.06.11"

import rhinoscriptsyntax as rs
if separation == 1 and z == 2 and interaction:
    a = 1
else:
    a = 0
# ---------- end python_26 ----------

# ----
panel_38 = Panel(python_26.a)

# ---- group: 分隔 (continued)
rec_8 = DataRecorder(flatten(python_26.a), DataLimit=-10, RecordData=True)
item_35 = ListItem(List=rec_8, Index="-2", Wrap=True)  # -> flatten(Item)
item_36 = ListItem(List=rec_8, Index="-1", Wrap=True)  # -> flatten(Item)
subtraction_10 = Subtraction(A=item_36, B=item_35)
abs_2 = Absolute(Value=subtraction_10)
counter_18 = Counter(CountDirection=True, Step=1, StartStop=Toggle(True), Reset=abs_2, OptionalCounterDomain=速度_越大越慢_2)
remap_18 = RemapNumbers(Value=counter_18, Source=速度_越大越慢_2, Target=Domain(0, 1))  # -> Mapped, Clipped
python_27 = GhPythonScript(x=remap_18.Mapped)  # -> out, a; same code as python_3
dcon_7 = DeleteConsecutive(Set=rec_8, Wrap=False)  # -> Set, Count
item_37 = ListItem(List=dcon_7.Set, Index="-1", Wrap=True)  # -> flatten(Item)
item_38 = ListItem(List=dcon_7.Set, Index="-2", Wrap=True)  # -> flatten(Item)
dom_11 = ConstructDomain(DomainStart=item_38, DomainEnd=item_37)
remap_19 = RemapNumbers(Value=python_27.a, Source=Domain(0, 1), Target=dom_11)  # -> Mapped, Clipped
remap_20 = RemapNumbers(Value=remap_19.Mapped, Source=Domain(0, 1), Target=dist_2)  # -> Mapped, Clipped
amp_24 = Amplitude(Vector=vec_5, Amplitude=remap_20.Mapped)
remap_21 = RemapNumbers(Value=remap_19.Mapped, Source=Domain(0, 1), Target=dist_3)  # -> Mapped, Clipped
amp_25 = Amplitude(Vector=vec_6, Amplitude=remap_21.Mapped)
move_64 = Move(Geometry=move_61.Geometry, Motion=amp_25)  # -> Geometry, Transform
move_65 = Move(Geometry=move_60.Geometry, Motion=amp_24)  # -> Geometry, Transform
remap_22 = RemapNumbers(Value=remap_19.Mapped, Source=Domain(0, 1), Target=subtraction_9)  # -> Mapped, Clipped
remap_23 = RemapNumbers(Value=remap_19.Mapped, Source=Domain(0, 1), Target=dist_5)  # -> Mapped, Clipped
amp_26 = Amplitude(Vector=vec_8, Amplitude=remap_23.Mapped)
remap_24 = RemapNumbers(Value=remap_19.Mapped, Source=Domain(0, 1), Target=dist_4)  # -> Mapped, Clipped
amp_27 = Amplitude(Vector=vec_7, Amplitude=remap_24.Mapped)
move_66 = Move(Geometry=move_62.Geometry, Motion=expr("-x", amp_26))  # -> Geometry, Transform
move_67 = Move(Geometry=move_63.Geometry, Motion=amp_27)  # -> Geometry, Transform

# ----
panel_39 = Panel(rec_8)
move_68 = Move(Geometry=move_65.Geometry, Motion=vec2pt.Vector)  # -> Geometry, Transform
move_69 = Move(Geometry=move_66.Geometry, Motion=vec2pt_2.Vector)  # -> Geometry, Transform
move_70 = Move(Geometry=move_66.Geometry, Motion=expr("-x", vec2pt_2.Vector))  # -> Geometry, Transform
move_71 = Move(Geometry=move_64.Geometry, Motion=vec2pt_3.Vector)  # -> Geometry, Transform

number_slider_22 = Slider(5, range=0..10)
number_slider_23 = Slider(1, range=0..10)
move_72 = Move(Geometry=move_47.Geometry, Motion=expr("-x", amp_3))  # -> Geometry, Transform
move_73 = Move(Geometry=move_47.Geometry, Motion=amp_3)  # -> Geometry, Transform
move_74 = Move(Geometry=move_53.Geometry, Motion=expr("-x", vec2pt_2.Vector))  # -> Geometry, Transform
move_75 = Move(Geometry=move_67.Geometry, Motion=amp_3)  # -> Geometry, Transform
move_76 = Move(Geometry=move_55.Geometry, Motion=amp_3)  # -> Geometry, Transform
move_77 = Move(Geometry=move_67.Geometry, Motion=expr("-x", amp_3))  # -> Geometry, Transform
move_78 = Move(Geometry=move_56.Geometry, Motion=amp)  # -> Geometry, Transform
move_79 = Move(Geometry=move_56.Geometry, Motion=expr("-x", amp))  # -> Geometry, Transform
move_80 = Move(Geometry=move_55.Geometry, Motion=expr("-x", amp_3))  # -> Geometry, Transform
move_81 = Move(Geometry=move_32.Geometry, Motion=amp)  # -> Geometry, Transform
srf4pt = _4PointSurface(CornerA=move_31.Geometry, CornerB=move_32.Geometry, CornerC=eval_21.Point, CornerD=move_8.Geometry)
srf4pt_2 = _4PointSurface(CornerA=pt_4, CornerB=move_8.Geometry, CornerC=move_31.Geometry, CornerD=move_26.Geometry)
srf4pt_3 = _4PointSurface(CornerA=move_56.Geometry, CornerB=move_26.Geometry, CornerC=pt_4, CornerD=move_5.Geometry)
srf4pt_4 = _4PointSurface(CornerA=move_56.Geometry, CornerB=move_65.Geometry, CornerC=move_10.Geometry, CornerD=move_5.Geometry)
srf4pt_5 = _4PointSurface(CornerA=move_9.Geometry, CornerB=move_10.Geometry, CornerC=move_65.Geometry, CornerD=move_68.Geometry)
srf4pt_6 = _4PointSurface(CornerA=move_66.Geometry, CornerB=move_68.Geometry, CornerC=move_9.Geometry, CornerD=eval_23.Point)
srf4pt_7 = _4PointSurface(CornerA=move_66.Geometry, CornerB=move_34.Geometry, CornerC=move_6.Geometry, CornerD=eval_23.Point)
srf4pt_8 = _4PointSurface(CornerA=move_53.Geometry, CornerB=move_34.Geometry, CornerC=move_6.Geometry, CornerD=move_11.Geometry)
srf4pt_9 = _4PointSurface(CornerA=move_11.Geometry, CornerB=move_12.Geometry, CornerC=move_54.Geometry, CornerD=move_53.Geometry)
srf4pt_10 = _4PointSurface(CornerA=move_54.Geometry, CornerB=move_33.Geometry, CornerC=pt_3, CornerD=move_12.Geometry)
srf4pt_11 = _4PointSurface(CornerA=move_38.Geometry, CornerB=move_33.Geometry, CornerC=pt_3, CornerD=move_7.Geometry)
srf4pt_12 = _4PointSurface(CornerA=move_52.Geometry, CornerB=move_51.Geometry, CornerC=pt_6, CornerD=move_15.Geometry)
srf4pt_13 = _4PointSurface(CornerA=move_55.Geometry, CornerB=move_64.Geometry, CornerC=move_19.Geometry, CornerD=move_17.Geometry)
srf4pt_14 = _4PointSurface(CornerA=move_14.Geometry, CornerB=move_19.Geometry, CornerC=move_64.Geometry, CornerD=move_71.Geometry)
srf4pt_15 = _4PointSurface(CornerA=move_67.Geometry, CornerB=move_50.Geometry, CornerC=move_16.Geometry, CornerD=eval_28.Point)
srf4pt_16 = _4PointSurface(CornerA=move_57.Geometry, CornerB=move_50.Geometry, CornerC=move_16.Geometry, CornerD=move_20.Geometry)
srf4pt_17 = _4PointSurface(CornerA=move_20.Geometry, CornerB=move_18.Geometry, CornerC=move_58.Geometry, CornerD=move_57.Geometry)
srf4pt_18 = _4PointSurface(CornerA=move_58.Geometry, CornerB=move_51.Geometry, CornerC=pt_6, CornerD=move_18.Geometry)
srf4pt_19 = _4PointSurface(CornerA=move_67.Geometry, CornerB=move_71.Geometry, CornerC=move_14.Geometry, CornerD=eval_28.Point)
srf4pt_20 = _4PointSurface(CornerA=move_48.Geometry, CornerB=move_47.Geometry, CornerC=eval_29.Point, CornerD=move_13.Geometry)
srf4pt_21 = _4PointSurface(CornerA=pt_5, CornerB=move_13.Geometry, CornerC=move_48.Geometry, CornerD=move_49.Geometry)
srf4pt_22 = _4PointSurface(CornerA=move_55.Geometry, CornerB=move_49.Geometry, CornerC=pt_5, CornerD=move_17.Geometry)
mesh_uv = MeshSurface(Surface=srf4pt_5, UCount=number_slider_17, VCount=number_slider_18, Overhang=True, Equalize=False)
mesh_uv_2 = MeshSurface(Surface=srf4pt_6, UCount=number_slider_17, VCount=number_slider_18, Overhang=True, Equalize=False)
srf4pt_23 = _4PointSurface(CornerA=move_73.Geometry, CornerB=move_49.Geometry, CornerC=move_53.Geometry, CornerD=move_54.Geometry)
srf4pt_24 = _4PointSurface(CornerA=move_74.Geometry, CornerB=move_53.Geometry, CornerC=move_49.Geometry, CornerD=move_80.Geometry)
srf4pt_25 = _4PointSurface(CornerA=move_80.Geometry, CornerB=move_55.Geometry, CornerC=move_34.Geometry, CornerD=move_74.Geometry)
srf4pt_26 = _4PointSurface(CornerA=move_76.Geometry, CornerB=move_55.Geometry, CornerC=move_34.Geometry, CornerD=move_69.Geometry)
srf4pt_27 = _4PointSurface(CornerA=move_69.Geometry, CornerB=move_66.Geometry, CornerC=move_64.Geometry, CornerD=move_76.Geometry)
srf4pt_28 = _4PointSurface(CornerA=move_66.Geometry, CornerB=move_70.Geometry, CornerC=move_77.Geometry, CornerD=move_64.Geometry)
srf4pt_29 = _4PointSurface(CornerA=move_67.Geometry, CornerB=move_77.Geometry, CornerC=move_70.Geometry, CornerD=move_65.Geometry)
srf4pt_30 = _4PointSurface(CornerA=move_75.Geometry, CornerB=move_67.Geometry, CornerC=move_65.Geometry, CornerD=move_78.Geometry)
srf4pt_31 = _4PointSurface(CornerA=move_79.Geometry, CornerB=move_56.Geometry, CornerC=move_50.Geometry, CornerD=move_59.Geometry)
srf4pt_32 = _4PointSurface(CornerA=move_59.Geometry, CornerB=move_57.Geometry, CornerC=move_26.Geometry, CornerD=move_79.Geometry)
srf4pt_33 = _4PointSurface(CornerA=move_26.Geometry, CornerB=move_81.Geometry, CornerC=move_58.Geometry, CornerD=move_57.Geometry)
srf4pt_34 = _4PointSurface(CornerA=move_58.Geometry, CornerB=move_51.Geometry, CornerC=move_32.Geometry, CornerD=move_81.Geometry)
srf4pt_35 = _4PointSurface(CornerA=move_78.Geometry, CornerB=move_56.Geometry, CornerC=move_50.Geometry, CornerD=move_75.Geometry)
srf4pt_36 = _4PointSurface(CornerA=move_47.Geometry, CornerB=move_72.Geometry, CornerC=move_38.Geometry, CornerD=move_33.Geometry)
srf4pt_37 = _4PointSurface(CornerA=move_73.Geometry, CornerB=move_47.Geometry, CornerC=move_33.Geometry, CornerD=move_54.Geometry)
mesh_uv_3 = MeshSurface(Surface=srf4pt, UCount=number_slider_17, VCount=number_slider_18, Overhang=True, Equalize=False)
mesh_uv_4 = MeshSurface(Surface=srf4pt_2, UCount=number_slider_17, VCount=number_slider_18, Overhang=True, Equalize=False)
mesh_uv_5 = MeshSurface(Surface=srf4pt_3, UCount=number_slider_17, VCount=number_slider_18, Overhang=True, Equalize=False)
mesh_uv_6 = MeshSurface(Surface=srf4pt_4, UCount=number_slider_17, VCount=number_slider_18, Overhang=True, Equalize=False)
mesh_uv_7 = MeshSurface(Surface=srf4pt_7, UCount=number_slider_17, VCount=number_slider_18, Overhang=True, Equalize=False)
mesh_uv_8 = MeshSurface(Surface=srf4pt_8, UCount=number_slider_17, VCount=number_slider_18, Overhang=True, Equalize=False)
mesh_uv_9 = MeshSurface(Surface=srf4pt_9, UCount=number_slider_19, VCount=number_slider_18, Overhang=True, Equalize=False)
mesh_uv_10 = MeshSurface(Surface=srf4pt_10, UCount=number_slider_17, VCount=number_slider_18, Overhang=True, Equalize=False)
mesh_uv_11 = MeshSurface(Surface=srf4pt_11, UCount=number_slider_17, VCount=number_slider_18, Overhang=True, Equalize=False)
mesh_uv_12 = MeshSurface(Surface=srf4pt_20, UCount=number_slider_17, VCount=number_slider_18, Overhang=True, Equalize=False)
mesh_uv_13 = MeshSurface(Surface=srf4pt_21, UCount=number_slider_17, VCount=number_slider_18, Overhang=True, Equalize=False)
mesh_uv_14 = MeshSurface(Surface=srf4pt_22, UCount=number_slider_17, VCount=number_slider_18, Overhang=True, Equalize=False)
mesh_uv_15 = MeshSurface(Surface=srf4pt_13, UCount=number_slider_17, VCount=number_slider_18, Overhang=True, Equalize=False)
mesh_uv_16 = MeshSurface(Surface=srf4pt_14, UCount=number_slider_17, VCount=number_slider_18, Overhang=True, Equalize=False)
mesh_uv_17 = MeshSurface(Surface=srf4pt_19, UCount=number_slider_17, VCount=number_slider_18, Overhang=True, Equalize=False)
mesh_uv_18 = MeshSurface(Surface=srf4pt_15, UCount=number_slider_17, VCount=number_slider_18, Overhang=True, Equalize=False)
mesh_uv_19 = MeshSurface(Surface=srf4pt_16, UCount=number_slider_17, VCount=number_slider_18, Overhang=True, Equalize=False)
mesh_uv_20 = MeshSurface(Surface=srf4pt_17, UCount=number_slider_19, VCount=number_slider_18, Overhang=True, Equalize=False)
mesh_uv_21 = MeshSurface(Surface=srf4pt_18, UCount=number_slider_17, VCount=number_slider_18, Overhang=True, Equalize=False)
mesh_uv_22 = MeshSurface(Surface=srf4pt_12, UCount=number_slider_17, VCount=number_slider_18, Overhang=True, Equalize=False)
mesh_uv_23 = MeshSurface(Surface=srf4pt_36, UCount=number_slider_17, VCount=number_slider_18, Overhang=True, Equalize=False)
mesh_uv_24 = MeshSurface(Surface=srf4pt_23, UCount=number_slider_17, VCount=number_slider_18, Overhang=True, Equalize=False)
mesh_uv_25 = MeshSurface(Surface=srf4pt_24, UCount=number_slider_17, VCount=number_slider_18, Overhang=True, Equalize=False)
srf4pt_38 = _4PointSurface(CornerA=move_32.Geometry, CornerB=move_45.Geometry, CornerC=move_52.Geometry, CornerD=move_51.Geometry)
mesh_uv_26 = MeshSurface(Surface=srf4pt_26, UCount=number_slider_17, VCount=number_slider_18, Overhang=True, Equalize=False)
mesh_uv_27 = MeshSurface(Surface=srf4pt_37, UCount=number_slider_17, VCount=number_slider_18, Overhang=True, Equalize=False)
mesh_uv_28 = MeshSurface(Surface=srf4pt_25, UCount=number_slider_17, VCount=number_slider_18, Overhang=True, Equalize=False)
mesh_uv_29 = MeshSurface(Surface=srf4pt_27, UCount=number_slider_17, VCount=number_slider_18, Overhang=True, Equalize=False)
mesh_uv_30 = MeshSurface(Surface=srf4pt_28, UCount=number_slider_17, VCount=number_slider_18, Overhang=True, Equalize=False)
mesh_uv_31 = MeshSurface(Surface=srf4pt_29, UCount=number_slider_17, VCount=number_slider_18, Overhang=True, Equalize=False)
mesh_uv_32 = MeshSurface(Surface=srf4pt_30, UCount=number_slider_17, VCount=number_slider_18, Overhang=True, Equalize=False)
mesh_uv_33 = MeshSurface(Surface=srf4pt_35, UCount=number_slider_17, VCount=number_slider_18, Overhang=True, Equalize=False)
mesh_uv_34 = MeshSurface(Surface=srf4pt_32, UCount=number_slider_17, VCount=number_slider_18, Overhang=True, Equalize=False)
mesh_uv_35 = MeshSurface(Surface=srf4pt_31, UCount=number_slider_17, VCount=number_slider_18, Overhang=True, Equalize=False)
mesh_uv_36 = MeshSurface(Surface=srf4pt_33, UCount=number_slider_17, VCount=number_slider_18, Overhang=True, Equalize=False)
mesh_uv_37 = MeshSurface(Surface=srf4pt_34, UCount=number_slider_17, VCount=number_slider_18, Overhang=True, Equalize=False)
mesh_uv_38 = MeshSurface(Surface=srf4pt_38, UCount=number_slider_17, VCount=number_slider_18, Overhang=True, Equalize=False)

flipm = FlipMesh(Mesh=mesh_uv_6, VertexNormals=True, FaceNormals=True, FaceOrientation=True)
flipm_2 = FlipMesh(Mesh=mesh_uv, VertexNormals=True, FaceNormals=True, FaceOrientation=True)
flipm_3 = FlipMesh(Mesh=mesh_uv_7, VertexNormals=True, FaceNormals=True, FaceOrientation=True)
flipm_4 = FlipMesh(Mesh=mesh_uv_4, VertexNormals=True, FaceNormals=True, FaceOrientation=True)
flipm_5 = FlipMesh(Mesh=mesh_uv_10, VertexNormals=True, FaceNormals=True, FaceOrientation=True)
flipm_6 = FlipMesh(Mesh=mesh_uv_31, VertexNormals=True, FaceNormals=True, FaceOrientation=True)
flipm_7 = FlipMesh(Mesh=mesh_uv_32, VertexNormals=True, FaceNormals=True, FaceOrientation=True)
flipm_8 = FlipMesh(Mesh=mesh_uv_30, VertexNormals=True, FaceNormals=True, FaceOrientation=True)
flipm_9 = FlipMesh(Mesh=mesh_uv_26, VertexNormals=True, FaceNormals=True, FaceOrientation=True)
flipm_10 = FlipMesh(Mesh=mesh_uv_29, VertexNormals=True, FaceNormals=True, FaceOrientation=True)
flipm_11 = FlipMesh(Mesh=mesh_uv_33, VertexNormals=True, FaceNormals=True, FaceOrientation=True)
flipm_12 = FlipMesh(Mesh=mesh_uv_36, VertexNormals=True, FaceNormals=True, FaceOrientation=True)
flipm_13 = FlipMesh(Mesh=mesh_uv_18, VertexNormals=True, FaceNormals=True, FaceOrientation=True)
flipm_14 = FlipMesh(Mesh=mesh_uv_21, VertexNormals=True, FaceNormals=True, FaceOrientation=True)
flipm_15 = FlipMesh(Mesh=mesh_uv_23, VertexNormals=True, FaceNormals=True, FaceOrientation=True)
flipm_16 = FlipMesh(Mesh=mesh_uv_27, VertexNormals=True, FaceNormals=True, FaceOrientation=True)
flipm_17 = FlipMesh(Mesh=mesh_uv_15, VertexNormals=True, FaceNormals=True, FaceOrientation=True)
flipm_18 = FlipMesh(Mesh=mesh_uv_16, VertexNormals=True, FaceNormals=True, FaceOrientation=True)
flipm_19 = FlipMesh(Mesh=mesh_uv_38, VertexNormals=True, FaceNormals=True, FaceOrientation=True)
merge_9 = Merge(
    Data1=flipm_15,
    Data2=flipm_16,
    Data3=mesh_uv_24,
    Data4=mesh_uv_25,
    Data5=mesh_uv_28,
    Data6=flipm_9,
    Data7=flipm_10,
    Data8=flipm_8,
    Data9=flipm_6,
    Data10=flipm_7,
    Data11=flipm_11,
    Data12=mesh_uv_35,
    Data13=mesh_uv_34,
    Data14=flipm_12,
    Data15=mesh_uv_37,
    Data16=flipm_19)
merge_10 = Merge(
    Data1=mesh_uv_3,
    Data2=flipm_4,
    Data3=mesh_uv_5,
    Data4=flipm,
    Data5=flipm_2,
    Data6=mesh_uv_2,
    Data7=flipm_3,
    Data8=mesh_uv_8,
    Data9=mesh_uv_9,
    Data10=flipm_5,
    Data11=mesh_uv_11)
merge_11 = Merge(Data1=mesh_uv_3, Data2=mesh_uv_5, Data3=flipm_2, Data4=flipm_3, Data5=mesh_uv_9, Data6=mesh_uv_11)
merge_12 = Merge(
    Data1=mesh_uv_12,
    Data2=mesh_uv_13,
    Data3=mesh_uv_14,
    Data4=flipm_17,
    Data5=flipm_18,
    Data6=mesh_uv_17,
    Data7=flipm_13,
    Data8=mesh_uv_19,
    Data9=mesh_uv_20,
    Data10=flipm_14,
    Data11=mesh_uv_22)
mjoin = MeshJoin(Meshes=merge_11)
mjoin_2 = MeshJoin(Meshes=merge_10)
faceb = FaceBoundaries(Mesh=mjoin)
faceb_2 = FaceBoundaries(Mesh=mjoin_2)
pcen = PolygonCenter(Polyline=faceb_2)  # -> CenterV, CenterE, CenterA
mjoin_3 = MeshJoin(Meshes=merge_12)
mjoin_4 = MeshJoin(Meshes=merge_9)
pcen_2 = PolygonCenter(Polyline=faceb)  # -> CenterV, CenterE, CenterA
smesh = SimpleMesh(Brep=faceb)
smesh_2 = SimpleMesh(Brep=faceb_2)
faceb_3 = FaceBoundaries(Mesh=mjoin_3)
scale_2 = Scale(Geometry=smesh, Center=pcen_2.CenterV, Factor=number_slider_20)  # -> Geometry, Transform
scale_3 = Scale(Geometry=smesh_2, Center=pcen.CenterV, Factor=number_slider_20)  # -> Geometry, Transform
pcen_3 = PolygonCenter(Polyline=faceb_3)  # -> CenterV, CenterE, CenterA
faceb_4 = FaceBoundaries(Mesh=mjoin_4)
pcen_4 = PolygonCenter(Polyline=faceb_4)  # -> CenterV, CenterE, CenterA
smesh_3 = SimpleMesh(Brep=faceb_3)
smesh_4 = SimpleMesh(Brep=faceb_4)
scale_4 = Scale(Geometry=smesh_3, Center=pcen_3.CenterV, Factor=number_slider_20)  # -> Geometry, Transform
scale_5 = Scale(Geometry=smesh_4, Center=pcen_4.CenterV, Factor=number_slider_20)  # -> Geometry, Transform

# ---- group: 片片
开放度最小百分比 = Slider(0.5, range=0..1)
construct_domain = ConstructDomain(DomainStart="1", DomainEnd=开放度最小百分比)
merge_13 = Merge(Data1=scale_3.Geometry, Data2=scale_4.Geometry, Data3=scale_5.Geometry)
remap_numbers_3 = RemapNumbers(Value=remap_8.Mapped, Source=Domain(0, 1), Target=construct_domain)  # -> Mapped, Clipped
lng = ListLength(List=merge_13)
remap_25 = RemapNumbers(Value=remap_numbers_3.Mapped, Source=Domain(0, 1), Target="1 to 0")  # -> Mapped, Clipped
remap_26 = RemapNumbers(Value=remap_25.Mapped, Source=Domain(0, 1), Target=lng)  # -> Mapped, Clipped
round = Round(Number=remap_26.Mapped)  # -> Nearest, Floor, Ceiling
reduce = RandomReduce(List=merge_13, Reduction=round.Nearest, Seed=Slider(44, range=0..100))

# ----
offmsh = OffsetMesh(Mesh=reduce, Distance=Slider(0.001, range=0..0.001), BothSides=0, CreateSolid="0")  # -> flatten(Offset)
flipm_20 = FlipMesh(Mesh=offmsh, VertexNormals=True, FaceNormals=True, FaceOrientation=True)
merge_14 = Merge(Data1=flatten(reduce), Data2=flipm_20)  # -> flatten(Result)
mesh数量 = Panel(merge_14)
# 网格线（待定）
panel_40 = Panel(merge_14)
mcol = MeshColours(Mesh=merge_14, Colours=hsv)
panel_41 = Panel(mcol)
c_script = CSharpScript(mesh=mcol)  # inputs mesh: list of Mesh
# ---------- c_script: C# usings ----------
using System.Linq;
# ---------- c_script: C# ----------
    using(var args = new Rhino.Runtime.NamedParametersEventArgs())
    {
      args.Set("mesh", mesh.ToArray());
      Rhino.Runtime.HostUtils.ExecuteNamedCallback("Unity:FromGrasshopper", args);
    }
# ---------- end c_script ----------

# ---- group: 颜色
python_28 = GhPythonScript(x=merge_3)  # -> out, a; disabled; same code as python_4
null_3 = NullItem(Item=python_28.a)  # -> NullFlags, InvalidFlags, Description; disabled
or = GateOr(A=null_3.NullFlags, B=null_3.InvalidFlags)  # disabled
not_2 = GateNot(A=or)  # disabled
python_29 = GhPythonScript(x=python_28.a, y=not_2)  # -> out, a; inputs y: Int32; disabled
# ---------- python_29: Python ----------
__author__ = "lmh"
__version__ = "2024.06.20"

import rhinoscriptsyntax as rs
if y:
    if 0 <= x <= 0.3:
        a = 0
    if 0.3 < x <= 0.4:
        a = 0.25
    if 0.4 < x <= 0.6:
        a =0.5
    if 0.6 < x <= 0.8:
        a =0.75
    if 0.8 < x <= 1:
        a = 1
else:
    a = 0
# ---------- end python_29 ----------
item_39 = ListItem(List=python_29.a, Index=0, Wrap=True)  # -> Item, Item1, Item2, Item3; disabled
addition_9 = Addition(A=item_39.Item, B=item_39.Item1, C=item_39.Item2, D=item_39.Item3)  # disabled
python_30 = GhPythonScript(x=addition_9)  # -> out, a; disabled
# ---------- python_30: Python ----------
__author__ = "lmh"
__version__ = "2024.06.21"

import rhinoscriptsyntax as rs
if x == 0:
    a = 1
else:
    a = x
# ---------- end python_30 ----------
division_7 = Division(A=item_39.Item2, B=python_30.a)  # disabled
division_8 = Division(A=item_39.Item, B=python_30.a)  # disabled
division_9 = Division(A=item_39.Item1, B=python_30.a)  # disabled
division_10 = Division(A=item_39.Item3, B=python_30.a)  # disabled
python_31 = GhPythonScript(x=item_39.Item, y=item_39.Item1, z=item_39.Item2, u=item_39.Item3)  # -> out, a; disabled
# ---------- python_31: Python ----------
__author__ = "lmh"
__version__ = "2024.06.21"

import rhinoscriptsyntax as rs

if x == y == z == u:
    a = 0
else:
    a = 1
# ---------- end python_31 ----------
argb_2 = SplitARGB(Colour=swatch_2)  # -> Alpha, Red, Green, Blue; disabled
argb_3 = SplitARGB(Colour=swatch)  # -> Alpha, Red, Green, Blue; disabled
argb_4 = SplitARGB(Colour=swatch_4)  # -> Alpha, Red, Green, Blue; disabled
argb_5 = SplitARGB(Colour=swatch_3)  # -> Alpha, Red, Green, Blue; disabled
merge_15 = Merge(Data1=argb_3.Red, Data2=argb_3.Green, Data3=argb_3.Blue)  # disabled
merge_16 = Merge(Data1=argb_2.Red, Data2=argb_2.Green, Data3=argb_2.Blue)  # disabled
merge_17 = Merge(Data1=argb_4.Red, Data2=argb_4.Green, Data3=argb_4.Blue)  # disabled
merge_18 = Merge(Data1=argb_5.Red, Data2=argb_5.Green, Data3=argb_5.Blue)  # disabled
multiplication_3 = Multiplication(A=merge_15, B=division_8)  # disabled
multiplication_4 = Multiplication(A=merge_16, B=division_9)  # disabled
multiplication_5 = Multiplication(A=merge_18, B=division_10)  # disabled
multiplication_6 = Multiplication(A=merge_17, B=division_7)  # disabled
addition_10 = Addition(A=multiplication_3, B=multiplication_4, C=multiplication_6, D=multiplication_5)  # disabled
python_32 = GhPythonScript(x=addition_10, y=not_2, z=python_31.a)  # -> out, a; inputs y: list; disabled
# ---------- python_32: Python ----------
__author__ = "lmh"
__version__ = "2024.06.21"

import rhinoscriptsyntax as rs
if 0 in y or z == 0:
    a = 1
else:
    a = x
# ---------- end python_32 ----------

# ----
panel_42 = Panel(python_28.a)
panel_43 = Panel(python_29.a)  # disabled

graft_3 = GraftTree(Tree=python_32.a, IncludeEmptyLists=True, IncludeNullItems=True)  # disabled
速度_2 = Slider(18, range=0..20)  # disabled
trigger_17 = Trigger(Interval=200, TimerInterval=200, Target=rec_9)  # disabled
toggle_4 = BooleanToggle(True)  # disabled
rec_9 = DataRecorder(graft_3, DataLimit=-10, RecordData=True)  # disabled
panel_44 = Panel("-1")  # disabled
panel_45 = Panel("-2")  # disabled
trigger_18 = Trigger(Interval=20, TimerInterval=20, Target=[counter_21, counter_20, counter_19])  # disabled
panel_46 = Panel("0 to 100")  # disabled
item_40 = ListItem(List=rec_9, Index=panel_45, Wrap=True)  # -> flatten(Item); disabled
panel_47 = Panel("0")  # disabled
item_41 = ListItem(List=rec_9, Index=panel_44, Wrap=True)  # -> flatten(Item); disabled
dom_12 = ConstructDomain(DomainStart=panel_47, DomainEnd=速度_2)  # disabled
dcon_8 = DeleteConsecutive(Set=rec_9, Wrap=False)  # -> Set, Count; disabled
panel_48 = Panel("-1")  # disabled
panel_49 = Panel("-2")  # disabled
subtraction_11 = Subtraction(A=item_41, B=item_40)  # disabled
abs_3 = Absolute(Value=subtraction_11)  # disabled
item_42 = ListItem(List=abs_3, Index=0, Wrap=True)  # -> Item, Item1, Item2; disabled
counter_19 = Counter(CountDirection=True, Step=1, StartStop=toggle_4, Reset=item_42.Item2, OptionalCounterDomain=Domain(0, 100))  # disabled
counter_20 = Counter(CountDirection=True, Step=1, StartStop=toggle_4, Reset=item_42.Item1, OptionalCounterDomain=Domain(0, 100))  # disabled
counter_21 = Counter(CountDirection=True, Step=1, StartStop=toggle_4, Reset=item_42.Item, OptionalCounterDomain=Domain(0, 100))  # disabled
merge_19 = Merge(Data1=counter_21, Data2=counter_20, Data3=counter_19)  # disabled
item_43 = ListItem(List=dcon_8.Set, Index=panel_49, Wrap=True)  # -> flatten(Item); disabled
item_44 = ListItem(List=dcon_8.Set, Index=panel_48, Wrap=True)  # -> flatten(Item); disabled
remap_27 = RemapNumbers(Value=merge_19, Source=panel_46, Target=dom_12)  # -> Mapped, Clipped; disabled
dom_13 = ConstructDomain(DomainStart=item_43, DomainEnd=item_44)  # disabled
python_33 = GhPythonScript(x=remap_27.Mapped)  # -> out, a; disabled; same code as python_3
remap_28 = RemapNumbers(Value=python_33.a, Source=Domain(0, 1), Target=dom_13)  # -> Mapped, Clipped; disabled

# ---- group: 颜色 (continued)
item_45 = ListItem(List=remap_28.Mapped, Index=0, Wrap=True)  # -> Item, Item1, Item2; disabled
frgb_2 = ColourRGBF(Alpha=1, Red=item_45.Item, Green=item_45.Item1, Blue=item_45.Item2)  # disabled
ahsv_2 = SplitAHSV(Colour=frgb_2)  # -> Alpha, Hue, Saturation, Value; disabled
addition_11 = Addition(A=ahsv_2.Saturation, B=饱和度)  # disabled
addition_12 = Addition(A=ahsv_2.Value, B=明度)  # disabled
hsv_2 = ColourHSV(Alpha=panel_16, Hue=ahsv_2.Hue, Saturation=addition_11, Value=addition_12)  # disabled

# ----
panel_50 = Panel(frgb_2)  # disabled

# ==== cluster Cluster
data = ClusterInput()
text_split = TextSplit(Text=data)
c_script = CSharpScript(x=text_split)  # -> out, a; inputs x: list of String
# ---------- c_script: C# usings ----------
using System.Linq;
# ---------- c_script: C# ----------
    List<List<string>> groups = new List<List<string>>();
    List<string> currentGroup = new List<string>();


    foreach (string item in x)
    {
      if (item == "")
      {
        if (currentGroup.Any())
        {
          groups.Add(currentGroup);
          currentGroup = new List<string>();
        }
      }
      else
      {
        currentGroup.Add(item);
      }
    }

    if (currentGroup.Any())
    {
      groups.Add(currentGroup);
    }

    List<string> combinedGroup = groups.Select(sublist => string.Join("\n", sublist)).ToList();
    a = combinedGroup.ToArray();
# ---------- end c_script ----------
text_split_2 = TextSplit(Text=c_script.a)
split_list = SplitList(List=text_split_2, Index="1")  # -> flatten(ListA), ListB
list_item = ListItem(List=flatten(split_list.ListA), Index=0, Wrap=True)
text_split_3 = TextSplit(Text=split_list.ListB, Separators=" ")  # -> simplify(Result)
list_item_2 = ListItem(List=text_split_3, Index=0, Wrap=True)  # -> Item, Item1, Item2
construct_point = ConstructPoint(XCoordinate=0, YCoordinate=0, ZCoordinate=0)
construct_point_2 = ConstructPoint(XCoordinate=list_item_2.Item, YCoordinate=list_item_2.Item1, ZCoordinate=list_item_2.Item2)
distance = Distance(PointA=construct_point_2, PointB=construct_point)
smaller_than = SmallerThan(FirstNumber=distance, SecondNumber="0.001")  # -> SmallerThan, OrEqualTo
member_index = MemberIndex(Set=smaller_than.SmallerThan, Member=Toggle(True))  # -> Index, Count
null_placeholder = NullPlaceholder()
replace_items = ReplaceItems(List=construct_point_2, Item=null_placeholder, Indices=member_index.Index, Wrap=False)
flatten_tree = FlattenTree(Tree=replace_items, Path="{0}")
tree = ClusterOutput(flatten_tree)

# ==== cluster Cluster_2
data = ClusterInput()
panel = Panel(""" 
:""")
text_split = TextSplit(Text=data)
c_script = CSharpScript(x=text_split)  # -> out, a; inputs x: list of String; same code as c_script
text_split_2 = TextSplit(Text=c_script.a, Separators=panel)  # -> flatten(Result)
result = ClusterOutput(text_split_2)

# ==== cluster Cluster_3
panel = Panel("""27
30
31""")
panel_2 = Panel("""2
11
12
13
14
15
16""")
panel_3 = Panel("""14
17""")
panel_4 = Panel("""0
22
23
24
25""")
panel_5 = Panel("""0
1
2
3
26
27""")
panel_6 = Panel("""27
28
29""")
panel_7 = Panel("""2
4
5
6
7
8
9""")
panel_8 = Panel("""7
10""")
panel_9 = Panel("""24
33""")
panel_10 = Panel("""0
18
19
20
21""")
panel_11 = Panel("""20
32""")
list = ClusterInput()
list_2 = ClusterInput()
list_3 = ClusterInput()
list_4 = ClusterInput()
list_5 = ClusterInput()
list_6 = ClusterInput()
list_7 = ClusterInput()
list_8 = ClusterInput()
list_9 = ClusterInput()
list_10 = ClusterInput()
list_11 = ClusterInput()
list_item = ListItem(List=list, Index=panel_6, Wrap=True)  # -> simplify(Item)
list_item_2 = ListItem(List=list_2, Index=panel_5, Wrap=True)
list_item_3 = ListItem(List=list_3, Index=panel, Wrap=True)
list_item_4 = ListItem(List=list_4, Index=panel_7, Wrap=True)
list_item_5 = ListItem(List=list_5, Index=panel_8, Wrap=True)
list_item_6 = ListItem(List=list_6, Index=panel_2, Wrap=True)
list_item_7 = ListItem(List=list_7, Index=panel_3, Wrap=True)
list_item_8 = ListItem(List=list_8, Index=panel_4, Wrap=True)
list_item_9 = ListItem(List=list_9, Index=panel_9, Wrap=True)
list_item_10 = ListItem(List=list_10, Index=panel_10, Wrap=True)
list_item_11 = ListItem(List=list_11, Index=panel_11, Wrap=True)
polyline = PolyLine(Vertices=list_item_2, Closed=False)
polyline_2 = PolyLine(Vertices=list_item, Closed=False)
polyline_3 = PolyLine(Vertices=list_item_3, Closed=False)
polyline_4 = PolyLine(Vertices=list_item_4, Closed=False)
polyline_5 = PolyLine(Vertices=list_item_5, Closed=False)
polyline_6 = PolyLine(Vertices=list_item_6, Closed=False)
polyline_7 = PolyLine(Vertices=list_item_7, Closed=False)
polyline_8 = PolyLine(Vertices=list_item_8, Closed=False)
polyline_9 = PolyLine(Vertices=list_item_9, Closed=False)
polyline_10 = PolyLine(Vertices=list_item_10, Closed=False)
polyline_11 = PolyLine(Vertices=list_item_11, Closed=False)
merge = Merge(
    Data1=polyline,
    Data2=polyline_2,
    Data3=polyline_3,
    Data4=polyline_4,
    Data5=polyline_5,
    Data6=polyline_6,
    Data7=polyline_7,
    Data8=polyline_8,
    Data9=polyline_9,
    Data10=polyline_10,
    Data11=polyline_11)

# ==== cluster Cluster_4
list = ClusterInput()
list_2 = ClusterInput()
list_3 = ClusterInput()

# ---- group: 头部向量
left_eye = Panel("28")
head = Panel("26")
right_eye = Panel("30")
list_item = ListItem(List=list, Index=left_eye, Wrap=True)
list_item_2 = ListItem(List=list_2, Index=right_eye, Wrap=True)
list_item_3 = ListItem(List=list_3, Index=head, Wrap=True)
plane_3pt = Plane3Pt(PointA=list_item_3, PointB=list_item, PointC=list_item_2)
polyline = PolyLine(Vertices=[list_item_3, list_item, list_item_2], Closed=False)
polygon_center = PolygonCenter(Polyline=polyline)  # -> CenterV, CenterE, CenterA
vector = Vector(plane_3pt)

# ----
i = ClusterOutput(list_item_3)
vector_2 = ClusterOutput(vector)
list_item_4 = ListItem(List=flatten(polygon_center.CenterV), Index=0, Wrap=True)  # -> Item, Item1
list_item_5 = ListItem(List=flatten(vector), Index=0, Wrap=True)  # -> Item, Item1

# ---- group: 头部向量 (continued)
vector_display = VectorDisplay(Anchor=list_item_4.Item, Vector=list_item_5.Item)

# ----
vector_display_2 = VectorDisplay(Anchor=list_item_4.Item1, Vector=list_item_5.Item1)
