# Grasshopper definition input0627_new.gh (Grasshopper 1.0.7)
# plug-ins: Firefly_X, gHowl, Pufferfish

network_source = NetworkSource()  # -> NetworkAdapterIsUp, AdapterProperties, LocalIpAddress
# - Interaction 交互状态
# 
# - Task 任务处理模式
# 
# - attention 注意力状态
# 
# - emotion 情绪状态
panel = Panel(network_source.LocalIpAddress)

trigger = Trigger(Interval=1000, TimerInterval=1000, Target=unityslider)  # disabled
trigger_2 = Trigger(Interval=1000, TimerInterval=1000, Target=[unityslider, unityslider_2])  # disabled
unityslider = UnitySlider()  # -> out, HeadPosition, HeadRotation
# ---------- unityslider: C# usings ----------
using Grasshopper.Kernel.Special;
using Grasshopper.GUI.Canvas;
# ---------- unityslider: C# ----------
    Register(Component);
    HeadPosition = temp_positionRhino;
    HeadRotation = temp_rotationRhino;
# ---------- unityslider: C# additional code ----------
  Point3d temp_positionRhino;
  Vector3d temp_rotationRhino;
  void Register(IGH_Component component)
  {
    Rhino.Runtime.HostUtils.RegisterNamedCallback("ToGH_HeadPose", ToGrasshopper);

  }

  void ToGrasshopper(object sender, Rhino.Runtime.NamedParametersEventArgs args)
  {
    Point3d positionRhino;
    Vector3d rotationRhino;
    if(args.TryGetPoint("HeadPosition", out positionRhino))
    {

      args.TryGetVector("HeadRotation", out rotationRhino);
      temp_positionRhino = positionRhino;
      temp_rotationRhino = rotationRhino;
    }
  }
# ---------- end unityslider ----------
unityslider_2 = UnitySlider()  # -> out, StationaryPercentage
# ---------- unityslider_2: C# ----------
    Register(Component);
    StationaryPercentage = temp_stationaryPercentage;
# ---------- unityslider_2: C# additional code ----------
  string temp_stationaryPercentage;

  void Register(IGH_Component component)
  {
    Rhino.Runtime.HostUtils.RegisterNamedCallback("ToGH_StationaryPercentage", ToGrasshopper);
  }

  void ToGrasshopper(object sender, Rhino.Runtime.NamedParametersEventArgs args)
  {
    double percentage;
    if (args.TryGetDouble("StationaryPercentage", out percentage))
    {
      temp_stationaryPercentage = percentage.ToString();
    }
  }
# ---------- end unityslider_2 ----------
vr获取_头部向量 = Panel(unityslider.HeadRotation)
vr获取_头部坐标 = Panel(unityslider.HeadPosition)
注意力状态 = Panel(unityslider_2.StationaryPercentage)

trigger_3 = Trigger(Interval=1000, TimerInterval=1000, Target=counter)  # disabled
button = Button()  # disabled
counter = Counter(CountDirection=True, Step=1, StartStop=True, Reset=button, OptionalCounterDomain=Domain(0, 100))  # disabled
panel_2 = Panel(counter)  # disabled
random = Random(Range=Domain(0, 1), Number=1, Seed=panel_2)  # disabled
生成随机数 = Panel(random)  # disabled

# ----
# (1)随机拿一个人，空间识别谁是主要人（好像也说得通）
# (2)固定拿一个人，画面扰动之后会变化
panel_3 = Panel("")
construct_point = ConstructPoint(XCoordinate=0, YCoordinate=0, ZCoordinate=0)
null_placeholder = NullPlaceholder()
remap_numbers = RemapNumbers(Value=注意力状态, Source="0 to 100", Target=Domain(0, 1))  # -> Mapped, Clipped
data_recorder = DataRecorder(remap_numbers.Mapped, DataLimit=-10, RecordData=True)
partition_list = PartitionList(List=data_recorder, Size=Slider(3, range=0..100))
panel_4 = Panel(partition_list)
number = Number(partition_list)
average = Average(Input=number)
panel_5 = Panel(average)
panel_6 = Panel(data_recorder)
list_item = ListItem(List=panel_5, Index="-2", Wrap=True)
panel_7 = Panel(list_item)

# ---- group: 分隔输入 规整度
速度 = Slider(8, range=0..20)
trigger_4 = Trigger(Interval=20, TimerInterval=20, Target=counter_2)  # disabled
dom = ConstructDomain(DomainStart="0", DomainEnd=速度)
relay = Relay()
python = GhPythonScript(x=relay)  # -> out, a
# ---------- python: Python ----------
__author__ = "lmh"
__version__ = "2024.06.20"

import rhinoscriptsyntax as rs
if 0 <= x <= 0.3:
    a = 0
if 0.3 < x <= 0.4:
    a = 0.25
if 0.4 < x <= 0.5:
    a = 0.5
if 0.5 < x <= 0.6:
    a = 0.75
if 0.6 < x <= 1:
    a = 1
# ---------- end python ----------
rec = DataRecorder(python.a, DataLimit=-10, RecordData=True)
item = ListItem(List=rec, Index="-1", Wrap=True)
item_2 = ListItem(List=rec, Index="-2", Wrap=True)
dcon = DeleteConsecutive(Set=rec, Wrap=False)  # -> Set, Count
subtraction = Subtraction(A=item, B=item_2)
python_2 = GhPythonScript(x=subtraction)  # -> out, a
# ---------- python_2: Python ----------
__author__ = "lmh"
__version__ = "2024.06.20"

import rhinoscriptsyntax as rs
if x == 0:
    a = 0
else:
    a = 1
# ---------- end python_2 ----------
counter_2 = Counter(CountDirection=True, Step=1, StartStop=Toggle(True), Reset=python_2.a, OptionalCounterDomain=Domain(0, 100))
remap = RemapNumbers(Value=counter_2, Source="0 to 100", Target=dom)  # -> Mapped, Clipped
python_3 = GhPythonScript(x=remap.Mapped)  # -> out, a
# ---------- python_3: Python ----------
__author__ = "lmh"
__version__ = "2024.06.11"

import rhinoscriptsyntax as rs
import math
if 0 <= x <= 1:
    a = (math.cos((x-1) * math.pi) + 1) / 2


if x > 1:
    a = 1
# ---------- end python_3 ----------
item_3 = ListItem(List=dcon.Set, Index="-1", Wrap=True)
item_4 = ListItem(List=dcon.Set, Index="-2", Wrap=True)
dom_2 = ConstructDomain(DomainStart=item_4, DomainEnd=item_3)
remap_2 = RemapNumbers(Value=python_3.a, Source=Domain(0, 1), Target=dom_2)  # -> Mapped, Clipped
panel_8 = Panel(remap_2.Mapped)

# ---- group: 分隔输入 远端高度
速度_2 = Slider(8, range=0..20)
trigger_5 = Trigger(Interval=20, TimerInterval=20, Target=counter_3)  # disabled
dom_3 = ConstructDomain(DomainStart="0", DomainEnd=速度_2)
relay_2 = Relay()
python_4 = GhPythonScript(x=relay_2)  # -> out, a
# ---------- python_4: Python ----------
__author__ = "lmh"
__version__ = "2024.06.20"

import rhinoscriptsyntax as rs
if 0 <= x <= 0.2:
    a = 0
if 0.2 < x <= 0.4:
    a = 0.25
if 0.4 < x <= 0.6:
    a = 0.5
if 0.6 < x <= 0.8:
    a = 0.75
if 0.8 < x <= 1:
    a = 1
# ---------- end python_4 ----------
rec_2 = DataRecorder(python_4.a, DataLimit=-10, RecordData=True)
item_5 = ListItem(List=rec_2, Index="-1", Wrap=True)
item_6 = ListItem(List=rec_2, Index="-2", Wrap=True)
dcon_2 = DeleteConsecutive(Set=rec_2, Wrap=False)  # -> Set, Count
subtraction_2 = Subtraction(A=item_5, B=item_6)
python_5 = GhPythonScript(x=subtraction_2)  # -> out, a; same code as python_2
counter_3 = Counter(CountDirection=True, Step=1, StartStop=Toggle(True), Reset=python_5.a, OptionalCounterDomain=Domain(0, 100))
remap_3 = RemapNumbers(Value=counter_3, Source="0 to 100", Target=dom_3)  # -> Mapped, Clipped
python_6 = GhPythonScript(x=remap_3.Mapped)  # -> out, a; same code as python_3
item_7 = ListItem(List=dcon_2.Set, Index="-1", Wrap=True)
item_8 = ListItem(List=dcon_2.Set, Index="-2", Wrap=True)
dom_4 = ConstructDomain(DomainStart=item_8, DomainEnd=item_7)
remap_4 = RemapNumbers(Value=python_6.a, Source=Domain(0, 1), Target=dom_4)  # -> Mapped, Clipped

# ---- group: 分隔输入 开放度
速度_3 = Slider(8, range=0..20)
trigger_6 = Trigger(Interval=20, TimerInterval=20, Target=counter_4)  # disabled
dom_5 = ConstructDomain(DomainStart="0", DomainEnd=速度_3)
relay_3 = Relay()
python_7 = GhPythonScript(x=relay_3)  # -> out, a; same code as python_4
rec_3 = DataRecorder(flatten(python_7.a), DataLimit=-10, RecordData=True)
item_9 = ListItem(List=rec_3, Index="-1", Wrap=True)
item_10 = ListItem(List=rec_3, Index="-2", Wrap=True)
dcon_3 = DeleteConsecutive(Set=rec_3, Wrap=False)  # -> Set, Count
subtraction_3 = Subtraction(A=item_9, B=item_10)
python_8 = GhPythonScript(x=subtraction_3)  # -> out, a; same code as python_2
counter_4 = Counter(CountDirection=True, Step=1, StartStop=Toggle(True), Reset=python_8.a, OptionalCounterDomain=Domain(0, 100))
remap_5 = RemapNumbers(Value=counter_4, Source="0 to 100", Target=dom_5)  # -> Mapped, Clipped
python_9 = GhPythonScript(x=remap_5.Mapped)  # -> out, a; same code as python_3
item_11 = ListItem(List=dcon_3.Set, Index="-1", Wrap=True)
item_12 = ListItem(List=dcon_3.Set, Index="-2", Wrap=True)
dom_6 = ConstructDomain(DomainStart=item_12, DomainEnd=item_11)
remap_6 = RemapNumbers(Value=python_9.a, Source=Domain(0, 1), Target=dom_6)  # -> Mapped, Clipped

# ----
relay_4 = Relay()
panel_9 = Panel(relay)

# ---- group: 分隔输入 近端高度
速度_4 = Slider(16, range=0..20)
trigger_7 = Trigger(Interval=20, TimerInterval=20, Target=counter_5)  # disabled
dom_7 = ConstructDomain(DomainStart="0", DomainEnd=速度_4)
python_10 = GhPythonScript(x=relay_4)  # -> out, a
# ---------- python_10: Python ----------
__author__ = "lmh"
__version__ = "2024.06.20"

import rhinoscriptsyntax as rs
if 0 <= x <= 0.9:
    a = 0
if 0.9 < x <= 0.92:
    a = 0.25
if 0.92 < x <= 0.95:
    a = 0.5
if 0.95 < x <= 0.98:
    a = 0.75
if 0.98 < x <= 1:
    a = 1
# ---------- end python_10 ----------
rec_4 = DataRecorder(flatten(python_10.a), DataLimit=-10, RecordData=True)
item_13 = ListItem(List=rec_4, Index="-1", Wrap=True)
item_14 = ListItem(List=rec_4, Index="-2", Wrap=True)
dcon_4 = DeleteConsecutive(Set=rec_4, Wrap=False)  # -> Set, Count
subtraction_4 = Subtraction(A=item_13, B=item_14)
python_11 = GhPythonScript(x=subtraction_4)  # -> out, a; same code as python_2
counter_5 = Counter(CountDirection=True, Step=1, StartStop=Toggle(True), Reset=python_11.a, OptionalCounterDomain=Domain(0, 100))
remap_7 = RemapNumbers(Value=counter_5, Source="0 to 100", Target=dom_7)  # -> Mapped, Clipped
python_12 = GhPythonScript(x=remap_7.Mapped)  # -> out, a; same code as python_3
item_15 = ListItem(List=dcon_4.Set, Index="-1", Wrap=True)
item_16 = ListItem(List=dcon_4.Set, Index="-2", Wrap=True)
dom_8 = ConstructDomain(DomainStart=item_16, DomainEnd=item_15)
remap_8 = RemapNumbers(Value=python_12.a, Source=Domain(0, 1), Target=dom_8)  # -> Mapped, Clipped

# ---- group: emotion
panel_10 = Panel("403")

# ----
udp_receiver = UDPReceiver(Address=network_source.LocalIpAddress, Port=panel_10, Pattern=0)  # -> Info, Data

# ---- group: emotion (continued)
emotion_of_headwearer = Panel(udp_receiver.Data)

panel_11 = Panel("402")

# ----
udp_receiver_2 = UDPReceiver(Address=network_source.LocalIpAddress, Port=panel_11, Pattern=0)  # -> Info, Data

# ---- group: emotion (continued)
emotion_average = Panel(udp_receiver_2.Data)

# ----
data_recorder_2 = DataRecorder(emotion_average, DataLimit=-10, RecordData=True)

panel_12 = Panel(""" 
:""")
text_split = TextSplit(Text=emotion_average, Separators=panel_12)
panel_13 = Panel("""1
3
5
7""")
list_item_2 = ListItem(List=text_split, Index=panel_13, Wrap=True)
panel_14 = Panel(list_item_2)
remap_numbers_2 = RemapNumbers(Value=panel_14, Source="0 to 5", Target="0.1 to 1")  # -> Mapped, Clipped
list_item_3 = ListItem(List=remap_numbers_2.Mapped, Index=0, Wrap=True)  # -> Item, Item1, Item2, Item3

panel_15 = Panel(data_recorder_2)

# ---- group: 情绪状态 emotion
surprise = Panel(list_item_3.Item3)
joy = Panel(list_item_3.Item)
sorrow = Panel(list_item_3.Item1)
anger = Panel(list_item_3.Item2)

# ----
udp_receiver_3 = UDPReceiver(Address=network_source.LocalIpAddress, Port="1111", Pattern=0)  # -> Info, Data

骨骼点 = Panel(udp_receiver_3.Data)

text_split_2 = TextSplit(Text=udp_receiver_3.Data, Separators=panel_3)
c_script = CSharpScript(x=text_split_2)  # -> out, a; inputs x: list of String
# ---------- c_script: C# usings ----------
using System.Linq;
# ---------- c_script: C# ----------
    List<List<string>> groups = new List<List<string>>();
    List<string> currentGroup = new List<string>();


    foreach (string item in x)
    {
      if (item == "")
      {
        if (currentGroup.Any())
        {
          groups.Add(currentGroup);
          currentGroup = new List<string>();
        }
      }
      else
      {
        currentGroup.Add(item);
      }
    }

    if (currentGroup.Any())
    {
      groups.Add(currentGroup);
    }

    List<string> combinedGroup = groups.Select(sublist => string.Join("\n", sublist)).ToList();
    a = combinedGroup.ToArray();
# ---------- end c_script ----------
text_split_3 = TextSplit(Text=c_script.a)
split_list = SplitList(List=text_split_3, Index="1")  # -> flatten(ListA), ListB
list_item_4 = ListItem(List=flatten(split_list.ListA), Index=0, Wrap=True)
text_split_4 = TextSplit(Text=split_list.ListB, Separators=" ")  # -> simplify(Result)
panel_16 = Panel(split_list.ListA)
list_item_5 = ListItem(List=text_split_4, Index=0, Wrap=True)  # -> Item, Item1, Item2
construct_point_2 = ConstructPoint(XCoordinate=list_item_5.Item, YCoordinate=list_item_5.Item1, ZCoordinate=list_item_5.Item2)
distance = Distance(PointA=construct_point_2, PointB=construct_point)
smaller_than = SmallerThan(FirstNumber=distance, SecondNumber="0.001")  # -> SmallerThan, OrEqualTo
member_index = MemberIndex(Set=smaller_than.SmallerThan, Member=Toggle(True))  # -> Index, Count
replace_items = ReplaceItems(List=construct_point_2, Item=null_placeholder, Indices=member_index.Index, Wrap=False)
flatten_tree = FlattenTree(Tree=replace_items, Path="{0}")

trim_tree = TrimTree(Tree=replace_items, Depth=1)  # disabled
panel_17 = Panel("Person 392:")  # disabled
flip_matrix = FlipMatrix(Data=trim_tree)  # disabled
member_index_2 = MemberIndex(Set=flatten(split_list.ListA), Member=panel_17)  # -> Index, Count; disabled
panel_18 = Panel("0")  # disabled
list_item_6 = ListItem(List=flip_matrix, Index=panel_18, Wrap=True)  # -> flatten(Item); disabled

point = Point(flatten_tree)

# ---- group: 坐标系转化
srf = Surface(<surface referenced from the Rhino model>)
pln = Plane(srf)
flip_plane = FlipPlane(Plane=pln, ReverseX=False, ReverseY=False, SwapAxes=True)
deplane = DeconstructPlane(Plane=flip_plane)  # -> Origin, XAxis, YAxis, ZAxis
deplane_2 = DeconstructPlane(Plane=flip_plane)  # -> Origin, XAxis, YAxis, ZAxis
pt = Point(flip_plane)
vec = Vector(deplane_2.XAxis)
vec_2 = Vector(deplane.ZAxis)
vdis = VectorDisplay(Anchor=pt, Vector=vec_2)
line_sdl = LineSDL(Start=deplane.Origin, Direction=vec_2, Length=Slider(1, range=0..1))
rotate_axis = RotateAxis(Geometry=flip_plane, Angle=degrees(Slider(90, range=0..100)), Axis=line_sdl)  # -> Geometry, Transform
xy = XYPlane(Origin=Point(0, 0, 0))
zed深度相机缩放比例 = Slider(1.129, range=0..10)
deplane_3 = DeconstructPlane(Plane=xy)  # -> Origin, XAxis, YAxis, ZAxis
scale = Scale(Geometry=point, Center=deplane_3.Origin, Factor=zed深度相机缩放比例)  # -> Geometry, Transform
orient = Orient(Geometry=scale.Geometry, Source=xy, Target=rotate_axis.Geometry)  # -> Geometry, Transform

# ----
partition_list_2 = PartitionList(List=orient.Geometry, Size="34")

# ----
# 看看取的是谁的
explode_tree = ExplodeTree(Data=partition_list_2)  # -> Branch0, Branch1, Branch2
point_2 = Point(explode_tree.Branch0)

# ---- group: 肘关节夹角
panel_19 = Panel("""18
19
20""")
panel_20 = Panel("""22
23
24""")
list_item_7 = ListItem(List=explode_tree.Branch0, Index=panel_19, Wrap=True)
list_item_8 = ListItem(List=explode_tree.Branch0, Index=panel_20, Wrap=True)
list_item_9 = ListItem(List=list_item_8, Index=0, Wrap=True)  # -> Item, Item1, Item2
list_item_10 = ListItem(List=list_item_7, Index=0, Wrap=True)  # -> Item, Item1, Item2
vector_2pt = Vector2Pt(PointA=list_item_9.Item, PointB=list_item_9.Item1, Unitize=False)  # -> Vector, Length
vector_2pt_2 = Vector2Pt(PointA=list_item_9.Item2, PointB=list_item_9.Item1, Unitize=False)  # -> Vector, Length
vector_2pt_3 = Vector2Pt(PointA=list_item_10.Item, PointB=list_item_10.Item1, Unitize=False)  # -> Vector, Length
vector_2pt_4 = Vector2Pt(PointA=list_item_10.Item2, PointB=list_item_10.Item1, Unitize=False)  # -> Vector, Length
angle = Angle(VectorA=vector_2pt.Vector, VectorB=vector_2pt_2.Vector)  # -> Angle, Reflex
angle_2 = Angle(VectorA=vector_2pt_3.Vector, VectorB=vector_2pt_4.Vector)  # -> Angle, Reflex
degrees = Degrees(Radians=angle.Angle)
degrees_2 = Degrees(Radians=angle_2.Angle)
right_膝关节夹角 = Panel(degrees_2)
left_膝关节夹角 = Panel(degrees)

# ---- group: 肩部夹角
panel_21 = Panel("""13
12
22""")
panel_22 = Panel("""6
5
18""")
list_item_11 = ListItem(List=explode_tree.Branch0, Index=panel_22, Wrap=True)
list_item_12 = ListItem(List=explode_tree.Branch0, Index=panel_21, Wrap=True)
list_item_13 = ListItem(List=list_item_12, Index=0, Wrap=True)  # -> Item, Item1, Item2
list_item_14 = ListItem(List=list_item_11, Index=0, Wrap=True)  # -> Item, Item1, Item2
vector_2pt_5 = Vector2Pt(PointA=list_item_13.Item, PointB=list_item_13.Item1, Unitize=False)  # -> Vector, Length
vector_2pt_6 = Vector2Pt(PointA=list_item_13.Item2, PointB=list_item_13.Item1, Unitize=False)  # -> Vector, Length
vector_2pt_7 = Vector2Pt(PointA=list_item_14.Item, PointB=list_item_14.Item1, Unitize=False)  # -> Vector, Length
vector_2pt_8 = Vector2Pt(PointA=list_item_14.Item2, PointB=list_item_14.Item1, Unitize=False)  # -> Vector, Length
angle_3 = Angle(VectorA=vector_2pt_5.Vector, VectorB=vector_2pt_6.Vector)  # -> Angle, Reflex
angle_4 = Angle(VectorA=vector_2pt_7.Vector, VectorB=vector_2pt_8.Vector)  # -> Angle, Reflex
degrees_3 = Degrees(Radians=angle_3.Angle)
degrees_4 = Degrees(Radians=angle_4.Angle)
right_肩部关节夹角 = Panel(degrees_4)
left_肩部关节夹角 = Panel(degrees_3)

# ---- group: 躯干-大腿夹角
panel_23 = Panel("""4
18
19""")
panel_24 = Panel("""11
22
23""")
list_item_15 = ListItem(List=explode_tree.Branch0, Index=panel_23, Wrap=True)
list_item_16 = ListItem(List=explode_tree.Branch0, Index=panel_24, Wrap=True)
list_item_17 = ListItem(List=list_item_16, Index=0, Wrap=True)  # -> Item, Item1, Item2
list_item_18 = ListItem(List=list_item_15, Index=0, Wrap=True)  # -> Item, Item1, Item2
vector_2pt_9 = Vector2Pt(PointA=list_item_17.Item, PointB=list_item_17.Item1, Unitize=False)  # -> Vector, Length
vector_2pt_10 = Vector2Pt(PointA=list_item_17.Item2, PointB=list_item_17.Item1, Unitize=False)  # -> Vector, Length
vector_2pt_11 = Vector2Pt(PointA=list_item_18.Item, PointB=list_item_18.Item1, Unitize=False)  # -> Vector, Length
vector_2pt_12 = Vector2Pt(PointA=list_item_18.Item2, PointB=list_item_18.Item1, Unitize=False)  # -> Vector, Length
angle_5 = Angle(VectorA=vector_2pt_9.Vector, VectorB=vector_2pt_10.Vector)  # -> Angle, Reflex
angle_6 = Angle(VectorA=vector_2pt_11.Vector, VectorB=vector_2pt_12.Vector)  # -> Angle, Reflex
degrees_5 = Degrees(Radians=angle_5.Angle)
degrees_6 = Degrees(Radians=angle_6.Angle)
right_躯干_大腿夹角 = Panel(degrees_6)
left_躯干_大腿夹角 = Panel(degrees_5)

# ---- group: 肘关节夹角
panel_25 = Panel("""5
6
7""")
panel_26 = Panel("""12
13
14""")
list_item_19 = ListItem(List=explode_tree.Branch0, Index=panel_25, Wrap=True)
list_item_20 = ListItem(List=explode_tree.Branch0, Index=panel_26, Wrap=True)
list_item_21 = ListItem(List=list_item_20, Index=0, Wrap=True)  # -> Item, Item1, Item2
list_item_22 = ListItem(List=list_item_19, Index=0, Wrap=True)  # -> Item, Item1, Item2
vector_2pt_13 = Vector2Pt(PointA=list_item_21.Item, PointB=list_item_21.Item1, Unitize=False)  # -> Vector, Length
vector_2pt_14 = Vector2Pt(PointA=list_item_21.Item2, PointB=list_item_21.Item1, Unitize=False)  # -> Vector, Length
vector_2pt_15 = Vector2Pt(PointA=list_item_22.Item, PointB=list_item_22.Item1, Unitize=False)  # -> Vector, Length
vector_2pt_16 = Vector2Pt(PointA=list_item_22.Item2, PointB=list_item_22.Item1, Unitize=False)  # -> Vector, Length
angle_7 = Angle(VectorA=vector_2pt_13.Vector, VectorB=vector_2pt_14.Vector)  # -> Angle, Reflex
angle_8 = Angle(VectorA=vector_2pt_15.Vector, VectorB=vector_2pt_16.Vector)  # -> Angle, Reflex
degrees_7 = Degrees(Radians=angle_7.Angle)
degrees_8 = Degrees(Radians=angle_8.Angle)
right_肘关节夹角 = Panel(degrees_8)
left_肘关节夹角 = Panel(degrees_7)

# ---- group: 骨骼连线（人形）
panel_27 = Panel("""27
30
31""")
panel_28 = Panel("""2
11
12
13
14
15
16""")
panel_29 = Panel("""14
17""")
panel_30 = Panel("""0
22
23
24
25""")
panel_31 = Panel("""0
1
2
3
26
27""")
panel_32 = Panel("""27
28
29""")
panel_33 = Panel("""2
4
5
6
7
8
9""")
panel_34 = Panel("""7
10""")
panel_35 = Panel("""24
33""")
panel_36 = Panel("""0
18
19
20
21""")
panel_37 = Panel("""20
32""")
list_item_23 = ListItem(List=partition_list_2, Index=panel_32, Wrap=True)  # -> simplify(Item)
list_item_24 = ListItem(List=partition_list_2, Index=panel_31, Wrap=True)
list_item_25 = ListItem(List=partition_list_2, Index=panel_27, Wrap=True)
list_item_26 = ListItem(List=partition_list_2, Index=panel_33, Wrap=True)
list_item_27 = ListItem(List=partition_list_2, Index=panel_34, Wrap=True)
list_item_28 = ListItem(List=partition_list_2, Index=panel_28, Wrap=True)
list_item_29 = ListItem(List=partition_list_2, Index=panel_29, Wrap=True)
list_item_30 = ListItem(List=partition_list_2, Index=panel_30, Wrap=True)
list_item_31 = ListItem(List=partition_list_2, Index=panel_35, Wrap=True)
list_item_32 = ListItem(List=partition_list_2, Index=panel_36, Wrap=True)
list_item_33 = ListItem(List=partition_list_2, Index=panel_37, Wrap=True)
polyline = PolyLine(Vertices=list_item_24, Closed=False)
polyline_2 = PolyLine(Vertices=list_item_23, Closed=False)
polyline_3 = PolyLine(Vertices=list_item_25, Closed=False)
polyline_4 = PolyLine(Vertices=list_item_26, Closed=False)
polyline_5 = PolyLine(Vertices=list_item_27, Closed=False)
polyline_6 = PolyLine(Vertices=list_item_28, Closed=False)
polyline_7 = PolyLine(Vertices=list_item_29, Closed=False)
polyline_8 = PolyLine(Vertices=list_item_30, Closed=False)
polyline_9 = PolyLine(Vertices=list_item_31, Closed=False)
polyline_10 = PolyLine(Vertices=list_item_32, Closed=False)
polyline_11 = PolyLine(Vertices=list_item_33, Closed=False)
merge = Merge(
    Data1=polyline,
    Data2=polyline_2,
    Data3=polyline_3,
    Data4=polyline_4,
    Data5=polyline_5,
    Data6=polyline_6,
    Data7=polyline_7,
    Data8=polyline_8,
    Data9=polyline_9,
    Data10=polyline_10,
    Data11=polyline_11)

# ---- group: 肘关节夹角
polyline_12 = PolyLine(Vertices=list_item_7, Closed=False)
polyline_13 = PolyLine(Vertices=list_item_8, Closed=False)

polyline_14 = PolyLine(Vertices=list_item_19, Closed=False)
polyline_15 = PolyLine(Vertices=list_item_20, Closed=False)

# ---- group: 躯干-大腿夹角
polyline_16 = PolyLine(Vertices=list_item_16, Closed=False)
polyline_17 = PolyLine(Vertices=list_item_15, Closed=False)

# ---- group: 肩部夹角
polyline_18 = PolyLine(Vertices=list_item_11, Closed=False)
polyline_19 = PolyLine(Vertices=list_item_12, Closed=False)

# ----
addition = Addition(A=right_膝关节夹角, B=left_膝关节夹角)
division = Division(A=addition, B=2)
addition_2 = Addition(A=right_躯干_大腿夹角, B=left_躯干_大腿夹角)
division_2 = Division(A=addition_2, B=2)
addition_3 = Addition(A=right_肘关节夹角, B=left_肘关节夹角)
addition_4 = Addition(A=right_肩部关节夹角, B=left_肩部关节夹角)
subtraction_5 = Subtraction(A=division, B=90)
absolute = Absolute(Value=subtraction_5)
subtraction_6 = Subtraction(A=division_2, B=90)
absolute_2 = Absolute(Value=subtraction_6)
division_3 = Division(A=addition_3, B="360")
division_4 = Division(A=addition_4, B="360")
division_5 = Division(A=absolute, B=90)
division_6 = Division(A=absolute_2, B=90)
肘关节夹角均值_归一化 = Panel(division_3)
膝关节夹角与90度差_归一化 = Panel(division_5)
大腿_躯干与90度差_归一化 = Panel(division_6)
肩部关节夹角_归一化 = Panel(division_4)
addition_5 = Addition(A=division_5, B=division_6)
division_7 = Division(A=addition_5, B=2)
addition_6 = Addition(A=肩部关节夹角_归一化, B=肘关节夹角均值_归一化)
division_8 = Division(A=addition_6, B=2)

灵活度_归一化 = Panel(division_7)
思考强度_归一化 = Panel(division_8)

data_recorder_3 = DataRecorder(灵活度_归一化, DataLimit=-10, RecordData=True)
data_recorder_4 = DataRecorder(思考强度_归一化, DataLimit=-10, RecordData=True)
panel_38 = Panel(data_recorder_3)
partition_list_3 = PartitionList(List=panel_38, Size=Slider(25, range=0..100))
partition_list_4 = PartitionList(List=data_recorder_4, Size=Slider(25, range=0..100))
number_2 = Number(partition_list_3)
vector = Vector(rotate_axis.Geometry)
average_2 = Average(Input=number_2)
deplane_4 = DeconstructPlane(Plane=rotate_axis.Geometry)  # -> Origin, XAxis, YAxis, ZAxis
number_3 = Number(partition_list_4)
vector_display = VectorDisplay(Anchor=deplane_4.Origin, Vector=vector)
average_3 = Average(Input=number_3)
list_item_34 = ListItem(List=average_2, Index="-2", Wrap=True)
list_item_35 = ListItem(List=average_3, Index="-2", Wrap=True)
panel_39 = Panel(list_item_34)
panel_40 = Panel(list_item_35)

# ---- group: 头部向量
head = Panel("26")
left_eye = Panel("28")
right_eye = Panel("30")
list_item_36 = ListItem(List=partition_list_2, Index=head, Wrap=True)
list_item_37 = ListItem(List=partition_list_2, Index=left_eye, Wrap=True)
list_item_38 = ListItem(List=partition_list_2, Index=right_eye, Wrap=True)
plane_3pt = Plane3Pt(PointA=list_item_36, PointB=list_item_37, PointC=list_item_38)
polyline_20 = PolyLine(Vertices=[list_item_36, list_item_37, list_item_38], Closed="1")
polygon_center = PolygonCenter(Polyline=polyline_20)  # -> CenterV, CenterE, CenterA
vector_2 = Vector(plane_3pt)

# ----
panel_41 = Panel(list_item_36)

list_length = ListLength(List=flatten(list_item_36))
person_count = Panel(list_length)
equality = Equality(FirstNumber=person_count, SecondNumber="2")  # -> Equality, Inequality

list_item_39 = ListItem(List=flatten(polygon_center.CenterV), Index=0, Wrap=True)  # -> Item, Item1
list_item_40 = ListItem(List=flatten(vector_2), Index=0, Wrap=True)  # -> Item, Item1

# ---- group: 头部向量 (continued)
vector_display_2 = VectorDisplay(Anchor=list_item_39.Item, Vector=list_item_40.Item)

# ----
vector_display_3 = VectorDisplay(Anchor=list_item_39.Item1, Vector=list_item_40.Item1)

list_item_41 = ListItem(List=flatten(panel_41), Index=0, Wrap=True)  # -> Item, Item1
line = Line(StartPoint=list_item_41.Item, EndPoint=list_item_41.Item1)
line_2 = Line(StartPoint=list_item_41.Item1, EndPoint=list_item_41.Item)
list_item_42 = ListItem(List=flatten(vector_2), Index=0, Wrap=True)  # -> Item, Item1
vector_display_4 = VectorDisplay(Anchor=list_item_41.Item, Vector=line)
angle_9 = Angle(VectorA=line_2, VectorB=list_item_42.Item1)  # -> Angle, Reflex
angle_10 = Angle(VectorA=line, VectorB=list_item_42.Item)  # -> Angle, Reflex
angle_11 = Angle(VectorA=list_item_42.Item, VectorB=list_item_42.Item1)  # -> Angle, Reflex
degrees_9 = Degrees(Radians=angle_10.Angle)
degrees_10 = Degrees(Radians=angle_11.Angle)
degrees_11 = Degrees(Radians=angle_9.Angle)
阈值角度 = Slider(30, range=0..100)
夹角2 = Panel(degrees_11)
夹角1 = Panel(degrees_9)
夹角 = Panel(degrees_10)
smaller_than_2 = SmallerThan(FirstNumber=夹角2, SecondNumber=阈值角度)  # -> SmallerThan, OrEqualTo
smaller_than_3 = SmallerThan(FirstNumber=夹角1, SecondNumber=阈值角度)  # -> SmallerThan, OrEqualTo
gate_and = GateAnd(A=smaller_than_3.OrEqualTo, B=smaller_than_2.OrEqualTo)
是否交互 = Panel(gate_and)
# TBD!!
是否位于分隔两边 = Panel("True")
是否是两个人 = Panel(equality.Equality)
gate_not = GateNot(A=是否交互)
gate_and_2 = GateAnd(A=是否是两个人, B=是否位于分隔两边)
gate_and_3 = GateAnd(A=gate_and_2, B=gate_not)
是否需要分隔 = Panel(gate_and_3)
ghpython_script = GhPythonScript(x=person_count, y2=是否需要分隔)  # -> out, a; inputs x: Int32, y2: Boolean
# ---------- ghpython_script: Python ----------
__author__ = "YANGRUYI"
__version__ = "2024.06.24"

import rhinoscriptsyntax as rs

if x <= 1:
    a = 0
elif x == 2:
    a = y2
else: 
    a = 0
# ---------- end ghpython_script ----------
交往模式_interaction = Panel(ghpython_script.a)
