# Grasshopper definition input_emotion.gh (Grasshopper 1.0.7)
# plug-ins: gHowl

network_source = NetworkSource()  # -> NetworkAdapterIsUp, AdapterProperties, LocalIpAddress
panel = Panel(network_source.LocalIpAddress)
panel_2 = Panel(""" 
:""")
headset = Panel("9")
emotion = Panel("""1
3
5
7""")
headset_theshold_probability = Slider(1, range=0..10)

# ---- group: emotion
panel_3 = Panel("401")

# ----
udp_receiver = UDPReceiver(Address=network_source.LocalIpAddress, Port=panel_3, Pattern=0)  # -> Info, Data

# ---- group: emotion (continued)
# Joy:1
# Sorrow:1
# Anger:1
# Surprise:1
# Headwear:1
# 
# Joy:1
# Sorrow:1
# Anger:1
# Surprise:1
# Headwear:1
emotion_average = Panel(udp_receiver.Data)

# ----
data_recorder = DataRecorder(emotion_average, DataLimit=-10, RecordData=True)
panel_4 = Panel(data_recorder)
text_split = TextSplit(Text=emotion_average)
c_script = CSharpScript(x=text_split)  # -> out, a; inputs x: list of String
# ---------- c_script: C# usings ----------
using System.Linq;
# ---------- c_script: C# ----------
    List<List<string>> groups = new List<List<string>>();
    List<string> currentGroup = new List<string>();


    foreach (string item in x)
    {
      if (item == "")
      {
        if (currentGroup.Any())
        {
          groups.Add(currentGroup);
          currentGroup = new List<string>();
        }
      }
      else
      {
        currentGroup.Add(item);
      }
    }

    if (currentGroup.Any())
    {
      groups.Add(currentGroup);
    }

    List<string> combinedGroup = groups.Select(sublist => string.Join("\n", sublist)).ToList();
    a = combinedGroup.ToArray();
# ---------- end c_script ----------
text_split_2 = TextSplit(Text=c_script.a, Separators=panel_2)
panel_5 = Panel(c_script.a)
list_item = ListItem(List=text_split_2, Index=emotion, Wrap=True)
list_item_2 = ListItem(List=text_split_2, Index=headset, Wrap=True)
panel_6 = Panel(list_item)
headwear_probability = Panel(list_item_2)
larger_than = LargerThan(FirstNumber=list_item_2, SecondNumber=headset_theshold_probability)  # -> LargerThan, OrEqualTo
remap_numbers = RemapNumbers(Value=list_item, Source="1 to 5", Target="0.1 to 1")  # -> simplify(Mapped), Clipped
panel_7 = Panel(larger_than.OrEqualTo)
dispatch = Dispatch(List=remap_numbers.Mapped, DispatchPattern=larger_than.OrEqualTo)  # -> simplify(ListA), ListB
# 特殊情况考虑：
# 没有人或者识别到两个人戴眼镜（去均值）
emotion_headset = Panel(dispatch.ListA)

# ---- group: 求平均
flip_matrix = FlipMatrix(Data=dispatch.ListA)
number = Number(flip_matrix)
average = Average(Input=number)

flip_matrix_2 = FlipMatrix(Data=remap_numbers.Mapped)
number_2 = Number(flip_matrix_2)
average_2 = Average(Input=number_2)

# ----
list_item_3 = ListItem(List=flatten(average), Index=0, Wrap=True)  # -> Item, Item1, Item2, Item3
list_item_4 = ListItem(List=flatten(average_2), Index=0, Wrap=True)  # -> Item, Item1, Item2, Item3

# ---- group: emtion headset
sorrow = Panel(list_item_3.Item1)
anger = Panel(list_item_3.Item2)
surprise = Panel(list_item_3.Item3)
joy = Panel(list_item_3.Item)

# ---- group: emtion average
anger_2 = Panel(list_item_4.Item2)
joy_2 = Panel(list_item_4.Item)
sorrow_2 = Panel(list_item_4.Item1)
surprise_2 = Panel(list_item_4.Item3)
